# Grasshopper definition beam_maker.ghx (Grasshopper 1.0.7)
# plug-ins: Human

number_slider = Slider(0.07, range=0..0.1)
number_slider_2 = Slider(0.2, range=0..1)
subtraction = Subtraction(A=number_slider_2, B=number_slider)
crv = Curve([<curve referenced from the Rhino model> x4])
crv_2 = Curve([<curve referenced from the Rhino model> x2])
subtraction_2 = Subtraction(A=number_slider_2, B=number_slider)
crv_3 = Curve(<curve referenced from the Rhino model>)
subtraction_3 = Subtraction(A=number_slider_2, B=number_slider)
num = Number(Slider(0.1, range=0..0.1))
crv_4 = Curve([<curve referenced from the Rhino model> x2])
num_2 = Number(Slider(0.05, range=0..0.1))
merge = Merge(Data1="0.075", Data2=subtraction)
merge_2 = Merge(Data1=subtraction_2, Data2="0.0", Data3="0.0", Data4=subtraction_2)
entwine = Entwine(Branch00=crv, Branch01=crv_2, FlattenInputs=True)
crv_5 = Curve([<curve referenced from the Rhino model> x14])
crv_6 = Curve([<curve referenced from the Rhino model> x4])
merge_3 = Merge(Data1=subtraction_3, Data2="0", Data3="0", Data4=subtraction_3)
num_3 = Number(merge)
num_4 = Number(merge_2)
num_5 = Number(Slider(0.03, range=0..0.1))
crv_7 = Curve(crv_5)
num_6 = Number(number_slider_2)
num_7 = Number(number_slider_2)
crv_8 = Curve(crv_4)
crv_9 = Curve(reparameterize(crv_8))
flatten = FlattenTree(Tree=entwine, Path="{0}")
num_8 = Number(number_slider_2)
num_9 = Number(merge_3)
num_10 = Number(subtraction_3)
crv_10 = Curve(crv_3)
crv_11 = Curve(crv_6)
crv_12 = Curve(reparameterize(crv_11))
entwine_2 = Entwine(Branch00=crv_12, Branch01=crv_9, FlattenInputs=True)
flatten_2 = FlattenTree(Tree=entwine_2, Path="{0}")
num_11 = Number(num_6)
crv_13 = Curve(flatten_2)
crv_14 = Curve(flatten)
crv_15 = Curve(crv_7)
num_12 = Number(num_3)
offset = OffsetCurve(Curve=crv_10, Distance="0.25", Plane=PlaneXY(0, 0, 0), Corners=1)
crv_16 = Curve(crv_8)
num_13 = Number(num_4)
num_14 = Number(num_6)
num_15 = Number(num_7)
crv_17 = Curve(crv_7)
crv_18 = Curve(crv_8)
Z = UnitZ(Factor=num_11)
crv_19 = Curve(crv_11)
num_16 = Number(num_9)
crv_20 = Curve(reparameterize(crv_14))
num_17 = Number(num_8)
crv_21 = Curve(crv_11)
Z_2 = UnitZ(Factor=num_14)
Z_3 = UnitZ(Factor=num_12)
Z_4 = UnitZ(Factor=num_15)
Z_5 = UnitZ(Factor=num_13)
move = Move(Geometry=offset, Motion=Z)  # -> Geometry, Transform
Z_6 = UnitZ(Factor=num_17)
Z_7 = UnitZ(Factor=num_16)
graft = GraftTree(Tree=crv_20, IncludeEmptyLists=True, IncludeNullItems=True)
cp = ControlPoints(Curve=crv_15)  # -> Points, Weights, Knots
cp_2 = ControlPoints(Curve=crv_16)  # -> Points, Weights, Knots
Z_8 = UnitZ(Factor="0.05")
cp_3 = ControlPoints(Curve=crv_19)  # -> Points, Weights, Knots
boundary = BoundarySurfaces(Edges=move.Geometry)
ccx = CurveCurve(CurveA=graft, CurveB=crv_13)  # -> simplify(Points), ParamsA, ParamsB
move_2 = Move(Geometry=cp.Points, Motion=Z_3)  # -> Geometry, Transform
move_3 = Move(Geometry=cp_2.Points, Motion=Z_5)  # -> Geometry, Transform
move_4 = Move(Geometry=crv_17, Motion=Z_2)  # -> Geometry, Transform
move_5 = Move(Geometry=crv_18, Motion=Z_4)  # -> Geometry, Transform
move_6 = Move(Geometry=cp_3.Points, Motion=Z_7)  # -> Geometry, Transform
move_7 = Move(Geometry=crv_21, Motion=Z_6)  # -> Geometry, Transform
pt = Point(ccx.Points)
num_18 = Number(ccx.ParamsA)
pline = PolyLine(Vertices=move_2.Geometry, Closed=False)
pline_2 = PolyLine(Vertices=move_3.Geometry, Closed=False)
extr = Extrude(Base=boundary, Direction=Z_8)
pline_3 = PolyLine(Vertices=move_6.Geometry, Closed=False)
crv_22 = Curve(pline)
crv_23 = Curve(move_4.Geometry)
crv_24 = Curve(pline_2)
crv_25 = Curve(move_5.Geometry)
pt_2 = Point(pt)
crv_26 = Curve(pline_3)
crv_27 = Curve(move_7.Geometry)
brep = Brep(extr)
graft_2 = GraftTree(Tree=pt_2, IncludeEmptyLists=True, IncludeNullItems=True)
crv_28 = Curve(crv_22)
crv_29 = Curve(crv_23)
crv_30 = Curve(crv_24)
crv_31 = Curve(crv_25)
crv_32 = Curve(crv_26)
crv_33 = Curve(crv_27)
graft_3 = GraftTree(Tree=crv_29, IncludeEmptyLists=True, IncludeNullItems=True)
graft_4 = GraftTree(Tree=crv_31, IncludeEmptyLists=True, IncludeNullItems=True)
graft_5 = GraftTree(Tree=crv_33, IncludeEmptyLists=True, IncludeNullItems=True)
match = MatchTree(Tree=crv_28, Guide=graft_3)
match_2 = MatchTree(Tree=crv_30, Guide=graft_4)
match_3 = MatchTree(Tree=crv_32, Guide=graft_5)
merge_4 = Merge(Data1=match, Data2=graft_3)
merge_5 = Merge(Data1=match_2, Data2=graft_4)
merge_6 = Merge(Data1=match_3, Data2=graft_5)
loft = Loft(Curves=merge_4, Options={Adjust=False, Closed=False, LoftEnds=0, LoftSimp=0, LoftType=0, Rebuild=10, Refit=0.01})
loft_2 = Loft(Curves=merge_5, Options={Adjust=False, Closed=False, LoftEnds=0, LoftSimp=0, LoftType=0, Rebuild=10, Refit=0.01})
crv_34 = Curve(match_3)
crv_35 = Curve(crv_34)
crv_36 = Curve(merge_6)
crv_37 = Curve(match)
crv_38 = Curve(match_2)
crv_39 = Curve(crv_38)
entwine_3 = Entwine(Branch00=crv_35, Branch01=crv_39, FlattenInputs=True)
flatten_3 = FlattenTree(Tree=entwine_3, Path="{0}")
crv_40 = Curve(flatten_3)
crv_41 = Curve(crv_40)
crv_cp = CurveClosestPoint(Point=graft_2, Curve=crv_41)  # -> Point, Parameter, Distance
sort = SortList(Keys=crv_cp.Distance, ValuesA=crv_cp.Point)  # -> Keys, ValuesA
item = ListItem(List=sort.Keys, Index=0, Wrap=True)  # -> simplify(Item)
item_2 = ListItem(List=sort.ValuesA, Index=0, Wrap=True)  # -> simplify(Item)
trim = TrimTree(Tree=item, Depth=1)
num_19 = Number(trim)
srf = Surface(loft)
srf_2 = Surface(loft_2)
num_20 = Number(num_2)
crv_42 = Curve(crv_36)
srf_3 = Surface(srf)
srf_4 = Surface(srf_2)
num_21 = Number(num_5)
num_22 = Number(num)
division = Division(A=num_20, B="2")
num_23 = Number(num_10)
planar = IsPlanar(Surface=srf_3, Interior=True)  # -> Planar, Plane
num_24 = Number(num_19)
planar_2 = IsPlanar(Surface=srf_4, Interior=True)  # -> Planar, Plane
division_2 = Division(A=num_21, B=2)
division_3 = Division(A=num_22, B=2)
neg = Negative(Value=division)
deplane = DeconstructPlane(Plane=planar.Plane)  # -> Origin, XAxis, YAxis, unitize(ZAxis)
deplane_2 = DeconstructPlane(Plane=planar_2.Plane)  # -> Origin, XAxis, YAxis, unitize(ZAxis)
clean = CleanTree(RemoveNulls=True, RemoveInvalid=True, RemoveEmpty=True, Tree=num_24)  # -> simplify(Tree)
neg_2 = Negative(Value=division_2)
neg_3 = Negative(Value=division_3)
offset_2 = OffsetCurve(Curve=crv_42, Distance=neg, Plane=PlaneXY(0, 0, 0), Corners=1)
offset_3 = OffsetCurve(Curve=crv_42, Distance=division, Plane=PlaneXY(0, 0, 0), Corners=1)
multiplication = Multiplication(A=deplane.ZAxis, B=neg_2)
pshift = ShiftPaths(Data=clean, Offset=-1)
multiplication_2 = Multiplication(A=deplane_2.ZAxis, B=neg_3)
multiplication_3 = Multiplication(A=deplane.ZAxis, B=num_21)
multiplication_4 = Multiplication(A=deplane_2.ZAxis, B=num_22)
merge_7 = Merge(Data1=offset_3, Data2=offset_2)
lng = ListLength(List=pshift)
panel = Panel("""0
-1""")
panel_2 = Panel("""0.0
1.0""")
num_25 = Number(num_18)
move_8 = Move(Geometry=srf_3, Motion=multiplication)  # -> Geometry, Transform
move_9 = Move(Geometry=srf_4, Motion=multiplication_2)  # -> Geometry, Transform
loft_3 = Loft(Curves=merge_7, Options={Adjust=False, Closed=False, LoftEnds=0, LoftSimp=0, LoftType=0, Rebuild=10, Refit=0.01})  # -> simplify(Loft)
one_over_x = OneOverX(Value=lng)
clean_2 = CleanTree(RemoveNulls=True, RemoveInvalid=True, RemoveEmpty=True, Tree=num_25)  # -> simplify(Tree)
extr_2 = Extrude(Base=move_8.Geometry, Direction=multiplication_3)
extr_3 = Extrude(Base=move_9.Geometry, Direction=multiplication_4)
trim_2 = TrimTree(Tree=loft_3, Depth=1)
multiplication_5 = Multiplication(A=pshift, B=one_over_x)
pshift_2 = ShiftPaths(Data=clean_2, Offset=-1)
loft_4 = Loft(Curves=trim_2, Options={Adjust=False, Closed=False, LoftEnds=0, LoftSimp=0, LoftType=0, Rebuild=10, Refit=0.01})
brep_2 = Brep(extr_2)
brep_3 = Brep(extr_3)
division_4 = Division(A=multiplication_5, B=3)
ins = InsertItems(List=pshift_2, Item=panel_2, Indices=panel, Wrap=True)
match_4 = MatchTree(Tree=loft_4, Guide=trim_2)
addition = Addition(A=division_4, B=pshift)
ins_2 = InsertItems(List=addition, Item=num_23, Indices=panel, Wrap=True)
merge_8 = Merge(Data1=trim_2, Data2=match_4)
sort_2 = SortList(Keys=ins, ValuesA=ins_2)  # -> Keys, ValuesA
join = BrepJoin(Breps=merge_8)  # -> Breps, Closed
num_26 = Number(sort_2.ValuesA)
num_27 = Number(sort_2.Keys)
brep_4 = Brep(join.Breps)
crv_43 = Curve(reparameterize(crv_14))
num_28 = Number(num_27)
num_29 = Number(num_26)
crv_44 = Curve(reparameterize(crv_14))
num_30 = Number(num_8)
graft_6 = GraftTree(Tree=crv_43, IncludeEmptyLists=True, IncludeNullItems=True)
Z_9 = UnitZ(Factor=num_30)
Z_10 = UnitZ(Factor=num_29)
eval = EvaluateCurve(Curve=graft_6, Parameter=num_28)  # -> Point, Tangent, Angle
move_10 = Move(Geometry=eval.Point, Motion=Z_10)  # -> Geometry, Transform
move_11 = Move(Geometry=crv_44, Motion=Z_9)  # -> Geometry, Transform
pline_4 = PolyLine(Vertices=move_10.Geometry, Closed=False)
crv_45 = Curve(pline_4)
crv_46 = Curve(move_11.Geometry)
crv_47 = Curve(crv_45)
crv_48 = Curve(crv_46)
graft_7 = GraftTree(Tree=crv_48, IncludeEmptyLists=True, IncludeNullItems=True)
match_5 = MatchTree(Tree=crv_47, Guide=graft_7)
merge_9 = Merge(Data1=match_5, Data2=graft_7)
crv_49 = Curve(merge_9)
num_31 = Number(num_2)
crv_50 = Curve(crv_49)
division_5 = Division(A=num_31, B="2")
neg_4 = Negative(Value=division_5)
offset_4 = OffsetCurve(Curve=crv_50, Distance=neg_4, Plane=PlaneXY(0, 0, 0), Corners=1)
offset_5 = OffsetCurve(Curve=crv_50, Distance=division_5, Plane=PlaneXY(0, 0, 0), Corners=1)
merge_10 = Merge(Data1=offset_5, Data2=offset_4)  # -> simplify(Result)
loft_5 = Loft(Curves=merge_10, Options={Adjust=False, Closed=False, LoftEnds=0, LoftSimp=0, LoftType=0, Rebuild=10, Refit=0.01})  # -> simplify(Loft)
graft_8 = GraftTree(Tree=merge_10, IncludeEmptyLists=True, IncludeNullItems=True)
path_mapper = PathMapper(graft_8, source="{A;B;C}", target="{A;C}")
loft_6 = Loft(Curves=path_mapper, Options={Adjust=False, Closed=False, LoftEnds=0, LoftSimp=0, LoftType=0, Rebuild=10, Refit=0.01})  # -> simplify(Loft)
trim_3 = TrimTree(Tree=loft_5, Depth=1)
trim_4 = TrimTree(Tree=loft_6, Depth=1)
match_6 = MatchTree(Tree=trim_4, Guide=trim_3)
merge_11 = Merge(Data1=trim_3, Data2=match_6)
join_2 = BrepJoin(Breps=merge_11)  # -> Breps, Closed
capex = CapHolesEx(Brep=join_2.Breps)  # -> Brep, Caps, Solid
brep_5 = Brep(capex.Brep)
swatch = ColourSwatch(SwatchColor=RGB(230, 171, 9))
swatch_2 = ColourSwatch(SwatchColor=RGB(153, 119, 6))
brep_6 = Brep(brep_3)
brep_7 = Brep(brep_3)
brep_8 = Brep(brep_4)
brep_9 = Brep(brep_2)
brep_10 = Brep(brep_5)
brep_11 = Brep(brep_4)
brep_12 = Brep(brep_5)
brep_13 = Brep(brep)
entwine_4 = Entwine(Branch00=brep_6, Branch01=brep_8, Branch02=brep_10, Branch03=brep_9, FlattenInputs=True)
entwine_5 = Entwine(Branch00=swatch, Branch01=swatch, FlattenInputs=True)
entwine_6 = Entwine(Branch00=brep_7, Branch01=brep_11, Branch02=brep_12, FlattenInputs=True)
entwine_7 = Entwine(
    Branch00=ColourSwatch(SwatchColor=RGB(6, 67, 153)),
    Branch01=ColourSwatch(SwatchColor=RGB(9, 101, 230)),
    FlattenInputs=True)
entwine_8 = Entwine(
    Branch00=ColourSwatch(SwatchColor=RGB(80, 6, 153)),
    Branch01=ColourSwatch(SwatchColor=RGB(185, 9, 230)),
    FlattenInputs=True)
entwine_9 = Entwine(
    Branch00=ColourSwatch(SwatchColor=RGB(117, 117, 117)),
    Branch01=ColourSwatch(SwatchColor=RGB(173, 173, 173)),
    FlattenInputs=True)
wires = BrepWireframe(Brep=entwine_6, Density=-1)
wires_2 = BrepWireframe(Brep=brep_13, Density=-1)
material = CreateMaterial(
    Diffuse=ColourSwatch(SwatchColor=RGB(217, 209, 191)),
    Specular=RGB(255, 255, 255),
    Emission=RGB(0, 0, 0),
    Transparency=0,
    Shine="50")
material_2 = CreateMaterial(
    Diffuse=ColourSwatch(SwatchColor=RGB(199, 199, 199)),
    Specular=RGB(255, 255, 255),
    Emission=RGB(0, 0, 0),
    Transparency="0.5",
    Shine=0)
previewlw = CustomPreviewLineweights(Geometry=wires, Shader=ColourSwatch(SwatchColor=RGB(0, 0, 0)), Thickness="3", Absolute=False)
preview = CustomPreview(Geometry=entwine_4, Material=material)
previewlw_2 = CustomPreviewLineweights(Geometry=wires_2, Shader=ColourSwatch(SwatchColor=RGB(0, 0, 0)), Thickness="3", Absolute=False)
preview_2 = CustomPreview(Geometry=brep_13, Material=material_2)
