# Grasshopper definition circle_make.gh (Grasshopper 1.0.7)

number = Number(Slider(23.86, range=0..100))
number_2 = Number(Slider(42, range=0..100))
number_3 = Number(Slider(2, range=0..2))
num = Number(number)
num_2 = Number(number_3)
num_3 = Number(number_2)
polygon = Polygon(Plane=PlaneXY(0, 0, 0), Radius=num, Segments=num_3, FilletRadius=0)  # -> Polygon, Length
construct_point = ConstructPoint(XCoordinate=0, YCoordinate=0, ZCoordinate=0)
explode = Explode(Curve=polygon.Polygon, Recursive=True)  # -> Segments, Vertices
line = Line(StartPoint=construct_point, EndPoint=explode.Vertices)
divide_length = DivideLength(Curve=line, Length=num_2)  # -> Points, Tangents, Parameters
list_length = ListLength(List=divide_length.Points)
graft_tree = GraftTree(Tree=line, IncludeEmptyLists=True, IncludeNullItems=True)
divide_curve = DivideCurve(Curve=graft_tree, Count=list_length, Kinks=False)  # -> Points, Tangents, Parameters
cull_index = CullIndex(List=divide_curve.Points, Indices="0", Wrap=True)
flip_matrix = FlipMatrix(Data=divide_curve.Points)
polyline = PolyLine(Vertices=divide_curve.Points, Closed=False)
polyline_2 = PolyLine(Vertices=flip_matrix, Closed=False)
explode_2 = Explode(Curve=polyline, Recursive=True)  # -> flatten(Segments), simplify(Vertices)
relative_item = RelativeItem(Tree=explode_2.Vertices, Offset="{1}[1]", WrapPaths=True, WrapItems=False)  # -> ItemA, ItemB
explode_3 = Explode(Curve=[polyline_2, polyline], Recursive=True)  # -> flatten(Segments), Vertices
line_2 = Line(StartPoint=relative_item.ItemA, EndPoint=relative_item.ItemB)
entwine = Entwine(Branch00=explode_3.Segments, Branch01=line_2, FlattenInputs=True)  # -> flatten(Result)
clean_tree = CleanTree(RemoveNulls=True, RemoveInvalid=True, RemoveEmpty=True, Tree=entwine)
crv = Curve(clean_tree)
