# Grasshopper definition grid_patcher.ghx (Grasshopper 1.0.7)
# plug-ins: Human, Weaverbird, Kangaroo2 Components

panel = Panel("/Users/arpj/code/libraries/variational_clustering/data/json_files/perimeter_supported_slab_k_3_smooth_20.json")
panel_2 = Panel("/Users/arpj/code/libraries/variational_clustering/data/json_files/four_point_slab_k_3_smooth_20.json")
panel_3 = Panel("/Users/arpj/code/libraries/variational_clustering/data/json_files/topleft_supported_slab_k_2_smooth_20.json")
panel_4 = Panel("/Users/arpj/code/libraries/variational_clustering/data/json_files/leftright_supported_slab_k_3_smooth_20.json")
panel_5 = Panel("/Users/arpj/code/libraries/variational_clustering/data/json_files/bottomleftright_supported_slab_k_3_smooth_20.json")
panel_6 = Panel("/Users/arpj/code/libraries/variational_clustering/data/json_files/middle_supported_slab_cantilever_k_2_smooth_20.json")
panel_7 = Panel("/Users/arpj/code/libraries/variational_clustering/data/json_files/triangle_supported_slab_cantilever_k_2_smooth_20.json")

panel_9 = Panel("/Users/arpj/code/libraries/directional_clustering/data/json_files/perimeter_supported_slab_k_3.json")
simplification_tol_left_right = Slider(0.15, range=0..1)
simplification_tol_middle_cantilever = Slider(0.1, range=0..1)
booleanable_second_round_perimeter = Panel("""1
2""")
booleanable_second_round_middle_cantilev = Panel("""2
3""")  # "booleanable second round middle cantilever"

booleanable_firstt_round_4ps = Panel("5")
booleanable_second_round_4ps = Panel("""7
8""")

booleanable_second_round_leftright = Panel("4")

booleanable_second_round_tringle_cantile = Panel("""2
0""")  # "booleanable second round tringle cantilever"
booleanable_first_round_triangle_cantile = Panel("5")  # "booleanable first round triangle cantilever"

lines_grids = Slider(60, range=0..100)
trim_parameter = Slider(0.04, range=0..0.1)
convex_hull_or_naked_boundary = BooleanToggle(True)
swatch = ColourSwatch(SwatchColor=RGB(0, 0, 0))
simplification_tol = Slider(0, range=0..1)

# ---- group: spacings
number_slider = Slider(0.8, range=0..1)
number_slider_2 = Slider(0.7, range=0..1)

# ----
txt = Text(panel_9)
subtraction = Subtraction(A="1", B=Slider(0.5, range=0..1))
txt_2 = Text(txt)
num = Number("4.5")
num_2 = Number("6.0")
num_3 = Number(Slider(23, range=0..100))
python = GhPythonScript(path=txt_2)  # -> out, mesh
# ---------- python: Python ----------
from compas.datastructures import Mesh

mesh = Mesh.from_json(path)
# ---------- end python ----------
panel_10 = Panel("7.0")
num_4 = Number(num)
num_5 = Number(num_3)
num_6 = Number(num_2)
bool = Boolean(convex_hull_or_naked_boundary)
int = Integer()
int_2 = Integer(booleanable_second_round_4ps)
num_7 = Number(simplification_tol)
num_8 = Number(subtraction)
num_9 = Number(lines_grids)
num_10 = Number(trim_parameter)
num_11 = Number(num_10)
neg = Negative(Value=num_11)
panel_11 = Panel(python.out)
X = UnitX(Factor="0.0")
data = Data(python.mesh)
python_2 = GhPythonScript(bound_x=num_4, bound_y=num_6, num=num_5)  # -> out, grid; inputs num: Int32
# ---------- python_2: Python ----------
import rhinoscriptsyntax as rs



x = 0.0
y = 0.0

delta_x = bound_x  / num
# delta_y = bound_y * 2 / num
delta_y = delta_x

points_pos = []
num = int(num / 2.0)
for step in range(1, num + 1):
    x += delta_x
    points_pos.append(x)

points_neg = [-x for x in points_pos[::-1]]
x_base_points = points_neg + [0.0] + points_pos


y_points_pos = []
num = int(bound_y / (2*delta_y))

y = 0.0
for step in range(1, num + 1):
    y += delta_y
    y_points_pos.append(y)

y_points_neg = [-x for x in y_points_pos[::-1]]
y_base_points = y_points_neg + [0.0] + y_points_pos


print("delta x", delta_x)
print("delta y", delta_y)

grid = []
for xpt in x_base_points:
    polyline = []
    for ypt in y_base_points:
        polyline.append([xpt, ypt, 0.0])
    
    grid.append(rs.AddPolyline(polyline))
# ---------- end python_2 ----------
data_2 = Data(data)
crv = Curve(python_2.grid)
data_3 = Data(python_2.out)
panel_12 = Panel("""4
2""")
Z = UnitZ(Factor=1)
python_3 = GhPythonScript(mesh=data_2)  # -> out, labels, angles
# ---------- python_3: Python ----------
labels = set(mesh.faces_attribute(keys=mesh.faces(), name="cluster"))
angles = set(mesh.faces_attribute(keys=mesh.faces(), name="cluster_angle_x"))
# ---------- end python_3 ----------
swatch_2 = ColourSwatch(SwatchColor=RGB(255, 255, 255))
line = LineSDL(Start=Z, Direction=Vector(0, 0, 1), Length=1)
multiplication = Multiplication(A=panel_12, B=Slider(2, range=0..10))
num_12 = Number(python_3.labels)
num_13 = Number(python_3.angles)
crv_2 = Curve(crv)
explode = Explode(Curve=crv_2, Recursive=True)  # -> Segments, Vertices
data_4 = Data(data)
num_14 = Number(num_12)
flip = FlipMatrix(Data=explode.Vertices)
python_4 = GhPythonScript(mesh=data_4, labels=num_14)  # -> out, gh_meshes, angles; inputs labels: list
# ---------- python_4: Python ----------
from compas.datastructures import Mesh
# from compas.datastructures import mesh_connected_components
from compas_ghpython.artists import MeshArtist

gh_meshes = []
angles = []

for label in labels:
    kfkeys = list(mesh.faces_where({"cluster": label}))
    kpolygons = [mesh.face_coordinates(fkey) for fkey in kfkeys]
    kangle = list(set([mesh.face_attribute(fkey, "cluster_angle_x") for fkey in kfkeys])).pop()
    
    
    
    pmesh = Mesh.from_polygons(kpolygons)
    
    artist = MeshArtist(pmesh)
    
    # should have equal length
    gh_meshes.append(artist.draw())
    angles.append(kangle)
    
    assert len(gh_meshes) == len(angles)
# ---------- end python_4 ----------
panel_13 = Panel(num_14)
pline = PolyLine(Vertices=flip, Closed=False)
explode_2 = Explode(Curve=pline, Recursive=True)  # -> Segments, Vertices
data_5 = Data(python_4.gh_meshes)
num_15 = Number(python_4.angles)
entwine = Entwine(Branch00=explode.Segments, Branch01=explode_2.Segments, FlattenInputs=True)
panel_14 = Panel(num_15)
data_6 = Data(data_5)
crv_3 = Curve(entwine)
disjoint = DisjointMesh(Mesh=data_6)
mesh = Mesh(disjoint)
crv_4 = Curve(crv_3)
num_16 = Number(num_10)
mesh_2 = Mesh(mesh)
neg_2 = Negative(Value=num_16)
num_17 = Number(num_7)
explode_3 = Explode(Curve=crv_4, Recursive=True)  # -> Segments, Vertices
mesh_3 = Mesh(mesh)
nv = NakedVertices(Mesh=mesh_2)  # -> ClothedIndex, NakedIndex, ClothedPts, NakedPts
trim = TrimTree(Tree=explode_3.Segments, Depth=1)
wbnaked = WeaverbirdsNakedBoundary(MeshClosedPolylines=mesh_3)
entwine_2 = Entwine(Branch00="0", Branch01=neg_2, FlattenInputs=True)
redpline = Reduce(Polyline=wbnaked, Tolerance=num_17)  # -> Polyline, Reduction
pt = Point(nv.NakedPts)
ext = ExtendCurve(Curve=trim, Type=0, Start=entwine_2, End=entwine_2)
hull = ConvexHull(Points=pt, Plane=PlaneXY(0, 0, 0))  # -> Hull, HullZ, Indices
crv_5 = Curve(redpline.Polyline)
crv_6 = Curve(hull.Hull)

int_3 = Integer(Slider(7, range=0..10))
geo = Geometry(crv_6)
int_4 = Integer(int_3)
tstat = TreeStatistics(Tree=geo)  # -> Paths, Length, Count
item = ListItem(List=tstat.Paths, Index=int_4, Wrap=True)
branch = TreeBranch(Tree=geo, Path=item, MaintainPaths=True)
geo_2 = Geometry(branch)  # disabled

crv_7 = Curve(ext)
crv_8 = Curve(crv_3)
crv_9 = Curve(simplify(crv_6))
int_5 = Integer(int)
crv_10 = Curve(crv_7)
clean = CleanTree(RemoveNulls=True, RemoveInvalid=True, RemoveEmpty=False, Tree=crv_8)
flatten = FlattenTree(Tree=crv_9, Path="{0}")
X_2 = UnitX(Factor="7.0")
python_5 = GhPythonScript(regions=flatten, tol="0.001", booleanable=int_5)  # -> out, a; inputs regions: list, booleanable: list of Int32
# ---------- python_5: Python ----------
__author__ = "arpj"

import rhinoscriptsyntax as rs

a = []
booleanable = set(booleanable)

for idx, region in enumerate(regions):
    
    if idx not in booleanable:
        a.append(region)
        continue

    other_regions = [r for r in regions if r != region]
    
    for other_region in other_regions:
        
        difference = rs.CurveBooleanDifference(region, other_region, tol)
        print('diff', len(difference))
        
        if len(difference) < 1:
            continue
           
        region = difference[0]

    a.append(region)
# ---------- end python_5 ----------
len = Length(Curve=clean)
move = Move(Geometry=crv_10, Motion=X_2)  # -> Geometry, Transform
match = MatchTree(Tree=graft(python_5.a), Guide=crv_9)
crv_11 = Curve(move.Geometry)
ma = MassAddition(Input=len)  # -> Result, PartialResults
crv_12 = Curve(match)
crv_13 = Curve(simplify(crv_12))
int_6 = Integer(int_2)
crv_14 = Curve(crv_11)
panel_15 = Panel("""4
2""")
flatten_2 = FlattenTree(Tree=crv_13, Path="{0}")
data_7 = Data(data_3)
python_6 = GhPythonScript(regions=flatten_2, tol="0.001", booleanable=int_6)  # -> out, a; inputs regions: list, booleanable: list of Int32; same code as python_5
previewlw = CustomPreviewLineweights(Geometry=crv_14, Shader=ColourSwatch(SwatchColor=RGB(255, 255, 255)), Thickness=graft(panel_15), Absolute=False)
panel_16 = Panel(data_7)
total_length_ortho = Panel(ma.Result)
match_2 = MatchTree(Tree=graft(python_6.a), Guide=crv_13)
panel_17 = Panel(python_6.out)
crv_15 = Curve(match_2)

mesh_4 = Mesh(flatten(mesh))
crv_16 = Curve(hull.Hull)
crv_17 = Curve(crv_15)
tstat_2 = TreeStatistics(Tree=mesh_4)  # -> Paths, Length, Count
ma_2 = MassAddition(Input=tstat_2.Length)  # -> Result, PartialResults
range = Range(Domain=Domain(0, 1), Steps=ma_2.Result)
gradient = Gradient(
    LowerLimit=0,
    UpperLimit=1,
    Parameter=range,
    stops=[0: RGB(243, 57, 0), 0.1: RGB(236, 27, 60), 0.2: RGB(210, 0, 118), 0.3: RGB(103, 0, 120), 0.4: RGB(39, 72, 161), 0.5: RGB(1, 192, 229), 0.6: RGB(18, 178, 90), 0.7: RGB(79, 186, 8), 0.8: RGB(220, 237, 32), 0.9: RGB(247, 159, 20), 1: RGB(243, 57, 0)])
jitter = Jitter(List=gradient, Jitter=1, Seed=2)  # -> Values, Indices
col = Colour(jitter.Values)
col_2 = Colour(col)
area = Area(Geometry=mesh_4)  # -> Area, Centroid
flatten_3 = FlattenTree(Tree=mesh_4, Path="{0}")
panel_18 = Panel("6")  # disabled
panel_19 = Panel("6")  # disabled
panel_20 = Panel("0.5")  # disabled
preview = CustomPreview(Geometry=flatten_3, Material=col_2)  # disabled
points = PointList(Points=area.Centroid, Size=panel_20)  # disabled
previewlw_2 = CustomPreviewLineweights(Geometry=crv_17, Shader=ColourSwatch(SwatchColor=RGB(184, 184, 184)), Thickness=panel_18, Absolute=False)  # disabled
previewlw_3 = CustomPreviewLineweights(Geometry=crv_16, Shader=ColourSwatch(SwatchColor=RGB(0, 0, 0)), Thickness=panel_19, Absolute=False)  # disabled

bool_2 = Boolean(bool)
crv_18 = Curve(match_2)
crv_19 = Curve(crv_5)
graft = GraftTree(Tree=crv_19, IncludeEmptyLists=True, IncludeNullItems=True)
match_3 = MatchTree(Tree=graft, Guide=crv_18)
filter = StreamFilter(Gate=bool_2, Stream0=crv_18, Stream1=match_3)
crv_20 = Curve(filter)
crv_21 = Curve(crv_20)
num_18 = Number(num_15)
num_19 = Number(num_9)
num_20 = Number(num_8)
area_2 = Area(Geometry=crv_21)  # -> Area, Centroid
rad = Radians(Degrees=num_18)
python_7 = GhPythonScript(spacing=num_20, amount=num_19)  # -> out, grid; inputs amount: Int32
# ---------- python_7: Python ----------
import rhinoscriptsyntax as rs

points_pos = []

x = 0.0
amount = int(amount / 2)
for delta in range(1, amount + 1):
    x += spacing
    points_pos.append(x)
    
points_neg = [-x for x in points_pos[::-1]]
base_points = points_neg + [0.0] + points_pos

grid = []
for xpt in base_points:
    polyline = []
    for ypt in base_points:
        polyline.append([xpt, ypt, 0.0])
    grid.append(rs.AddPolyline(polyline))
# ---------- end python_7 ----------
graft_2 = GraftTree(Tree=num_18, IncludeEmptyLists=True, IncludeNullItems=True)
xy = XYPlane(Origin=area_2.Centroid)
data_8 = Data(xy)
crv_22 = Curve(python_7.grid)
python_8 = GhPythonScript(x=xy, y=graft_2)  # -> out, a; inputs x: tree, y: tree
# ---------- python_8: Python ----------
import rhinoscriptsyntax as rs
import clr
clr.AddReference("Grasshopper")
import Grasshopper.Kernel.Data.GH_Path as ghpath
import Grasshopper.DataTree as datatree
import System
 

a = datatree[System.Object]()

x_path_indices = max([path.Length for path in x.Paths])
y_path_indices = max([path.Length for path in y.Paths])

path_difference = x_path_indices - y_path_indices

for path in x.Paths:
    if path_difference == 0:
        newpath = path
    else:
        newpath = ghpath(*path.Indices[:-path_difference])
        
    # newpath = path.Indices[:]
    print(newpath)
    a.AddRange(x.Branch(path), newpath)
# ---------- end python_8 ----------
trim_2 = TrimTree(Tree=data_8, Depth=1)
trim_3 = TrimTree(Tree=python_8.a, Depth=1)
lng = ListLength(List=trim_3)
branch_2 = TreeBranch(Tree=trim_2, Path=Slider(0, range=0..10), MaintainPaths=True)
dup = DuplicateData(Data=graft_2, Number=lng, Order=True)
data_9 = Data(branch_2)
graft_3 = GraftTree(Tree=dup, IncludeEmptyLists=True, IncludeNullItems=True)
match_4 = MatchTree(Tree=graft_3, Guide=xy)
prot = RotatePlane(Plane=xy, Angle=match_4)
pln = Plane(prot)
crv_23 = Curve(crv_22)
pln_2 = Plane(pln)
xy_2 = XYPlane(Origin=Point(0, 0, 0))
group = Group(Objects=crv_23)
orient = Orient(Geometry=group, Source=xy_2, Target=pln_2)  # -> Geometry, Transform
ungroup = Ungroup(Group=orient.Geometry)
simplify = SimplifyTree(Tree=ungroup, Front=False)
crv_24 = Curve(simplify)
crv_25 = Curve(crv_24)
explode_4 = Explode(Curve=crv_25, Recursive=True)  # -> Segments, simplify(Vertices)
graft_4 = GraftTree(Tree=explode_4.Vertices, IncludeEmptyLists=True, IncludeNullItems=True)
path_mapper = PathMapper(graft_4, source="{A;B;C;D}", target="{A;B;D}")
path_mapper_2 = PathMapper(graft_4, source="{A;B;C}", target="{A;C}")
pline_2 = PolyLine(Vertices=path_mapper_2, Closed=False)
trim_4 = TrimTree(Tree=pline_2, Depth=1)
crv_26 = Curve(trim_4)
crv_27 = Curve(crv_20)
crv_28 = Curve(crv_26)
crv_29 = Curve(crv_20)
crv_30 = Curve(crv_20)
crv_31 = Curve(crv_20)
crv_32 = Curve(crv_24)
graft_5 = GraftTree(Tree=crv_27, IncludeEmptyLists=True, IncludeNullItems=True)
graft_6 = GraftTree(Tree=crv_30, IncludeEmptyLists=True, IncludeNullItems=True)
python_9 = GhPythonScript(x=crv_28, y=graft_5)  # -> out, a; inputs x: tree, y: tree; same code as python_8
python_10 = GhPythonScript(x=crv_32, y=graft_6)  # -> out, a; inputs x: tree, y: tree; same code as python_8
flatten_4 = FlattenTree(Tree=crv_29, Path="{0}")
runion = RegionUnion(Curves=flatten(crv_31))
trim_5 = TrimWithRegion(Curve=python_9.a, Region=graft_5)  # -> Inside, Outside
python_11 = GhPythonScript(region=crv_29, other_regions=flatten_4)  # -> out, internal_regions; inputs other_regions: list
# ---------- python_11: Python ----------
import rhinoscriptsyntax as rs


internal_regions = []

for other_region in other_regions:
    contained = rs.PlanarClosedCurveContainment(region, other_region)
    
    # the region bounded by curve_b is inside of curve_a
    if contained == 3: 
        internal_regions.append(other_region)
# ---------- end python_11 ----------
trim_6 = TrimWithRegion(Curve=python_10.a, Region=graft_6)  # -> Inside, Outside
crv_33 = Curve(trim_5.Inside)
crv_34 = Curve(trim_6.Inside)
crv_35 = Curve(runion)
crv_36 = Curve(crv_35)
preview_2 = CustomPreview(Geometry=crv_36, Material=ColourSwatch(SwatchColor=RGB(94, 94, 94)))
crv_37 = Curve(python_11.internal_regions)
crv_38 = Curve(crv_33)
crv_39 = Curve(crv_37)
crv_40 = Curve(crv_34)
crv_41 = Curve(crv_37)
crv_42 = Curve(crv_20)
crv_43 = Curve(crv_20)
python_12 = GhPythonScript(x=crv_38, y=crv_39)  # -> out, a; inputs x: tree, y: tree; same code as python_8
tstat_3 = TreeStatistics(Tree=crv_42)  # -> Paths, Length, Count
python_13 = GhPythonScript(x=crv_40, y=crv_41)  # -> out, a; inputs x: tree, y: tree; same code as python_8
ma_3 = MassAddition(Input=tstat_3.Length)  # -> Result, PartialResults
trim_7 = TrimWithRegion(Curve=python_12.a, Region=crv_39)  # -> Inside, Outside
trim_8 = TrimWithRegion(Curve=python_13.a, Region=crv_41)  # -> Inside, Outside
range_2 = Range(Domain=Domain(0, 1), Steps=ma_3.Result)
python_14 = GhPythonScript(x=trim_7.Outside, y=crv_39)  # -> out, a; inputs x: tree, y: tree; same code as python_8
python_15 = GhPythonScript(x=trim_8.Outside, y=crv_41)  # -> out, a; inputs x: tree, y: tree; same code as python_8
gradient_2 = Gradient(
    LowerLimit=0,
    UpperLimit=1,
    Parameter=range_2,
    stops=[0: RGB(243, 57, 0), 0.1: RGB(236, 27, 60), 0.2: RGB(210, 0, 118), 0.3: RGB(103, 0, 120), 0.4: RGB(39, 72, 161), 0.5: RGB(1, 192, 229), 0.6: RGB(18, 178, 90), 0.7: RGB(79, 186, 8), 0.8: RGB(220, 237, 32), 0.9: RGB(247, 159, 20), 1: RGB(243, 57, 0)])
crv_44 = Curve(python_14.a)
crv_45 = Curve(python_15.a)
crv_46 = Curve(crv_45)
crv_47 = Curve(crv_34)
crv_48 = Curve(crv_33)
crv_49 = Curve(crv_44)
jitter_2 = Jitter(List=gradient_2, Jitter=1, Seed=2)  # -> Values, Indices
python_16 = GhPythonScript(x=crv_47, y=crv_46)  # -> out, a; inputs x: tree, y: tree; same code as python_8
python_17 = GhPythonScript(x=crv_48, y=crv_49)  # -> out, a; inputs x: tree, y: tree; same code as python_8
col_3 = Colour(gradient_2)
clean_2 = CleanTree(RemoveNulls=True, RemoveInvalid=True, RemoveEmpty=True, Tree=crv_46)
clean_3 = CleanTree(RemoveNulls=True, RemoveInvalid=True, RemoveEmpty=True, Tree=crv_49)
tstat_4 = TreeStatistics(Tree=python_16.a)  # -> Paths, Length, Count
tstat_5 = TreeStatistics(Tree=clean_2)  # -> Paths, Length, Count
tstat_6 = TreeStatistics(Tree=python_17.a)  # -> Paths, Length, Count
tstat_7 = TreeStatistics(Tree=clean_3)  # -> Paths, Length, Count
compare = PathCompare(Path=tstat_4.Paths, Mask=tstat_5.Paths)
compare_2 = PathCompare(Path=tstat_6.Paths, Mask=tstat_7.Paths)
rotax = RotateAxis(Geometry=crv_43, Angle=1.570796327, Axis=line)  # -> Geometry, Transform
not = GateNot(A=compare)
col_4 = Colour(col_3)
not_2 = GateNot(A=compare_2)
cull = CullPattern(List=tstat_4.Paths, CullPattern=not)
boundary = BoundarySurfaces(Edges=crv_43)
rotax_2 = RotateAxis(Geometry=boundary, Angle=1.570796327, Axis=line)  # -> Geometry, Transform
cull_2 = CullPattern(List=tstat_6.Paths, CullPattern=not_2)
branch_3 = TreeBranch(Tree=python_16.a, Path=cull, MaintainPaths=True)
flatten_5 = FlattenTree(Tree=boundary, Path="{0}")
branch_4 = TreeBranch(Tree=python_17.a, Path=cull_2, MaintainPaths=True)
merge = Merge(Data1=branch_3, Data2=clean_2)
preview_3 = CustomPreview(Geometry=flatten_5, Material=col_4)
merge_2 = Merge(Data1=branch_4, Data2=clean_3)
previewlw_4 = CustomPreviewLineweights(Geometry=crv_43, Shader=ColourSwatch(SwatchColor=RGB(0, 0, 0)), Thickness="3", Absolute=False)
null = NullItem(Item=merge)  # -> NullFlags, InvalidFlags, Description
tstat_8 = TreeStatistics(Tree=null.NullFlags)  # -> Paths, Length, Count
null_2 = NullItem(Item=merge_2)  # -> NullFlags, InvalidFlags, Description
ma_4 = MassAddition(Input=tstat_8.Length)  # -> Result, PartialResults
tstat_9 = TreeStatistics(Tree=null_2.NullFlags)  # -> Paths, Length, Count
larger = LargerThan(FirstNumber=ma_4.Result, SecondNumber=0)  # -> LargerThan, OrEqualTo
ma_5 = MassAddition(Input=tstat_9.Length)  # -> Result, PartialResults
filter_2 = StreamFilter(Gate=larger.LargerThan, Stream0=merge, Stream1=python_16.a)
larger_2 = LargerThan(FirstNumber=ma_5.Result, SecondNumber=0)  # -> LargerThan, OrEqualTo
filter_3 = StreamFilter(Gate=larger_2.LargerThan, Stream0=merge_2, Stream1=python_17.a)
crv_50 = Curve(filter_2)
crv_51 = Curve(crv_50)
crv_52 = Curve(crv_51)
crv_53 = Curve(crv_51)
rotax_3 = RotateAxis(Geometry=crv_52, Angle=1.570796327, Axis=line)  # -> Geometry, Transform
previewlw_5 = CustomPreviewLineweights(Geometry=rotax_3.Geometry, Shader=ColourSwatch(SwatchColor=RGB(255, 255, 255)), Thickness="4", Absolute=False)
crv_54 = Curve(crv_50)
crv_55 = Curve(filter_3)
crv_56 = Curve(crv_55)
explode_5 = Explode(Curve=crv_56, Recursive=True)  # -> Segments, Vertices
crv_57 = Curve(crv_56)
ext_2 = ExtendCurve(Curve=explode_5.Segments, Type=0, Start=neg, End=neg)
move_2 = Move(Geometry=crv_57, Motion=X)  # -> Geometry, Transform
crv_58 = Curve(ext_2)
entwine_3 = Entwine(Branch00=crv_53, Branch01=crv_58, FlattenInputs=True)
crv_59 = Curve(move_2.Geometry)
previewlw_6 = CustomPreviewLineweights(Geometry=entwine_3, Shader=swatch, Thickness=graft(multiplication), Absolute=False)

previewlw_7 = CustomPreviewLineweights(Geometry=crv_52, Shader=swatch, Thickness="4", Absolute=False)
previewlw_8 = CustomPreviewLineweights(Geometry=move_2.Geometry, Shader=swatch, Thickness="4", Absolute=False)

crv_60 = Curve(crv_55)
entwine_4 = Entwine(Branch00=crv_54, Branch01=crv_60, FlattenInputs=True)
clean_4 = CleanTree(RemoveNulls=True, RemoveInvalid=True, RemoveEmpty=False, Tree=entwine_4)
len_2 = Length(Curve=clean_4)
ma_6 = MassAddition(Input=len_2)  # -> Result, PartialResults
total_length_kmeans = Panel(ma_6.Result)
