# Grasshopper definition singular_pattern_maker.ghx (Grasshopper 1.0.7)
# plug-ins: Human, Weaverbird

# singular | compas_pattern
# Quad mesh densification and patterning
# Robin Oval
# rpho2@cam.ac.uk
# https://github.com/BlockResearchGroup/compas_pattern
mesh = Mesh(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)
tolerance_value = Slider(0.5, range=0..1)
# singular | compas_pattern
# Quad-mesh topological edit
# Robin Oval
# rpho2@cam.ac.uk
# https://github.com/BlockResearchGroup/compas_pattern
mesh_2 = Mesh(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)
fromrhinomesh = FromRhinoMesh(mesh_guid=mesh)  # -> mesh
# ---------- fromrhinomesh: Python ----------
from compas_pattern.rhino.grasshopper import gh_from_rhino_mesh
mesh = gh_from_rhino_mesh(mesh_guid)
# ---------- end fromrhinomesh ----------
# singular | compas_pattern
# Surface quad-meshing
# Robin Oval
# rpho2@cam.ac.uk
# https://github.com/BlockResearchGroup/compas_pattern
srf = Surface(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)

pt = Point([Point(4.67783024, 0.3459388189, 1.951780041), Point(3.176917069, 5.551557034, 3.253131615)])
crv = Curve()

crv_2 = Curve(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)
crv_3 = Curve(Tree({0;0}: [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], {0;1}: [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], {0;2}: [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], {0;3}: [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], {1;0}: [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], {1;1}: [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], {1;2}: [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]))

fromrhinomesh_2 = FromRhinoMesh(mesh_guid=mesh_2)  # -> mesh; same code as fromrhinomesh

crv_4 = Curve(Tree({0;0;0}: [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], {0;1;0}: [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], {0;2;0}: [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], {0;3;0}: [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], {1;0;0}: [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], {1;1;0}: [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], {1;2;0}: [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]))
crv_5 = Curve(Tree({0;0;0}: [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], {0;1;0}: [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], {0;2;0}: [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], {0;3;0}: [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], {1;0;0}: [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], {1;1;0}: [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], {1;2;0}: [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]))

coarsen = CoarsenQuadMesh(quad_mesh=fromrhinomesh)  # -> coarse_quad_mesh
# ---------- coarsen: Python ----------
from compas_pattern.rhino.grasshopper import gh_coarsening
coarse_quad_mesh = gh_coarsening(quad_mesh)
# ---------- end coarsen ----------
srfquaddec = SurfaceQuadDecomposition(surface_guid=srf, accuracy_value=tolerance_value, point_guids=pt)  # -> quad_mesh; inputs point_guids: list, curve_guids: list
# ---------- srfquaddec: Python ----------
from compas_pattern.rhino.grasshopper import gh_surface_decomposition
quad_mesh = gh_surface_decomposition(surface_guid, accuracy_value, point_guids, curve_guids)
# ---------- end srfquaddec ----------

neg = Negative(Value=Slider(6.2, range=0..10))
X = UnitX(Factor=neg)
vec = Vector(X)

number_slider = Slider(0, range=0..10)
storestrips = StoreStrips(quad_mesh=fromrhinomesh_2)  # -> quad_mesh
# ---------- storestrips: Python ----------
from compas_pattern.rhino.grasshopper import gh_store_strips
quad_mesh = gh_store_strips(quad_mesh)
# ---------- end storestrips ----------
xy = XYPlane(Origin=Point(0, 0, 0))
data = Data(storestrips)
panel = Panel("4")
prot = RotatePlane(Plane=xy, Angle=degrees(Slider(45, range=0..100)))
subd = Slider(1, range=0..10)
mesh_3 = Mesh(<mesh referenced from the Rhino model>)
storestrips_2 = StoreStrips(quad_mesh=srfquaddec)  # -> quad_mesh; same code as storestrips
rectangle = Rectangle(Plane=PlaneXY(0, 0, 0), XSize=Domain(-1, 1), YSize=Domain(-2, 2), Radius=0)  # -> Rectangle, Length
crv_6 = Curve([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, <curve referenced from the Rhino model> x3, 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])
storestrips_3 = StoreStrips(quad_mesh=coarsen)  # -> quad_mesh; same code as storestrips

k = Slider(0, range=0..100)
d = Slider(0.05, range=0..1)

panel_2 = Panel("""1
4
8
15""")
tolerance_value_2 = Slider(0.2, range=0..1)
vertices = MeshVertices(mesh=data)  # -> vertex_coordinates
# ---------- vertices: Python ----------
from compas_pattern.rhino.grasshopper import gh_vertices
vertex_coordinates = gh_vertices(mesh)
# ---------- end vertices ----------
strips = QuadMeshStrips(quad_mesh=data)  # -> strip_edges, strip_closed
# ---------- strips: Python ----------
from compas_pattern.rhino.grasshopper import gh_strips
strip_edges, strip_closed = gh_strips(quad_mesh)
# ---------- end strips ----------
quad = MeshQuad(CornerA=0, CornerB=1, CornerC=2, CornerD=3)
triangle = MeshTriangle(CornerA=0, CornerB=1, CornerC=2)
polygon = Polygon(Plane=prot, Radius=3, Segments="3", FilletRadius=0)  # -> Polygon, Length
entwine = Entwine(Branch00=panel_2, FlattenInputs=True)  # -> simplify(Result)
srf_2 = Surface(rectangle.Rectangle)
wbweave = WeaverbirdsMeshFromLinesWeaveBack(Lines=crv_6, MaximumValence=4)
wbedges = WeaverbirdsMeshEdges(MeshOrPolylines=mesh_2)
int = Integer()
int_2 = Integer("3")
int_3 = Integer()
vertices_2 = MeshVertices(mesh=storestrips_2)  # -> vertex_coordinates; same code as vertices
explode = Explode(Curve=polygon.Polygon, Recursive=True)  # -> Segments, reverse(Vertices)
strips_2 = QuadMeshStrips(quad_mesh=storestrips_2)  # -> strip_edges, strip_closed; same code as strips
line = Line(wbedges)
mesh_4 = Mesh(wbweave)
boundary = BoundarySurfaces(Edges=polygon.Polygon)
num = Number(subd)
srfquaddec_2 = SurfaceQuadDecomposition(surface_guid=boundary, accuracy_value=tolerance_value_2)  # -> quad_mesh; inputs point_guids: list, curve_guids: list; same code as srfquaddec
int_4 = Integer(int)
int_5 = Integer(int_3)
num_2 = Number(k)
num_3 = Number(d)
vertices_3 = MeshVertices(mesh=storestrips_3)  # -> vertex_coordinates; same code as vertices
strips_3 = QuadMeshStrips(quad_mesh=storestrips_3)  # -> strip_edges, strip_closed; same code as strips
cull_i = CullIndex(List=explode.Vertices, Indices="0", Wrap=True)
item = ListItem(List=vertices, Index=strips.strip_edges, Wrap=True)
points = PointList(Points=vertices, Size=0.35)
mesh_5 = Mesh(mesh_4)
item_2 = ListItem(List=vertices_2, Index=strips_2.strip_edges, Wrap=True)
conmesh = ConstructMesh(Vertices=cull_i, Faces=triangle)
conmesh_2 = ConstructMesh(Vertices=explode.Vertices, Faces=quad)
item_3 = ListItem(List=item, Index=0, Wrap=True)  # -> Item, Item1
mesh_6 = Mesh(mesh_5)
torhinomesh = ToRhinoMesh(mesh=srfquaddec_2)  # -> mesh_guid
# ---------- torhinomesh: Python ----------
from compas_pattern.rhino.grasshopper import gh_to_rhino_mesh
mesh_guid = gh_to_rhino_mesh(mesh)
# ---------- end torhinomesh ----------
item_4 = ListItem(List=item_2, Index=0, Wrap=True)  # -> Item, Item1
ln = Line(StartPoint=item_3.Item, EndPoint=item_3.Item1)

panel_3 = Panel("""2
4
7""")
panel_4 = Panel("""15
14
13
17""")

mesh_7 = Mesh(torhinomesh)
item_5 = ListItem(List=vertices_3, Index=strips_3.strip_edges, Wrap=True)
panel_5 = Panel("""3
8""")
panel_6 = Panel("""2
4
9
11
14
18""")
fromrhinomesh_3 = FromRhinoMesh(mesh_guid=mesh_6)  # -> mesh; same code as fromrhinomesh
ln_2 = Line(StartPoint=item_4.Item, EndPoint=item_4.Item1)
trim = TrimTree(Tree=ln, Depth=1)
item_6 = ListItem(List=item_5, Index=0, Wrap=True)  # -> Item, Item1
wbnaked = WeaverbirdsNakedBoundary(MeshClosedPolylines=mesh_6)
mesh_8 = Mesh(mesh_7)
trim_2 = TrimTree(Tree=ln_2, Depth=1)
entwine_2 = Entwine(Branch00=panel_6, FlattenInputs=True)  # -> simplify(Result)
entwine_3 = Entwine(Branch00=panel_3, Branch01=panel_4, FlattenInputs=True)  # -> simplify(Result)
curvepoint = PointOnCurve(trim, parameter=0.5)
ln_3 = Line(StartPoint=item_6.Item, EndPoint=item_6.Item1)
storestrips_4 = StoreStrips(quad_mesh=fromrhinomesh_3)  # -> quad_mesh; same code as storestrips
fromrhinomesh_4 = FromRhinoMesh(mesh_guid=mesh_8)  # -> mesh; same code as fromrhinomesh
boundary_2 = BoundarySurfaces(Edges=wbnaked)
trim_3 = TrimTree(Tree=ln_3, Depth=1)
editstrip = EditQuadMeshStripTopology(mesh=storestrips, polyedges_to_add=entwine_2, strips_to_delete="2")  # -> mesh; inputs polyedges_to_add: tree of Int32, strips_to_delete: list of Int32
# ---------- editstrip: Python ----------
from compas_pattern.rhino.grasshopper import gh_add_delete_strips
mesh = gh_add_delete_strips(mesh, polyedges_to_add, strips_to_delete)
# ---------- end editstrip ----------
editstrip_2 = EditQuadMeshStripTopology(mesh=storestrips, polyedges_to_add=entwine_3, strips_to_delete=panel_5)  # -> mesh; inputs polyedges_to_add: tree of Int32, strips_to_delete: list of Int32; same code as editstrip
len = Length(Curve=trim_2)
pline = PolyLine(Vertices=curvepoint, Closed=strips.strip_closed)  # -> flatten(Polyline)

target_length = Slider(1.2, range=0..2)
min_subdivision = Slider(1, range=0..10)

avr = Average(Input=len)
srf_3 = Surface(boundary_2)
len_2 = Length(Curve=trim_3)
storestrips_5 = StoreStrips(quad_mesh=fromrhinomesh_4)  # -> quad_mesh; same code as storestrips
lng = ListLength(List=pline)
data_2 = Data(storestrips_4)
avr_2 = Average(Input=len_2)
division = Division(A=avr, B=Slider(0.4, range=0..2))

k_2 = Slider(1, range=0..100)
d_2 = Slider(0.2, range=0..1)

range = Range(Domain=Domain(0, 1), Steps=lng)
curvepoint_2 = PointOnCurve(pline, parameter=0.358)
max = Maximum(A=division, B=Slider(1, range=0..10))  # -> flatten(Result)
division_2 = Division(A=avr_2, B=target_length)
data_3 = Data(storestrips_5)
data_4 = Data(data_2)
int_6 = Integer(int_4)
int_7 = Integer(int_5)
gradient = Gradient(
    LowerLimit=0,
    UpperLimit=1,
    Parameter=range,
    stops=[0: RGB(234, 38, 0), 0.25: RGB(234, 126, 0), 0.5: RGB(254, 244, 84), 0.75: RGB(173, 203, 249), 1: RGB(75, 107, 169)])
srf_4 = Surface(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)
srf_5 = Surface(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)
max_2 = Maximum(A=division_2, B=min_subdivision)  # -> flatten(Result)
int_8 = Integer(max)
editstrip_3 = EditQuadMeshStripTopology(mesh=data_4, polyedges_to_add=int_6, strips_to_delete=int_7)  # -> mesh; inputs polyedges_to_add: tree of Int32, strips_to_delete: list of Int32; same code as editstrip
data_5 = Data(data_3)
editstrip_4 = EditQuadMeshStripTopology(mesh=data_5, strips_to_delete="0")  # -> mesh; inputs polyedges_to_add: tree of Int32, strips_to_delete: list of Int32; same code as editstrip
cstrsmoothing = ConstrainedLaplacianSmoothing(mesh=editstrip, k=k_2, d=d_2, surface_constraint=srf_4)  # -> smooth_mesh; inputs k: Int32, point_constraints: list
# ---------- cstrsmoothing: Python ----------
from compas_pattern.rhino.grasshopper import gh_constrained_smoothing
smooth_mesh = gh_constrained_smoothing(mesh, k=k, damping=d, surface_constraint=surface_constraint, point_constraints=point_constraints)
# ---------- end cstrsmoothing ----------
densify = DensifyQuadMesh(quad_mesh=storestrips_2, strips_subdivision=int_8)  # -> dense_quad_mesh; inputs strips_subdivision: list of Int32
# ---------- densify: Python ----------
from compas_pattern.rhino.grasshopper import gh_densifiying
dense_quad_mesh = gh_densifiying(quad_mesh, strips_subdivision)
# ---------- end densify ----------
densify_2 = DensifyQuadMesh(quad_mesh=storestrips_3, strips_subdivision=max_2)  # -> dense_quad_mesh; inputs strips_subdivision: list of Int32; same code as densify
vertices_4 = MeshVertices(mesh=data_5)  # -> vertex_coordinates; same code as vertices
strips_4 = QuadMeshStrips(quad_mesh=data_5)  # -> strip_edges, strip_closed; same code as strips
preview = CustomPreview(Geometry=pline, Material=gradient)
points_2 = PointList(Points=curvepoint_2, Size=0.5)

k_3 = Slider(10, range=0..100)
d_3 = Slider(0.5, range=0..1)

data_6 = Data(editstrip_3)
srf_6 = Surface(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)
data_7 = Data(cstrsmoothing)

k_4 = Slider(20, range=0..100)
d_4 = Slider(0.5, range=0..1)

item_7 = ListItem(List=vertices_4, Index=strips_4.strip_edges, Wrap=True)
points_3 = PointList(Points=vertices_4, Size=0.35)
cstrsmoothing_2 = ConstrainedLaplacianSmoothing(mesh=densify_2, k=k_3, d=d_3, surface_constraint=srf_6)  # -> smooth_mesh; inputs k: Int32, point_constraints: list; same code as cstrsmoothing
data_8 = Data(data_6)
item_8 = ListItem(List=item_7, Index=0, Wrap=True)  # -> Item, Item1
srf_7 = Surface(srf)
pt_2 = Point(pt)
ln_4 = Line(StartPoint=item_8.Item, EndPoint=item_8.Item1)

num_4 = Number(num)
data_9 = Data(data_8)
strips_5 = QuadMeshStrips(quad_mesh=data_9)  # -> strip_edges, strip_closed; same code as strips
trim_4 = TrimTree(Tree=strips_5.strip_edges, Depth=1)
tstat = TreeStatistics(Tree=trim_4)  # -> Paths, Length, Count
dup = DuplicateData(Data=num_4, Number=tstat.Count, Order=True)
num_5 = Number(dup)
data_10 = Data(data_9)
num_6 = Number(num_5)
densify_3 = DensifyQuadMesh(quad_mesh=data_10, strips_subdivision=num_6)  # -> dense_quad_mesh; inputs strips_subdivision: list of Int32; same code as densify
data_11 = Data(densify_3)

data_12 = Data(data_7)
cstrsmoothing_3 = ConstrainedLaplacianSmoothing(mesh=densify, k=k_4, d=d_4, surface_constraint=srf_7, point_constraints=pt_2)  # -> smooth_mesh; inputs k: Int32, point_constraints: list; same code as cstrsmoothing
trim_5 = TrimTree(Tree=ln_4, Depth=1)
list = ValueList({"seed", "dual", "join", "ambo", "kis", "needle", "zip", "truncate", "ortho", "expand", "gyro", "snub", "meta", "bevel"}, selected="gyro")
strips_6 = QuadMeshStrips(quad_mesh=data_12)  # -> strip_edges, strip_closed; same code as strips
curvepoint_3 = PointOnCurve(trim_5, parameter=0.5)
conway = ConwayOperator(mesh=cstrsmoothing_2, operator=list)  # -> polygonal_mesh
# ---------- conway: Python ----------
from compas_pattern.rhino.grasshopper import gh_conway
polygonal_mesh = gh_conway(mesh, operator)
# ---------- end conway ----------

k_5 = Slider(5, range=0..100)
d_5 = Slider(0.5, range=0..1)

torhinomesh_2 = ToRhinoMesh(mesh=cstrsmoothing_3)  # -> mesh_guid; same code as torhinomesh
pline_2 = PolyLine(Vertices=curvepoint_3, Closed=strips_4.strip_closed)  # -> flatten(Polyline)
trim_6 = TrimTree(Tree=strips_6.strip_edges, Depth=1)
lng_2 = ListLength(List=pline_2)
mesh_9 = Mesh(torhinomesh_2)
tstat_2 = TreeStatistics(Tree=trim_6)  # -> Paths, Length, Count
cstrsmoothing_4 = ConstrainedLaplacianSmoothing(mesh=conway, k=k_5, d=d_5, surface_constraint=srf_6)  # -> smooth_mesh; inputs k: Int32, point_constraints: list; same code as cstrsmoothing
range_2 = Range(Domain=Domain(0, 1), Steps=lng_2)
dup_2 = DuplicateData(Data=Slider(3, range=0..10), Number=tstat_2.Count, Order=True)
curvepoint_4 = PointOnCurve(pline_2, parameter=0.358)
gradient_2 = Gradient(LowerLimit=0, UpperLimit=1, Parameter=range_2, stops=[0: RGB(0, 128, 0), 0.5: RGB(255, 255, 0), 1: RGB(255, 0, 0)])
num_7 = Number(dup_2)
data_13 = Data(data_7)
torhinomesh_3 = ToRhinoMesh(mesh=conway)  # -> mesh_guid; same code as torhinomesh
data_14 = Data(conway)
points_4 = PointList(Points=curvepoint_3, Size=0.5)
preview_2 = CustomPreview(Geometry=pline_2, Material=gradient_2)
densify_4 = DensifyQuadMesh(quad_mesh=data_13, strips_subdivision=num_7)  # -> dense_quad_mesh; inputs strips_subdivision: list of Int32; same code as densify
vertices_5 = MeshVertices(mesh=data_14)  # -> vertex_coordinates; same code as vertices
edges = MeshEdges(mesh=data_14)  # -> edge_vertices
# ---------- edges: Python ----------
from compas_pattern.rhino.grasshopper import gh_edges
edge_vertices = gh_edges(mesh)
# ---------- end edges ----------
X_2 = UnitX(Factor=Slider(11, range=0..100))
data_15 = Data(densify_4)
data_16 = Data(data_15)
vertices_6 = MeshVertices(mesh=data_16)  # -> vertex_coordinates; same code as vertices
singularities = QuadMeshSingularities(quad_mesh=data_16)  # -> singularities
# ---------- singularities: Python ----------
from compas_pattern.rhino.grasshopper import gh_singularities
singularities = gh_singularities(quad_mesh)
# ---------- end singularities ----------
torhinomesh_4 = ToRhinoMesh(mesh=data_16)  # -> mesh_guid; same code as torhinomesh
item_9 = ListItem(List=vertices_6, Index=singularities, Wrap=True)
move = Move(Geometry=torhinomesh_4, Motion=X_2)  # -> Geometry, Transform
item_10 = ListItem(List=vertices_5, Index=edges, Wrap=True)
move_2 = Move(Geometry=item_9, Motion=X_2)  # -> Geometry, Transform
item_11 = ListItem(List=item_10, Index=0, Wrap=True)  # -> Item, Item1
ln_5 = Line(StartPoint=item_11.Item, EndPoint=item_11.Item1)

srf_8 = Surface(srf_3)
num_8 = Number(num_2)
data_17 = Data(data_11)
num_9 = Number(num_3)
cstrsmoothing_5 = ConstrainedLaplacianSmoothing(mesh=data_17, k=num_8, d=num_9, surface_constraint=srf_8)  # -> smooth_mesh; inputs k: Int32, point_constraints: list; same code as cstrsmoothing
data_18 = Data(cstrsmoothing_5)

circle = CircleCNR(Center=move_2.Geometry, Normal=Vector(0, 0, 1), Radius=Slider(0.1, range=0..1))
wbedges_2 = WeaverbirdsMeshEdges(MeshOrPolylines=move.Geometry)
swatch = ColourSwatch(SwatchColor=RGB(255, 0, 255))
line_2 = Line(ln_5)
boundary_3 = BoundarySurfaces(Edges=circle)
line_3 = Line(wbedges_2)
mesh_10 = Mesh(move.Geometry)

data_19 = Data(data_18)
vec_2 = Vector(vec)
vec_3 = Vector(vec)
vertices_7 = MeshVertices(mesh=data_19)  # -> vertex_coordinates; same code as vertices
singularities_2 = QuadMeshSingularities(quad_mesh=data_19)  # -> singularities; same code as singularities
torhinomesh_5 = ToRhinoMesh(mesh=data_19)  # -> mesh_guid; same code as torhinomesh
item_12 = ListItem(List=vertices_7, Index=singularities_2, Wrap=True)
move_3 = Move(Geometry=torhinomesh_5, Motion=vec_2)  # -> Geometry, Transform
move_4 = Move(Geometry=item_12, Motion=vec_3)  # -> Geometry, Transform
circle_2 = CircleCNR(Center=move_4.Geometry, Normal=Vector(0, 0, 1), Radius="0.01")
wbedges_3 = WeaverbirdsMeshEdges(MeshOrPolylines=move_3.Geometry)
boundary_4 = BoundarySurfaces(Edges=circle_2)
line_4 = Line(wbedges_3)
mesh_11 = Mesh(move_3.Geometry)
preview_3 = CustomPreview(Geometry=boundary_4, Material=ColourSwatch(SwatchColor=RGB(255, 0, 255)))  # disabled
previewlw = CustomPreviewLineweights(Geometry=line_4, Shader=ColourSwatch(SwatchColor=RGB(255, 255, 255)), Thickness="3", Absolute=False)

data_20 = Data(data_8)
vec_4 = Vector(vec)
strips_7 = QuadMeshStrips(quad_mesh=data_20)  # -> strip_edges, strip_closed; same code as strips
vertices_8 = MeshVertices(mesh=data_20)  # -> vertex_coordinates; same code as vertices
item_13 = ListItem(List=vertices_8, Index=strips_7.strip_edges, Wrap=True)
item_14 = ListItem(List=item_13, Index=0, Wrap=True)  # -> Item, Item1
ln_6 = Line(StartPoint=item_14.Item, EndPoint=item_14.Item1)
trim_7 = TrimTree(Tree=ln_6, Depth=1)
curvepoint_5 = PointOnCurve(trim_7, parameter=0.5)
move_5 = Move(Geometry=curvepoint_5, Motion=vec_4)  # -> Geometry, Transform
pline_3 = PolyLine(Vertices=move_5.Geometry, Closed=strips_7.strip_closed)  # -> flatten(Polyline)
lng_3 = ListLength(List=pline_3)
range_3 = Range(Domain=Domain(0, 1), Steps=lng_3)
curvepoint_6 = PointOnCurve(pline_3, parameter=0.358)
gradient_3 = Gradient(
    LowerLimit=0,
    UpperLimit=1,
    Parameter=range_3,
    stops=[0: RGB(234, 38, 0), 0.25: RGB(234, 126, 0), 0.5: RGB(254, 244, 84), 0.75: RGB(173, 203, 249), 1: RGB(75, 107, 169)])
points_5 = PointList(Points=vertices_8, Size=0.35)
preview_4 = CustomPreview(Geometry=pline_3, Material=gradient_3)
points_6 = PointList(Points=curvepoint_6, Size=0.5)

data_21 = Data(data_7)
vertices_9 = MeshVertices(mesh=data_21)  # -> vertex_coordinates; same code as vertices
strips_8 = QuadMeshStrips(quad_mesh=data_21)  # -> strip_edges, strip_closed; same code as strips
item_15 = ListItem(List=vertices_9, Index=strips_8.strip_edges, Wrap=True)
item_16 = ListItem(List=item_15, Index=0, Wrap=True)  # -> Item, Item1
ln_7 = Line(StartPoint=item_16.Item, EndPoint=item_16.Item1)
trim_8 = TrimTree(Tree=ln_7, Depth=1)
curvepoint_7 = PointOnCurve(trim_8, parameter=0.489)
pline_4 = PolyLine(Vertices=curvepoint_7, Closed=strips_8.strip_closed)  # -> flatten(Polyline)

move_6 = Move(Geometry=vertices_9, Motion=X_2)  # -> Geometry, Transform
move_7 = Move(Geometry=pline_4, Motion=X_2)  # -> Geometry, Transform

points_7 = PointList(Points=move_6.Geometry, Size=0.35)
curvepoint_8 = PointOnCurve(move_7.Geometry, parameter=0.271)
points_8 = PointList(Points=curvepoint_8, Size=0.5)

lng_4 = ListLength(List=move_7.Geometry)
subtraction = Subtraction(A=lng_4, B=1)
range_4 = Range(Domain=Domain(0, 1), Steps=subtraction)
gradient_4 = Gradient(
    LowerLimit=0,
    UpperLimit=1,
    Parameter=range_4,
    stops=[0: RGB(234, 38, 0), 0.25: RGB(234, 126, 0), 0.5: RGB(254, 244, 84), 0.75: RGB(173, 203, 249), 1: RGB(75, 107, 169)])
preview_5 = CustomPreview(Geometry=move_7.Geometry, Material=gradient_4)
