# Grasshopper definition slab_generator_geometry.ghx (Grasshopper 1.0.7)

panel = Panel("Z:\code\libraries\variational_clustering\data\json_files\four_point_slab.json")
shell_thickness_m = Slider(0.15, range=0..1)
concrete_covers_cm = Panel("""2.5
2.5
-2.5
-2.5""")
txt = Text(panel)
num = Number(shell_thickness_m)
num_2 = Number(concrete_covers_cm)

create_cmesh_for_json_export = BooleanToggle(False)
bool = Boolean(create_cmesh_for_json_export)

export_json_file = BooleanToggle(False)
bool_2 = Boolean(export_json_file)

shell_dimension_x_m = Slider(4.5, range=0..10)
shell_dimension_y_m = Slider(6, range=0..10)
num_of_faces_in_x_direction = Slider(45, range=0..100)
num_of_faces_in_y_direction = Slider(60, range=0..120)
num_3 = Number(num_of_faces_in_y_direction)
num_4 = Number(shell_dimension_x_m)
num_5 = Number(shell_dimension_y_m)
num_6 = Number(num_of_faces_in_x_direction)

# ---- group: Loading - Controls
area_load_kn_m2 = Slider(10, range=0..100)
num_7 = Number(area_load_kn_m2)

# ----
rectangle = Rectangle(Plane=PlaneXY(0, 0, 0), XSize=Domain(-1, 1), YSize=Domain(-2, 2), Radius=0)  # -> Rectangle, Length
explode = Explode(Curve=rectangle.Rectangle, Recursive=True)  # -> Segments, Vertices
item = ListItem(List=explode.Segments, Index=0, Wrap=True)  # -> Item, Item1
num_8 = Number(num_5)
num_9 = Number(num_4)
num_10 = Number(num_3)
num_11 = Number(num_6)
divide = DivideCurve(Curve=item.Item1, Count="2", Kinks=False)  # -> Points, Tangents, Parameters
division = Division(A=num_9, B="2")
division_2 = Division(A=num_8, B="2")
item_2 = ListItem(List=explode.Vertices, Index=0, Wrap=True)  # -> Item, Item1, Item2, Item3
item_3 = ListItem(List=divide.Points, Index=0, Wrap=True)  # -> Item, Item1
neg = Negative(Value=division)
neg_2 = Negative(Value=division_2)
merge = Merge(Data1=flatten(item_2.Item), Data2=flatten(item_3.Item1), Data3=flatten(item_2.Item3))
dom = ConstructDomain(DomainStart=neg_2, DomainEnd=division_2)
dom_2 = ConstructDomain(DomainStart=neg, DomainEnd=division)
pline = PolyLine(Vertices=merge, Closed=False)
rectangle_2 = Rectangle(Plane=PlaneXY(0, 0, 0), XSize=dom_2, YSize=dom, Radius=0)  # -> Rectangle, Length
crv = Curve(pline)
crv_2 = Curve(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)
mplane = MeshPlane(Boundary=rectangle_2.Rectangle, WidthCount=num_11, HeightCount=num_10)  # -> Mesh, Area
crv_3 = Curve(crv)
tri = Triangulate(Mesh=mplane.Mesh)  # -> Mesh, Count
mesh = Mesh(tri.Mesh)
mesh_2 = Mesh(mesh)
demesh = DeconstructMesh(Mesh=mesh_2)  # -> Vertices, Faces, Colours, Normals
python = GhPythonScript(x=demesh.Vertices, y="0.06", z="1.5")  # -> out, a; inputs x: list of Point3d
# ---------- python: Python ----------
a = []


max_y = max([pt.Y for pt in x])

for point in x:
    
    print(point.X, point.Y)
    if point.X > y or point.X < -y:
        continue
    
    if point.Y > (max_y - z) or point.Y < (-max_y + z):
       continue
    
    a.append(point)
# ---------- end python ----------
mesh_3 = Mesh(mesh)
demesh_2 = DeconstructMesh(Mesh=mesh_3)  # -> Vertices, Faces, Colours, Normals
crv_4 = Curve(rectangle_2.Rectangle)
crv_5 = Curve(crv_4)
explode_2 = Explode(Curve=crv_5, Recursive=True)  # -> Segments, Vertices
graft = GraftTree(Tree=explode_2.Segments, IncludeEmptyLists=True, IncludeNullItems=True)
crv_cp = CurveClosestPoint(Point=demesh.Vertices, Curve=graft)  # -> Point, Parameter, Distance
smaller = SmallerThan(FirstNumber=crv_cp.Distance, SecondNumber="0.001")  # -> SmallerThan, OrEqualTo
cull = CullPattern(List=crv_cp.Point, CullPattern=smaller.SmallerThan)  # -> simplify(List)
split = SplitTree(Data=cull, Masks=flatten("{0,2}"))  # -> Positive, Negative
lng = ListLength(List=split.Negative)
lng_2 = ListLength(List=split.Positive)
division_3 = Division(A=lng, B=2)
division_4 = Division(A=lng_2, B=2)
split_2 = SplitList(List=split.Negative, Index=division_3)  # -> simplify(ListA), simplify(ListB)
split_3 = SplitList(List=split.Positive, Index=division_4)  # -> simplify(ListA), simplify(ListB)
panel_2 = Panel("0.04")
crv_cp_2 = CurveClosestPoint(Point=demesh_2.Vertices, Curve=crv_3)  # -> Point, Parameter, Distance
smaller_2 = SmallerThan(FirstNumber=crv_cp_2.Distance, SecondNumber="0.06")  # -> SmallerThan, OrEqualTo
split_4 = SplitTree(Data=split_2.ListA, Masks=flatten("{1}"))  # -> Positive, Negative
split_5 = SplitTree(Data=split_2.ListB, Masks=flatten("{1}"))  # -> Positive, Negative
split_6 = SplitTree(Data=split_3.ListA, Masks=flatten("{0}"))  # -> Positive, Negative
intersection = SetIntersection(SetA=split.Positive, SetB=flatten(split.Negative))
cset = CreateSet(List=flatten(cull))  # -> Set, Map
split_7 = SplitTree(Data=cull, Masks=flatten("{2, 3}"))  # -> Positive, Negative
cull_2 = CullPattern(List=demesh_2.Vertices, CullPattern=smaller_2.OrEqualTo)
pt = Point([split_4.Positive, split_5.Negative, split_6.Positive])
pt_2 = Point(intersection)
pt_3 = Point(cset.Set)
pt_4 = Point(split_7.Positive)
pt_5 = Point(python.a)
pt_6 = Point([split_4.Negative, split_5.Positive])
pt_7 = Point(cull_2)
pt_8 = Point(pt_7)
cset_2 = CreateSet(List=flatten(pt_8))  # -> Set, Map
pt_9 = Point(cset_2.Set)
