# Grasshopper definition three_point_circle_slab.gh (Grasshopper 1.0.7)
# plug-ins: NGon 2, Sandbox Topology, Human, Weaverbird, Kangaroo2 Components, TT Toolbox, karambaGH

shell_dimension_x = Slider(4.5, range=0..10)
num_of_faces_in_x_direction = Slider(45, range=0..100)
num_of_faces_in_y_direction = Slider(30, range=0..120)
shell_global_orientation = Slider(0, range=0..1)
shell_dimension_y_m = Slider(6, range=0..10)
num = Number(shell_dimension_x)
num_2 = Number(num_of_faces_in_y_direction)
num_3 = Number(shell_global_orientation)
num_4 = Number(shell_dimension_y_m)
num_5 = Number(num_of_faces_in_x_direction)

num_6 = Number(num_4)
num_7 = Number(num)
division = Division(A=num_7, B="6")
addition = Addition(A="6", B=1)
division_2 = Division(A=num_6, B="6")
series = Series(Start=0, Step=1, Count=addition)
division_3 = Division(A=num_6, B=2)
division_4 = Division(A=num_7, B=2)
multiplication = Multiplication(A=division, B=series)
multiplication_2 = Multiplication(A=division_2, B=series)
pt = ConstructPoint(XCoordinate=division_4, YCoordinate=division_3, ZCoordinate=0)
graft = GraftTree(Tree=multiplication, IncludeEmptyLists=True, IncludeNullItems=True)
xy = XYPlane(Origin=Point(0, 0, 0))
xy_2 = XYPlane(Origin=pt)
pt_2 = ConstructPoint(XCoordinate=graft, YCoordinate=multiplication_2, ZCoordinate=0)
panel = Panel("""1
3
5""")
orient = Orient(Geometry=pt_2, Source=xy_2, Target=xy)  # -> Geometry, Transform
panel_2 = Panel("""4
1
4""")
tii = TreeItemIndex(DataTree=orient.Geometry, BranchIndex=panel, ItemIndex=panel_2)
pt_3 = Point(tii)
concrete_covers_cm = Panel("""2.5
2.5
-2.5
-2.5""")
matselect = MaterialSelectionKaramba(menu=[dropdown(3), dropdown(8)])
matselect_2 = MaterialSelectionKaramba(menu=[dropdown(2), dropdown(2)])
num_8 = Number()
num_9 = Number(num_3)
multiplication_3 = Multiplication(A=num_8, B="100")
multiplication_4 = Multiplication(A=concrete_covers_cm, B=2)
panel_3 = Panel(multiplication_3)
cross_sections = CrossSectionsKaramba(
    FamilyNameOfCrossSection="DefaultCroSec",
    MaterialConcrete=matselect,
    Height_cm=panel_3,
    MaterialReinforcement=matselect_2,
    ReinforcementConcreteCovers_cm=multiplication_4,
    PrincipalReinforcementDirection_deg=0,
    mode="Shell RC Standard - Const.")
pt_4 = ConstructPoint(XCoordinate=0, YCoordinate=0, ZCoordinate=0)
vec = VectorXYZ(XComponent="1.0", YComponent=num_9, ZComponent=0)  # -> Vector, Length
vdisex = VectorDisplayEx(Point=pt_4, Vector=vec.Vector, Colour=RGB(0, 0, 0), Width=2)
panel_4 = Panel("""True
False
False
False
False
False
False
False
False""")

# ---- group: Optional Colors
range = Range(Domain=Domain(0, 1), Steps=10)
gradient = Gradient(
    LowerLimit=0,
    UpperLimit=1,
    Parameter=range,
    stops=[0: RGB(255, 0, 0), 0.176: RGB(255, 238, 0), 0.35: RGB(0, 255, 234), 0.504: RGB(35, 4, 128), 0.664: RGB(0, 252, 215), 0.843: RGB(255, 255, 0), 1: RGB(255, 0, 47)])

range_2 = Range(Domain=Domain(0, 1), Steps=10)
gradient_2 = Gradient(
    LowerLimit=0,
    UpperLimit=1,
    Parameter=range_2,
    stops=[0: RGB(255, 0, 0), 0.176: RGB(255, 238, 0), 0.35: RGB(0, 255, 234), 0.504: RGB(35, 4, 128), 0.664: RGB(0, 252, 215), 0.843: RGB(255, 255, 0), 1: RGB(255, 0, 47)])

# ----
num_10 = Number()
bool = Boolean()
num_11 = Number()

# ---- group: Optional Colors
range_3 = Range(Domain=Domain(0, 1), Steps=10)
gradient_3 = Gradient(
    LowerLimit=0,
    UpperLimit=1,
    Parameter=range_3,
    stops=[0: RGB(255, 0, 0), 0.176: RGB(255, 238, 0), 0.35: RGB(0, 255, 234), 0.504: RGB(35, 4, 128), 0.664: RGB(0, 252, 215), 0.843: RGB(255, 255, 0), 1: RGB(255, 0, 47)])

# ----
bool_2 = Boolean(Toggle(True))
bool_3 = Boolean(bool_2)
txt = Text()
bool_4 = Boolean()
python = GhPythonScript()  # -> out, a
# ---------- python: Python ----------
import compas
print compas.__version__
# ---------- end python ----------
panel_5 = Panel("Z:\code\libraries\directional_clustering\data\json_files\three_point_circle_slab.json")

panel_6 = Panel("""nx
ny
nxy
mx
my
mxy
vx
vy""")
graft_2 = GraftTree(Tree=panel_6, IncludeEmptyLists=True, IncludeNullItems=True)

# ---- group: Display Vector Field - Selection 2
list = ValueList({"n_1": 0, "n_2": 1, "m_1": 2, "m_2": 3, "ps_1_top": 4, "ps_1_bot": 5, "ps_1_mid": 6, "ps_2_top": 7, "ps_2_bot": 8, "ps_2_mid": 9, "custom_1": 10, "custom_2": 11}, selected="ps_2_bot")
int = Integer(list)

# ---- group: Vector Field 1 - Selection
list_2 = ValueList({"n_1": 0, "n_2": 1, "m_1": 2, "m_2": 3, "ps_1_top": 4, "ps_1_bot": 5, "ps_1_mid": 6, "ps_2_top": 7, "ps_2_bot": 8, "ps_2_mid": 9, "custom_1": 10, "custom_2": 11}, selected="ps_1_bot")
int_2 = Integer(list_2)

# ---- group: Display Vector Field - Selection
list_3 = ValueList({"n_1": 0, "n_2": 1, "m_1": 2, "m_2": 3, "ps_1_top": 4, "ps_1_bot": 5, "ps_1_mid": 6, "ps_2_top": 7, "ps_2_bot": 8, "ps_2_mid": 9, "custom_1": 10, "custom_2": 11}, selected="ps_1_bot")
int_3 = Integer(list_3)

# ---- group: Display Mesh - Mode Selection
list_4 = ValueList({"max": 0, "min": 1, "avg": 2, "angle_avg": 3}, selected="max")
int_4 = Integer(list_4)

# ---- group: As 2 - Density Selection
list_5 = ValueList({"asx_": 0, "asy_": 1}, selected="asy_")
int_5 = Integer(list_5)

# ---- group: Display Controls
display_results_on_mesh = BooleanToggle(True)
bool_5 = Boolean(display_results_on_mesh)

display_vector_field = BooleanToggle(True)
bool_6 = Boolean(display_vector_field)

display_seeds = BooleanToggle(False)
bool_7 = Boolean(display_seeds)

display_face_singularities = BooleanToggle(True)
bool_8 = Boolean(display_face_singularities)

display_face_edge_planes = BooleanToggle(False)
bool_9 = Boolean(display_face_edge_planes)

# ---- group: As 1 - Density Selection
list_6 = ValueList({"asx_": 0, "asy_": 1}, selected="asx_")
int_6 = Integer(list_6)

# ---- group: Display Mesh - Results Selection
list_7 = ValueList({"nx": 0, "ny": 1, "nxy": 2, "mx": 3, "my": 4, "mxy": 5, "vx": 6, "vy": 7, "asx_b": 8, "asx_t": 9, "asy_b": 10, "asy_t": 11, "asx_c": 12, "asy_c": 13, "asx_": 14, "asy_": 15, "sp_asx_": 16, "sp_asy_": 17}, selected="asx_")
int_7 = Integer(list_7)

# ----
panel_7 = Panel("""asx_b
asx_t
asy_b
asy_t
asx_c
asy_c
asx_
asy_
spacing_asx_
spacing_asy_""")
int_8 = Integer(int_7)

# ---- group: RC - Design Controls
shell_thickness_m = Slider(0.14, range=0..1)
concrete_compression_strength_fck = Slider(40, range=0..100)
concrete_tension_strength_factor_fctd = Slider(10, range=0..100)
rebar_yield_strength_fy = Slider(500, range=0..1000)
cover_to_rebar_m = Slider(0.05, range=0..1)

# ----
min_length = Slider(0.2, range=0..2)
dl = Slider(0.01, range=0..0.1)
num_12 = Number(dl)
num_13 = Number(min_length)

dir_1_weight_vector_field = Slider(1, range=0..1)
dir_1_weight_separate = Slider(0, range=0..1)
dir_1_weight_align = Slider(0, range=0..1)
dir_2_weight_separate = Slider(0, range=0..1)
dir_2_weight_vector_field = Slider(1, range=0..1)
dir_2_weight_align = Slider(0, range=0..1)
merge = Merge(
    Data1=dir_1_weight_vector_field,
    Data2=dir_1_weight_separate,
    Data3=dir_1_weight_align,
    Data4=dir_2_weight_vector_field,
    Data5=dir_2_weight_separate,
    Data6=dir_2_weight_align)
num_14 = Number(merge)

# ---- group: Loading - Controls
area_load_kn_m2 = Slider(10, range=0..100)
num_15 = Number(area_load_kn_m2)

# ----
num_16 = Number(num_15)
panel_8 = Panel(num_16)
Z = UnitZ(Factor=panel_8)
rev = Reverse(Vector=Z)

# ---- group: Algorithm - Controls
run_rc_design = BooleanToggle(True)
bool_10 = Boolean(run_rc_design)

run_smesh = BooleanToggle(True)
bool_11 = Boolean(run_smesh)

# ----
export_smesh_json = BooleanToggle(False)
bool_12 = Boolean(export_smesh_json)

vector_scale = Slider(2.5, range=0..2.5)
num_17 = Number(vector_scale)

# ---- group: Custom Vector - Controls
x_vector = Slider(1, range=0..1)
y_vector = Slider(0, range=0..1)
z_vector = Slider(0, range=0..1)
vec_2 = VectorXYZ(XComponent=x_vector, YComponent=y_vector, ZComponent=z_vector)  # -> Vector, Length
vec_3 = Vector(vec_2.Vector)

# ----
vec_4 = Vector(vec_3)
vec_5 = Vector(vec_3)

vector_scale_2 = Slider(2.5, range=0..2.5)
num_18 = Number(vector_scale_2)

singularities_tol = Slider(0, range=0..1)
num_19 = Number(singularities_tol)

panel_9 = Panel("""n_1
n_2
m_1
m_2
ps_1_top
ps_1_bot
ps_1_mid
ps_2_top
ps_2_bot
ps_2_mid
custom_1
custom_2""")
int_9 = Integer(int_2)
int_10 = Integer(int_3)
graft_3 = GraftTree(Tree=panel_9, IncludeEmptyLists=True, IncludeNullItems=True)
item = ListItem(List=panel_9, Index=int_10, Wrap=True)
item_2 = ListItem(List=panel_9, Index=int_9, Wrap=True)

panel_10 = Panel("""max
min
avg
angle_avg""")
int_11 = Integer(int_4)

panel_11 = Panel("""asx_
asy_""")
int_12 = Integer(int_6)
int_13 = Integer(int_5)
item_3 = ListItem(List=panel_11, Index=int_12, Wrap=True)
item_4 = ListItem(List=panel_11, Index=int_13, Wrap=True)

int_14 = Integer(int)
txt_2 = Text(panel_5)
bool_13 = Boolean(bool_2)
merge_2 = Merge(Data1=panel_6, Data2=panel_7)
item_5 = ListItem(List=panel_9, Index=int_14, Wrap=True)
item_6 = ListItem(List=merge_2, Index=int_8, Wrap=True)
item_7 = ListItem(List=panel_10, Index=int_11, Wrap=True)

# ---- group: Internal Forces - Tags
txt_3 = Text(graft_2)

# ----
txt_4 = Text(flatten(txt_3))
txt_5 = Text(flatten(txt_3))

# ---- group: Display - Tag
txt_6 = Text(item_6)

# ---- group: as_tag_1
txt_7 = Text(item_3)

# ---- group: as_tag_2
txt_8 = Text(item_4)

# ---- group: Principal Vectors - Tags
txt_9 = Text(graft_3)

# ----
txt_10 = Text(flatten(txt_9))
txt_11 = Text(flatten(txt_9))

# ---- group: vector_tag
txt_12 = Text(item_2)

# ---- group: vector_tag - display
txt_13 = Text(item)

# ---- group: Display - Tag
txt_14 = Text(item_7)

# ----
txt_15 = Text(item_5)

# ---- group: RC - Design Controls
num_20 = Number(shell_thickness_m)
num_21 = Number(cover_to_rebar_m)
num_22 = Number(concrete_compression_strength_fck)
num_23 = Number(concrete_tension_strength_factor_fctd)
num_24 = Number(rebar_yield_strength_fy)

# ----
number_slider = Slider(0.06, range=0..0.1)

crv = Curve()
crv_2 = Curve()

bool_14 = Boolean(bool_7)

X = UnitX(Factor="6")
swatch = ColourSwatch(SwatchColor=RGB(0, 0, 0))
swatch_2 = ColourSwatch(SwatchColor=RGB(0, 0, 0))
Z_2 = UnitZ(Factor="6")
Z_3 = UnitZ(Factor="6")
panel_12 = Panel("4 to 0.5")
panel_13 = Panel("Z:\code\libraries\streamlines\examples\three_point_circle_slab.json")
panel_14 = Panel("-1")
panel_15 = Panel("2")

# ---- group: Principal Vectors - Tags
txt_16 = Text(txt_9)

txt_17 = Text(txt_9)

# ---- group: vector_tag
txt_18 = Text(txt_12)

# ---- group: Optional Colors
range_4 = Range(Domain=Domain(0, 1), Steps=10)
gradient_4 = Gradient(
    LowerLimit=0,
    UpperLimit=1,
    Parameter=range_4,
    stops=[0: RGB(255, 0, 0), 0.176: RGB(255, 238, 0), 0.35: RGB(0, 255, 234), 0.504: RGB(35, 4, 128), 0.664: RGB(0, 252, 215), 0.843: RGB(255, 255, 0), 1: RGB(255, 0, 47)])

# ----
panel_16 = Panel("""1
-1
0""")

# ---- group: Principal Vectors - Tags
txt_19 = Text(flatten(txt_9))

# ----
txt_20 = Text(flatten(txt_3))
bool_15 = Boolean(bool_10)
num_25 = Number(num_20)
num_26 = Number(num_21)
num_27 = Number(num_22)
num_28 = Number(num_24)
num_29 = Number(num_23)
panel_17 = Panel("True")

# ---- group: display
bool_16 = Boolean(bool_5)

# ---- group: mode
txt_21 = Text(txt_14)

# ---- group: data_tag
txt_22 = Text(txt_6)

# ---- group: vector_tag
txt_23 = Text(txt_15)

txt_24 = Text(txt_13)

# ---- group: Vector Scale
num_30 = Number(num_19)

# ---- group: vector_tag
txt_25 = Text(txt_13)

# ---- group: display
bool_17 = Boolean(bool_8)

bool_18 = Boolean(bool_9)

# ---- group: Vector Scale
num_31 = Number(num_17)

num_32 = Number(num_18)

# ---- group: display
bool_19 = Boolean(bool_6)

bool_20 = Boolean(bool_6)

# ----
panel_18 = Panel("0")

uniform_spacing = BooleanToggle(True)
min_sp_m = Slider(0.5, range=0..1)
dl_2 = Slider(0.02, range=0..0.1)
min_length_2 = Slider(0.01, range=0..4)
num_33 = Number(dl_2)
num_34 = Number(min_length_2)
bool_21 = Boolean(uniform_spacing)
num_35 = Number(min_sp_m)

proximity_factor_to_others = Slider(0.05, range=0..1)
number_of_samples = Slider(15, range=0..500)
strat_factor = Slider(1, range=0..1)
proximity_at_start = Slider(0.9, range=0..1)
iterations = Slider(2000, range=0..10000)
proximity_to_itself = Slider(1, range=0..10)
int_15 = Integer(number_of_samples)
num_36 = Number(strat_factor)
num_37 = Number(proximity_factor_to_others)
num_38 = Number(proximity_to_itself)
num_39 = Number(iterations)
num_40 = Number(proximity_at_start)

run_streamlines_jobard = BooleanToggle(False)
bool_22 = Boolean(run_streamlines_jobard)

run_streamlines_jobard_2 = BooleanToggle(False)
bool_23 = Boolean(run_streamlines_jobard_2)

uniform_spacing_2 = BooleanToggle(True)
min_sp_m_2 = Slider(0.5, range=0..1)
dl_3 = Slider(0.02, range=0..0.1)
min_length_3 = Slider(0.2, range=0..4)
bool_24 = Boolean(uniform_spacing_2)
num_41 = Number(min_length_3)
num_42 = Number(min_sp_m_2)
num_43 = Number(dl_3)

number_of_samples_2 = Slider(15, range=0..300)
proximity_at_start_2 = Slider(0.9, range=0..1)
strat_factor_2 = Slider(1, range=0..1)
proximity_factor_to_others_2 = Slider(0.05, range=0..1)
proximity_to_itself_2 = Slider(1, range=0..10)
iterations_2 = Slider(1000, range=0..10000)
int_16 = Integer(number_of_samples_2)
num_44 = Number(strat_factor_2)
num_45 = Number(proximity_factor_to_others_2)
num_46 = Number(proximity_at_start_2)
num_47 = Number(proximity_to_itself_2)
num_48 = Number(iterations_2)

percentage_of_max_demand_dir_2 = Slider(0.67, range=0..1)
max_spacing_dir_2 = Slider(0.4, range=0..1)
percentage_of_max_demand_dir_1 = Slider(0.67, range=0..1)
bar_diameter_mm_dir_1 = Slider(12, range=0..30)
bar_diameter_mm_dir_2 = Slider(12, range=0..30)
max_spacing_dir_1 = Slider(0.4, range=0..1)
merge_3 = Merge(Data1=bar_diameter_mm_dir_1, Data2=bar_diameter_mm_dir_2)
merge_4 = Merge(Data1=max_spacing_dir_1, Data2=max_spacing_dir_2)
merge_5 = Merge(Data1=percentage_of_max_demand_dir_1, Data2=percentage_of_max_demand_dir_2)
num_49 = Number(merge_4)
num_50 = Number(merge_5)
num_51 = Number(merge_3)

# ---- group: bar diameter
num_52 = Number(num_51)

# ---- group: max spacing
num_53 = Number(num_49)

# ---- group: % demand
num_54 = Number(num_50)

# ----
ghpython_script = GhPythonScript()  # -> Out, A
bool_25 = Boolean(bool_22)
num_55 = Number(num_33)
txt_26 = Text(txt_7)
num_56 = Number(num_40)
num_57 = Number(num_14)
num_58 = Number(num_34)
txt_27 = Text(txt_12)
num_59 = Number(num_35)
bool_26 = Boolean(bool_21)
int_17 = Integer(int_15)
num_60 = Number(num_36)
num_61 = Number(num_37)
num_62 = Number(num_38)
num_63 = Number(num_39)
num_64 = Number(num_41)
num_65 = Number(num_14)
num_66 = Number(num_45)
num_67 = Number(num_46)
bool_27 = Boolean(bool_23)
num_68 = Number(num_43)
txt_28 = Text(txt_12)
txt_29 = Text(txt_8)
num_69 = Number(num_42)
bool_28 = Boolean(bool_24)
int_18 = Integer(int_16)
num_70 = Number(num_44)
num_71 = Number(num_47)
num_72 = Number(num_48)
crv_3 = Curve()
crv_4 = Curve()
flatten = FlattenTree(Tree=crv_3, Path="{0}")
flatten_2 = FlattenTree(Tree=crv_4, Path="{0}")
eval = EvaluateCurve(Curve=reparameterize(flatten), Parameter="0.5")  # -> Point, Tangent, Angle
eval_2 = EvaluateCurve(Curve=reparameterize(flatten_2), Parameter="0.5")  # -> Point, Tangent, Angle
panel_19 = Panel("""dir1-8-8
dir2-8-8
boundary""")
panel_20 = Panel("""dir1-12-12
dir2-12-12
boundary""")
panel_21 = Panel("""dir1-6-6
dir2-6-6
boundary""")
panel_22 = Panel("""dir1-10-10
dir2-10-10
boundary""")
dpipeline = DynamicGeometryPipeline(
    LayerFilter=panel_20,
    TypeFilter="curve",
    NameFilter="*",
    GroupByLayer=False,
    GroupByType=False,
    IncludeHidden=True,
    IncludeLocked=True,
    enableFullPath=False,
    listenToAttributes=True)
crv_5 = Curve(dpipeline)
crv_6 = Curve(crv_5)
pt_5 = ConstructPoint(XCoordinate="0", YCoordinate=0, ZCoordinate=0)
yz = YZPlane(Origin=pt_5)
mirror = Mirror(Geometry=crv_6, Plane=yz)  # -> Geometry, Transform
merge_6 = Merge(Data1=crv_6, Data2=mirror.Geometry)  # -> simplify(Result)
split = SplitTree(Data=merge_6, Masks=flatten("{2}"))  # -> Positive, Negative
join = JoinCurves(Curves=split.Negative, Preserve=False)  # -> simplify(Curves)
merge_7 = Merge(Data1=split.Positive, Data2=join)  # -> simplify(Result)
crv_7 = Curve(merge_7)
crv_8 = Curve(crv_7)
flatten_3 = FlattenTree(Tree=crv_8, Path="{0}")
crv_9 = Curve(flatten_3)
crv_10 = Curve(crv_9)
crv_11 = Curve(reparameterize(crv_10))
graft_4 = GraftTree(Tree=crv_11, IncludeEmptyLists=True, IncludeNullItems=True)  # -> simplify(Tree)
flatten_4 = FlattenTree(Tree=crv_11, Path="{0}")
group = Group(Objects=flatten_4)
tstat = TreeStatistics(Tree=graft_4)  # -> Paths, Length, Count
dup = DuplicateData(Data=group, Number=tstat.Count, Order=True)
series_2 = Series(Start=0, Step=1, Count=tstat.Count)
ungroup = Ungroup(Group=dup)
graft_5 = GraftTree(Tree=series_2, IncludeEmptyLists=True, IncludeNullItems=True)
cull_i = CullIndex(List=ungroup, Indices=graft_5, Wrap=True)
match = MatchTree(Tree=cull_i, Guide=graft_4)
ccx = CurveCurve(CurveA=graft_4, CurveB=match)  # -> Points, ParamsA, ParamsB
pt_6 = Point(ccx.Points)
num_73 = Number(ccx.ParamsA)
crv_12 = Curve(reparameterize(crv_10))
pt_7 = Point(pt_6)
simplify = SimplifyTree(Tree=pt_7, Front=False)
graft_6 = GraftTree(Tree=crv_12, IncludeEmptyLists=True, IncludeNullItems=True)
trim = TrimTree(Tree=simplify, Depth=1)
simplify_2 = SimplifyTree(Tree=graft_6, Front=False)
crv_cp = CurveClosestPoint(Point=trim, Curve=simplify_2)  # -> Point, Parameter, Distance
smaller = SmallerThan(FirstNumber=crv_cp.Distance, SecondNumber="0.001")  # -> SmallerThan, OrEqualTo
cull = CullPattern(List=crv_cp.Parameter, CullPattern=smaller.SmallerThan)
cull_2 = CullPattern(List=crv_cp.Point, CullPattern=smaller.SmallerThan)
clean = CleanTree(RemoveNulls=True, RemoveInvalid=True, RemoveEmpty=False, Tree=cull)
clean_2 = CleanTree(RemoveNulls=True, RemoveInvalid=True, RemoveEmpty=False, Tree=cull_2)
rdpoints = RemoveDuplicatePointsKaramba(Point=flatten(clean_2), LimitDistance=0.005)  # -> OutPoint, Info, Indexes
shatter = Shatter(Curve=simplify_2, Parameters=clean)  # -> simplify(Segments)
pt_8 = Point(rdpoints.OutPoint)
reb = RebuildCurve(Curve=shatter, Degree="3", Count="10", Tangents=False)
crv_13 = Curve(reb)
crv_14 = Curve(crv_13)
crv_15 = Curve(crv_13)
end = EndPoints(Curve=crv_14)  # -> Start, End
join_2 = JoinCurves(Curves=crv_15, Preserve=False)
ln = Line(StartPoint=end.Start, EndPoint=end.End)  # -> simplify(Line)
crv_16 = Curve(join_2)
line = Line(ln)
line_2 = Line(line)
flatten_5 = FlattenTree(Tree=line_2, Path="{0}")
rdlines = RemoveDuplicateLinesKaramba(Line=flatten_5, LimitDistance="0.005")  # -> OutLine, Info, Indexes
line_topo = LineTopology(ListOfLines=rdlines.OutLine, Tolerance="0.005")  # -> ListOfPoints, LinePointStructure, PointPointStructure, PointLineStructure
lng = ListLength(List=line_topo.PointPointStructure)
larger = LargerThan(FirstNumber=lng, SecondNumber="2")  # -> LargerThan, OrEqualTo
flatten_6 = FlattenTree(Tree=larger.OrEqualTo, Path="{0}")
bool_29 = Boolean("False")
mindex = MemberIndex(Set=flatten_6, Member=bool_29)  # -> Index, Count
replace = ReplaceItems(List=line_topo.ListOfPoints, Indices=mindex.Index, Wrap=False)
item_8 = ListItem(List=replace, Index=line_topo.LinePointStructure, Wrap=True)
pline = PolyLine(Vertices=item_8, Closed=False)  # -> flatten(Polyline)
clean_3 = CleanTree(RemoveNulls=True, RemoveInvalid=True, RemoveEmpty=False, Tree=pline)
crv_17 = Curve(clean_3)
createatts = CreateAttributes(enableFullPath=False)
createhatch = CreateHatch(Bake=False, HatchPatternName="Solid", HatchScale=1, HatchRotation=0)
ngon = NGon(LineWeight=1)

number = Number(Slider(50, range=0..100))
number_2 = Number(Slider(0.15, range=0..1))
num_74 = Number(number)
polygon = Polygon(Plane=PlaneXY(0, 0, 0), Radius=3, Segments=num_74, FilletRadius=0)  # -> Polygon, Length
construct_point = ConstructPoint(XCoordinate=0, YCoordinate=0, ZCoordinate=0)
num_75 = Number(number_2)
explode = Explode(Curve=polygon.Polygon, Recursive=True)  # -> Segments, Vertices
line_3 = Line(StartPoint=construct_point, EndPoint=explode.Vertices)
divide_length = DivideLength(Curve=line_3, Length=num_75)  # -> Points, Tangents, Parameters
list_length = ListLength(List=divide_length.Points)
graft_tree = GraftTree(Tree=line_3, IncludeEmptyLists=True, IncludeNullItems=True)
divide_curve = DivideCurve(Curve=graft_tree, Count=list_length, Kinks=False)  # -> Points, Tangents, Parameters
cull_index = CullIndex(List=divide_curve.Points, Indices="0", Wrap=True)
flip_matrix = FlipMatrix(Data=cull_index)
polyline = PolyLine(Vertices=cull_index, Closed=False)
polyline_2 = PolyLine(Vertices=flip_matrix, Closed=False)
explode_2 = Explode(Curve=polyline, Recursive=True)  # -> flatten(Segments), simplify(Vertices)
relative_item = RelativeItem(Tree=explode_2.Vertices, Offset="{1}[1]", WrapPaths=True, WrapItems=False)  # -> ItemA, ItemB
explode_3 = Explode(Curve=[polyline_2, polyline], Recursive=True)  # -> flatten(Segments), Vertices
line_4 = Line(StartPoint=relative_item.ItemA, EndPoint=relative_item.ItemB)
entwine = Entwine(Branch00=explode_3.Segments, Branch01=line_4, FlattenInputs=True)  # -> flatten(Result)
clean_tree = CleanTree(RemoveNulls=True, RemoveInvalid=True, RemoveEmpty=True, Tree=entwine)
remove_duplicate_lines_karamba3d = RemoveDuplicateLinesKaramba3D(Line=clean_tree, LimitDistance="0.001")  # -> OutLine, Info, Indexes
weaverbird_s_mesh_from_lines_weave_back = WeaverbirdsMeshFromLinesWeaveBack(Lines=remove_duplicate_lines_karamba3d.OutLine, MaximumValence=10)

ghpython_script_2 = GhPythonScript(x=remove_duplicate_lines_karamba3d.OutLine)  # -> out, a; inputs x: list
# ---------- ghpython_script_2: Python ----------
from compas_rhino.utilities import get_line_coordinates

from compas.datastructures import Mesh
from compas_ghpython.artists import MeshArtist


lines = get_line_coordinates(x)

mesh = Mesh.from_lines(lines, delete_boundary_face=True, precision='6f')

# biggest_fkey = [fkey for fkey in mesh.faces() if len(mesh.face_vertices(fkey)) > 4]

 #for f in biggest_fkey:
#     mesh.delete_face(f)

artist = MeshArtist(mesh)
a = artist.draw_mesh()
# ---------- end ghpython_script_2 ----------
mesh = Mesh(ghpython_script_2.a)
point = Point(explode.Vertices)
create_material = CreateMaterial(
    Diffuse=ColourSwatch(SwatchColor=RGB(74, 74, 74)),
    Specular=RGB(255, 255, 255),
    Emission=RGB(0, 0, 0),
    Transparency=0,
    Shine=0)

mesh_2 = Mesh(ghpython_script_2.a)
face_boundaries = FaceBoundaries(Mesh=mesh_2)
custom_preview = CustomPreview(Geometry=face_boundaries, Material=create_material)

nv = NakedVertices(Mesh=mesh_2)  # -> ClothedIndex, NakedIndex, ClothedPts, NakedPts
pt_9 = Point(point)
mesh_3 = Mesh(mesh_2)
pt_10 = Point(nv.NakedPts)
mesh_4 = Mesh(mesh_2)
loads = LoadsKaramba(Vector=rev, Mesh=mesh_3, LCase=0, mode="MeshLoad -Const.", menu=[buttons(off, on, off), buttons(on, on)])
entwine_2 = Entwine(Branch00=loads, FlattenInputs=True)
meshtoshell = MeshToShellKaramba(Mesh=mesh_4, Identifier="slab", CrossSection=cross_sections, LimitDistance_m=0.005)  # -> Element, Points, Info
load = LoadKaramba(flatten(entwine_2))
orientate = OrientateElemKaramba(Shell=meshtoshell.Element, XOrientations=vec.Vector, mode="Shell")
element = ElementKaramba(flatten(orientate))
pt_11 = Point(meshtoshell.Points)
pt_12 = Point(pt_11)
closest_point = ClosestPoint(Point=pt_9, Cloud=pt_12)  # -> ClosestPoint, CPIndex, Distance
closest_point_2 = ClosestPoint(Point=pt_3, Cloud=pt_12)  # -> ClosestPoint, CPIndex, Distance
remove_duplicate_points_karamba3d = RemoveDuplicatePointsKaramba3D(Point=closest_point.ClosestPoint, LimitDistance=0.005)  # -> OutPoint, Info, Indexes
pt_13 = Point(closest_point_2.ClosestPoint)
pt_14 = Point(remove_duplicate_points_karamba3d.OutPoint)
supp = SupportKaramba(PosInd=pt_13, menu=[buttons(on, on, on, off, off, on)])
supp_2 = SupportKaramba(PosInd=pt_14, menu=[buttons(on, on, on, off, off, on)])
entwine_3 = Entwine(Branch02=supp, FlattenInputs=True)
support = SupportKaramba(flatten(entwine_3))
element_2 = ElementKaramba(element)
support_2 = SupportKaramba(support)
load_2 = LoadKaramba(load)
cull_pattern = CullPattern(List=pt_11, CullPattern=panel_4)
assemble = AssembleModelKaramba(Elem=element_2, Support=flatten(support_2), Load=load_2, LimitDistance_m=0.005)  # -> Model, Info, Mass_kg, CenterOfGravity
pt_15 = Point(flatten(pt_14))
analyzethi = AnalyzeThIKaramba(Model=assemble.Model)  # -> CalculatedModel, MaximumDisplacement_m, ResultingForceOfGravity_kN, ElasticEnergy_kNm
panel_24 = Panel(analyzethi.MaximumDisplacement_m)
model = ModelKaramba(analyzethi.CalculatedModel)
model_2 = ModelKaramba(model)
shelllineresults = LineResultsOnShellsKaramba(
    AnalyzedModel=model_2,
    Layer="-1",
    ListOfSourcesOfPrincipalStressLinesLinesPoints=flatten(cull_pattern),
    SegmentLength_m=0.5,
    DA_deg=5,
    mode="PrincStress")  # -> AnalyzedModel, Lines1, Lines2
model_3 = ModelKaramba(model)
curve = Curve(shelllineresults.Lines2)
model_4 = ModelKaramba(model)
shellvecresults = ResultVectorsOnShellsKaramba(AnalyzedModel=model_4, mode="PrincForce")  # -> AnalyzedModel, Points, FirstPrincipalNormalForceVector_kN_m, SecondPrincipalNormalForceVector_kN_m, FirstPrincipalMomentVector_kN, SecondPrincipalMomentVector_kN, FirstPrincipalNormalForceValue_kN_m, SecondPrincipalNormalForceValue_kN_m, FirstPrincipalMomentValue_kN, SecondPrincipalMomentValue_kN
disassemble = DisassembleModelKaramba(Model=model_4)  # -> Model, Point, Beam, Shell, Support, Load, Line, Mesh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

s_forces = ShellForcesKaramba(AnalyzedModel=model_4, LCase=0, mode="Local")  # -> AnalyzedModel, Nxx_kN_m, Nyy_kN_m, Nxy_kN_m, Mxx_kN, Myy_kN, Mxy_kN, Vx_kN_m, Vy_kN_m
graft_7 = GraftTree(Tree=s_forces.Nxx_kN_m, IncludeEmptyLists=True, IncludeNullItems=True)  # -> simplify(Tree)
graft_8 = GraftTree(Tree=s_forces.Nyy_kN_m, IncludeEmptyLists=True, IncludeNullItems=True)  # -> simplify(Tree)
graft_9 = GraftTree(Tree=s_forces.Nxy_kN_m, IncludeEmptyLists=True, IncludeNullItems=True)  # -> simplify(Tree)
graft_10 = GraftTree(Tree=s_forces.Mxx_kN, IncludeEmptyLists=True, IncludeNullItems=True)  # -> simplify(Tree)
graft_11 = GraftTree(Tree=s_forces.Myy_kN, IncludeEmptyLists=True, IncludeNullItems=True)  # -> simplify(Tree)
graft_12 = GraftTree(Tree=s_forces.Mxy_kN, IncludeEmptyLists=True, IncludeNullItems=True)  # -> simplify(Tree)
graft_13 = GraftTree(Tree=s_forces.Vx_kN_m, IncludeEmptyLists=True, IncludeNullItems=True)  # -> simplify(Tree)
graft_14 = GraftTree(Tree=s_forces.Vy_kN_m, IncludeEmptyLists=True, IncludeNullItems=True)  # -> simplify(Tree)
merge_8 = Merge(
    Data1=graft_7,
    Data2=graft_8,
    Data3=graft_9,
    Data4=graft_10,
    Data5=graft_11,
    Data6=graft_12,
    Data7=graft_13,
    Data8=graft_14)
flip = FlipMatrix(Data=merge_8)

vec_6 = Vector(shellvecresults.SecondPrincipalNormalForceVector_kN_m)
vec_7 = Vector(shellvecresults.FirstPrincipalNormalForceVector_kN_m)

vec_8 = Vector(shellvecresults.FirstPrincipalMomentVector_kN)
vec_9 = Vector(shellvecresults.SecondPrincipalMomentVector_kN)

model_5 = ModelKaramba(model)
modelview = ModelViewKaramba(Model=model_5, LoadCaseFactorsForLinearSuperposition=1, IndexOfVisibleLoadcase=-1, ListOfColorsForColoringPlots=gradient)  # -> Model, DeformedMesh, DeformedAxes, DeformedModel
shellview = ShellViewKaramba(Model=modelview.Model, IndexOfLayer=0)  # -> Model, MeshesOfRenderedShells, LegendColors, LegendTags
legend = Legend(Colour=shellview.LegendColors, Tags=shellview.LegendTags, LegendType=1)

num_76 = Number(flip)
mesh_5 = Mesh(disassemble.Mesh)
mesh_6 = Mesh(mesh_5)

model_6 = ModelKaramba(model)
modelview_2 = ModelViewKaramba(
    Model=model_6,
    LoadCaseFactorsForLinearSuperposition=1,
    IndexOfVisibleLoadcase=-1,
    ListOfColorsForColoringPlots=gradient_2)  # -> Model, DeformedMesh, DeformedAxes, DeformedModel
shellview_2 = ShellViewKaramba(Model=modelview_2.Model, IndexOfLayer=0)  # -> Model, MeshesOfRenderedShells, LegendColors, LegendTags
legend_2 = Legend(Colour=shellview_2.LegendColors, Tags=shellview_2.LegendTags, LegendType=1)

pt_16 = Point(meshtoshell.Points)
lng_2 = ListLength(List=pt_16)
multiplication_5 = Multiplication(A=lng_2, B=Slider(0.98, range=0..1))
reduce = RandomReduce(List=pt_16, Reduction=multiplication_5, Seed=Slider(37, range=0..100))
pt_17 = Point(reduce)

pt_18 = Point(flatten(pt_17))
model_7 = ModelKaramba(model)
shelllineresults_2 = LineResultsOnShellsKaramba3D(
    AnalyzedModel=model_7,
    LayerPosition="-1",
    ListOfSourcesOfPrincipalStressLinesLinesPoints=pt_18,
    SegmentLength_m=0.5,
    DA_deg=5,
    mode="PrincStress")  # -> AnalyzedModel, Lines1, Lines2

pt_19 = Point()
model_8 = ModelKaramba(model)
shelllineresults_3 = LineResultsOnShellsKaramba3D(
    AnalyzedModel=model_8,
    LayerPosition="-1",
    ListOfSourcesOfPrincipalStressLinesLinesPoints=pt_19,
    SegmentLength_m=0.5,
    DA_deg=5,
    mode="PrincStress")  # -> AnalyzedModel, Lines1, Lines2

line_5 = Line(shelllineresults_2.Lines1)
line_6 = Line(shelllineresults_2.Lines2)
line_7 = Line([shelllineresults_3.Lines1, shelllineresults_3.Lines2])

panel_25 = Panel("""1
-1
0""")
graft_15 = GraftTree(Tree=panel_25, IncludeEmptyLists=True, IncludeNullItems=True)
shellvecresults_2 = ResultVectorsOnShellsKaramba(AnalyzedModel=model_3, mode="PrincForce")  # -> AnalyzedModel, Points, FirstPrincipalNormalForceVector_kN_m, SecondPrincipalNormalForceVector_kN_m, FirstPrincipalMomentVector_kN, SecondPrincipalMomentVector_kN, FirstPrincipalNormalForceValue_kN_m, SecondPrincipalNormalForceValue_kN_m, FirstPrincipalMomentValue_kN, SecondPrincipalMomentValue_kN
shellvecresults_3 = ResultVectorsOnShellsKaramba(AnalyzedModel=model_3, LayerOfResults=graft_15, mode="PrincStress")  # -> AnalyzedModel, Points, FirstPrincipalStressVector_kN_cm2, SecondPrincipalStressVector_kN_cm2, FirstPrincipalStressValue_kN_cm2, SecondPrincipalStressValue_kN_cm2
disassemble_2 = DisassembleModelKaramba(Model=model_3)  # -> Model, Point, Beam, Shell, Support, Load, Line, Mesh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

graft_16 = GraftTree(Tree=panel_25, IncludeEmptyLists=True, IncludeNullItems=True)
shellvecresults_4 = ResultVectorsOnShellsKaramba(AnalyzedModel=model_4, LayerOfResults=graft_16, mode="PrincStress")  # -> AnalyzedModel, Points, FirstPrincipalStressVector_kN_cm2, SecondPrincipalStressVector_kN_cm2, FirstPrincipalStressValue_kN_cm2, SecondPrincipalStressValue_kN_cm2

vec_10 = Vector(shellvecresults_3.SecondPrincipalStressVector_kN_cm2)
vec_11 = Vector(shellvecresults_3.FirstPrincipalStressVector_kN_cm2)

vec_12 = Vector(shellvecresults_2.SecondPrincipalNormalForceVector_kN_m)
vec_13 = Vector(shellvecresults_2.FirstPrincipalNormalForceVector_kN_m)

vec_14 = Vector(shellvecresults_2.FirstPrincipalMomentVector_kN)
vec_15 = Vector(shellvecresults_2.SecondPrincipalMomentVector_kN)

vec_16 = Vector(shellvecresults_4.SecondPrincipalStressVector_kN_cm2)
vec_17 = Vector(shellvecresults_4.FirstPrincipalStressVector_kN_cm2)

vec_18 = Vector(vec_12)
vec_19 = Vector(vec_13)
vec_20 = Vector(vec_14)
vec_21 = Vector(vec_15)
vec_22 = Vector(vec_11)
vec_23 = Vector(vec_10)

path_mapper = PathMapper(vec_23, source="{A;B}", target="{A;B+7}")
path_mapper_2 = PathMapper(vec_22, source="{A;B}", target="{A;B+4}")
entwine_4 = Entwine(Branch00=vec_19, Branch01=vec_18, Branch02=vec_20, Branch03=vec_21, FlattenInputs=True)  # -> simplify(Result)
merge_9 = Merge(Data1=entwine_4, Data2=simplify(path_mapper_2), Data3=simplify(path_mapper))

vec_24 = Vector(vec_6)
vec_25 = Vector(vec_7)
vec_26 = Vector(vec_8)
vec_27 = Vector(vec_9)
vec_28 = Vector(vec_17)
vec_29 = Vector(vec_16)

path_mapper_3 = PathMapper(vec_29, source="{A;B}", target="{A;B+7}")
path_mapper_4 = PathMapper(vec_28, source="{A;B}", target="{A;B+4}")
entwine_5 = Entwine(Branch00=vec_25, Branch01=vec_24, Branch02=vec_26, Branch03=vec_27, FlattenInputs=True)  # -> simplify(Result)
merge_10 = Merge(Data1=entwine_5, Data2=simplify(path_mapper_4), Data3=simplify(path_mapper_3))
mesh_7 = Mesh(disassemble_2.Mesh)

# ---- group: Vector Fields
vec_30 = Vector(merge_9)

# ----
vec_31 = Vector(vec_30)
mesh_8 = Mesh(mesh_7)

# ---- group: Vector Fields
vec_32 = Vector(merge_10)

# ----
cluster = Cluster(mesh=mesh_8, vec=vec_4)  # -> vec_6, vec_5
entwine_6 = Entwine(Branch00=cluster.vec_6, Branch01=cluster.vec_5, FlattenInputs=True)  # -> simplify(Result)
path_mapper_5 = PathMapper(entwine_6, source="{A}", target="{A+10}")
merge_11 = Merge(Data1=vec_31, Data2=simplify(path_mapper_5))

vec_33 = Vector(vec_32)

cluster_2 = Cluster(mesh=mesh_6, vec=vec_5)  # -> vec_6, vec_5
entwine_7 = Entwine(Branch00=cluster_2.vec_6, Branch01=cluster_2.vec_5, FlattenInputs=True)  # -> simplify(Result)
path_mapper_6 = PathMapper(entwine_7, source="{A}", target="{A+10}")
merge_12 = Merge(Data1=vec_33, Data2=simplify(path_mapper_6))

mesh_9 = Mesh(mesh_8)
model_9 = ModelKaramba(model)
vec_34 = Vector(merge_11)

vec_35 = Vector(merge_12)
mesh_10 = Mesh(mesh_6)
num_77 = Number(num_76)
model_10 = ModelKaramba(model)

mesh_11 = Mesh(mesh_9)
vec_36 = Vector(vec_34)
python_2 = GhPythonScript(run=bool, mesh=mesh_11, vectors=vec_36, vector_tags=txt_10, internal_forces=num_11, force_tags=txt_4)  # -> out, cmesh; inputs mesh: Mesh, vectors: tree of Vector3d, vector_tags: list, internal_forces: tree, force_tags: list
# ---------- python_2: Python ----------
from compas.datastructures import Mesh
from compas_rhino.helpers import mesh_from_guid


min_force = 1e-6
if run is True:

    # instantiate mesh
    cmesh = mesh_from_guid(Mesh, mesh)
    
    for j, internal_force in enumerate(internal_forces.Branches):
        force_tag = force_tags[j]

        for fkey in cmesh.faces():
            force = internal_force[fkey]
            if force == 0.0:
                force = min_force

            cmesh.set_face_attribute(fkey, force_tag, force)

    for i, vector in enumerate(vectors.Branches):
        vector_tag = vector_tags[i]

        for fkey in cmesh.faces():
            vec = vector[fkey]
            vec = [vec.X, vec.Y, vec.Z]
           
            cmesh.set_face_attribute(fkey, vector_tag, vec)
            
    print("Compas mesh created and loaded")
# ---------- end python_2 ----------
panel_26 = Panel(python_2.out)
data = Data(python_2.cmesh)
mesh_12 = Mesh(mesh_10)
python_3 = GhPythonScript(x=mesh_12)  # -> out, a
# ---------- python_3: Python ----------
from compas_rhino.geometry import RhinoMesh


a = RhinoMesh.from_guid(x).to_compas()
# ---------- end python_3 ----------
num_78 = Number(num_77)
vec_37 = Vector(vec_35)
data_2 = Data(data)
python_4 = GhPythonScript(run=bool_4, cmesh=data_2, filepath=txt)  # -> out
# ---------- python_4: Python ----------
if run is True:
    cmesh.to_json(filepath)
    print("Exported!")
# ---------- end python_4 ----------
python_5 = GhPythonScript(run=bool_3, mesh=mesh_12, vectors=vec_37, vector_tags=txt_11, internal_forces=num_78, force_tags=txt_5)  # -> out, cmesh; inputs vectors: tree of Vector3d, vector_tags: list, internal_forces: tree, force_tags: list
# ---------- python_5: Python ----------
from compas.datastructures import Mesh
from compas_rhino.geometry import RhinoMesh


min_force = 1e-6
if run is True:

    # instantiate mesh
    cmesh = RhinoMesh.from_guid(mesh).to_compas()
    
    for j, internal_force in enumerate(internal_forces.Branches):
        force_tag = force_tags[j]

        for fkey in cmesh.faces():
            force = internal_force[fkey]
            if force == 0.0:
                force = min_force

            cmesh.face_attribute(fkey, force_tag, force)

    for i, vector in enumerate(vectors.Branches):
        vector_tag = vector_tags[i]

        for fkey in cmesh.faces():
            vec = vector[fkey]
            vec = [vec.X, vec.Y, vec.Z]
           
            cmesh.face_attribute(fkey, vector_tag, vec)
            
    print("Compas mesh created and loaded")
# ---------- end python_5 ----------
panel_27 = Panel(python_4)
panel_28 = Panel(python_5.out)
data_3 = Data(python_5.cmesh)
data_4 = Data(data_3)
python_6 = GhPythonScript(run=bool_13, cmesh=data_4, filepath=txt_2)  # -> out; same code as python_4
panel_29 = Panel(python_6)

mesh_13 = Mesh(mesh_9)
vec_38 = Vector(vec_34)
model_11 = ModelKaramba(model_9)

mesh_14 = Mesh(mesh_13)
vec_39 = Vector(vec_38)
model_12 = ModelKaramba(model_11)

mesh_15 = Mesh(mesh_14)
bool_30 = Boolean(bool_11)

# ---- group: Principal Vectors
vec_40 = Vector(vec_39)

vec_41 = Vector(vec_39)

# ----
mesh_16 = Mesh(mesh_14)
bool_31 = Boolean(bool_12)

python_7 = GhPythonScript(run=bool_30, mesh=mesh_15, vectors=vec_40, vectors_tags=txt_16)  # -> out, s_mesh; inputs mesh: Mesh, vectors: tree of Vector3d, vectors_tags: tree; disabled
# ---------- python_7: Python ----------
__author__ = "Rafael Pastrana"
__name__ = "Mesh Maker"
__date__ = "2018.07.19"
__version__ = "0.0.1"


# 1. Import dependencies
import sys
import imp
import rhinoscriptsyntax as rs

# 1-b. Replace with your own path here
sys.path.append("Z:\code\libraries\streamlines\src\streamlines")

import custom_mesh
imp.reload(custom_mesh)

from custom_mesh import StructuralMesh
from compas.datastructures import Mesh
from compas_rhino.helpers import mesh_from_guid

# Define Global Variables
NORM = False

# 2. Start System
if run is True:
    print('SYSTEM STARTED')
        
    # instantiate mesh
    my_mesh = StructuralMesh(mesh_from_guid(Mesh, mesh))

    # set vector attributes
    for idx, vector_field in enumerate(vectors.Branches):
        tag = vectors_tags.Branches[idx][0]
        clean_vectors = [[vec.X, vec.Y, vec.Z] for vec in vector_field]
        my_mesh.set_face_vectors(clean_vectors, tag, NORM)
        # my_mesh.set_vertex_vectors(tag)
        my_mesh.set_vertex_vectors_angles(tag)
    
    # output mesh
    s_mesh = my_mesh
# ---------- end python_7 ----------
wbedges = WeaverbirdsMeshEdges(MeshOrPolylines=mesh_15)
wbedges_2 = WeaverbirdsMeshEdges(MeshOrPolylines=mesh_16)
python_8 = GhPythonScript(run=bool_31, mesh=mesh_16, vectors=vec_41, vectors_tags=txt_17, filepath=panel_13)  # -> out, s_mesh; inputs mesh: Mesh, vectors: tree of Vector3d, vectors_tags: tree
# ---------- python_8: Python ----------
__author__ = "Rafael Pastrana"
__name__ = "Mesh Maker"
__date__ = "2018.07.19"
__version__ = "0.0.1"


# 1. Import dependencies
import sys
import imp
import rhinoscriptsyntax as rs

# 1-b. Replace with your own path here
sys.path.append("Z:\code\libraries\streamlines\src\streamlines")

import custom_mesh
imp.reload(custom_mesh)

from custom_mesh import StructuralMesh
from compas.datastructures import Mesh
from compas_rhino.helpers import mesh_from_guid

# Define Global Variables
NORM = True

# 2. Start System
if run is True:
    print('SYSTEM STARTED')
        
    # instantiate mesh
    compas_mesh = mesh_from_guid(Mesh, mesh)

    # set vector attributes
    for idx, vector_field in enumerate(vectors.Branches):
        tag = vectors_tags.Branches[idx][0]
        clean_vectors = [[vec.X, vec.Y, vec.Z] for vec in vector_field]
        # my_mesh.set_face_vectors(clean_vectors, tag, NORM)
        # my_mesh.set_vertex_vectors(tag)
        # my_mesh.set_vertex_vectors_angles(tag)
        help(compas_mesh.set_face_attribute)
        
        for jdx, vector in enumerate(clean_vectors):
            compas_mesh.set_face_attribute(jdx, tag, vector)
        # compas_mesh.set_faces_attributes(tag, clean_vectors)
        
    
    # output mesh
    
    compas_mesh.dump(filepath)
# ---------- end python_8 ----------
lng_3 = ListLength(List=wbedges)
lng_4 = ListLength(List=wbedges_2)
data_5 = Data(python_7.s_mesh)
data_6 = Data(python_8.s_mesh)
panel_30 = Panel(lng_3)
panel_31 = Panel(lng_4)

# ---- group: s_mesh
data_7 = Data(data_5)

# ----
python_9 = GhPythonScript(s_mesh=data_7, vector_tag=txt_18)  # -> out, s_mesh, vector_field
# ---------- python_9: Python ----------
# 1. Import dependencies
import rhinoscriptsyntax as rs
import copy

print('number of edges is: {}'.format(len([e for e in s_mesh.c_mesh.edges()])))

# 2. Start System
my_mesh = s_mesh
v_name = vector_tag

# vector properties
vector_field = [x[0] for x in my_mesh.find_vector_face_centers(v_name)]
vector_field = [rs.CreateVector(x) for x in vector_field]
s_mesh = my_mesh
# ---------- end python_9 ----------
vec_42 = Vector(python_9.vector_field)
model_13 = ModelKaramba(model_12)
vec_43 = Vector(vec_42)

disassemble_3 = DisassembleModelKaramba(Model=model_13)  # -> Model, Point, Beam, Shell, Support, Load, Line, Mesh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
orientate_2 = OrientateElemKaramba(Shell=disassemble_3.Shell, XOrientations=unitize(vec_43), mode="Shell")
assemble_2 = AssembleModelKaramba(
    Points=disassemble_3.Point,
    Elem=orientate_2,
    Support=disassemble_3.Support,
    Load=disassemble_3.Load,
    LimitDistance_m=0.005)  # -> Model, Info, Mass_kg, CenterOfGravity
analyzethi_2 = AnalyzeThIKaramba(Model=assemble_2.Model)  # -> CalculatedModel, MaximumDisplacement_m, ResultingForceOfGravity_kN, ElasticEnergy_kNm

model_14 = ModelKaramba(analyzethi_2.CalculatedModel)

model_15 = ModelKaramba(model_14)
modelview_3 = ModelViewKaramba(Model=model_15, LoadCaseFactorsForLinearSuperposition=1, IndexOfVisibleLoadcase=-1)  # -> Model, DeformedMesh, DeformedAxes, DeformedModel
shellview_3 = ShellViewKaramba(Model=modelview_3.Model, IndexOfLayer=0)  # -> Model, MeshesOfRenderedShells, LegendColors, LegendTags
legend_3 = Legend(Colour=shellview_3.LegendColors, Tags=shellview_3.LegendTags, LegendType=1)

model_16 = ModelKaramba(model_14)
modelview_4 = ModelViewKaramba(
    Model=model_16,
    LoadCaseFactorsForLinearSuperposition=1,
    IndexOfVisibleLoadcase=-1,
    ListOfColorsForColoringPlots=gradient_4)  # -> Model, DeformedMesh, DeformedAxes, DeformedModel
shellview_4 = ShellViewKaramba(Model=modelview_4.Model, IndexOfLayer=0)  # -> Model, MeshesOfRenderedShells, LegendColors, LegendTags
legend_4 = Legend(Colour=shellview_4.LegendColors, Tags=shellview_4.LegendTags, LegendType=1)

panel_32 = Panel(analyzethi_2.MaximumDisplacement_m)
model_17 = ModelKaramba(model_14)

graft_17 = GraftTree(Tree=panel_16, IncludeEmptyLists=True, IncludeNullItems=True)
shellvecresults_5 = ResultVectorsOnShellsKaramba(AnalyzedModel=model_17, LayerOfResults=graft_17, mode="PrincStress")  # -> AnalyzedModel, Points, FirstPrincipalStressVector_kN_cm2, SecondPrincipalStressVector_kN_cm2, FirstPrincipalStressValue_kN_cm2, SecondPrincipalStressValue_kN_cm2
shellvecresults_6 = ResultVectorsOnShellsKaramba(AnalyzedModel=model_17, mode="PrincForce")  # -> AnalyzedModel, Points, FirstPrincipalNormalForceVector_kN_m, SecondPrincipalNormalForceVector_kN_m, FirstPrincipalMomentVector_kN, SecondPrincipalMomentVector_kN, FirstPrincipalNormalForceValue_kN_m, SecondPrincipalNormalForceValue_kN_m, FirstPrincipalMomentValue_kN, SecondPrincipalMomentValue_kN
path_mapper_7 = PathMapper(shellvecresults_5.SecondPrincipalStressValue_kN_cm2, source="{A;B}", target="{A;B+7}")
path_mapper_8 = PathMapper(shellvecresults_5.FirstPrincipalStressValue_kN_cm2, source="{A;B}", target="{A;B+4}")
entwine_8 = Entwine(
    Branch00=shellvecresults_6.FirstPrincipalNormalForceValue_kN_m,
    Branch01=shellvecresults_6.SecondPrincipalNormalForceValue_kN_m,
    Branch02=shellvecresults_6.FirstPrincipalMomentValue_kN,
    Branch03=shellvecresults_6.SecondPrincipalMomentValue_kN,
    FlattenInputs=True)  # -> simplify(Result)
merge_13 = Merge(Data1=entwine_8, Data2=simplify(path_mapper_8), Data3=simplify(path_mapper_7))

s_forces_2 = ShellForcesKaramba(AnalyzedModel=model_17, LCase=0, mode="Local")  # -> AnalyzedModel, Nxx_kN_m, Nyy_kN_m, Nxy_kN_m, Mxx_kN, Myy_kN, Mxy_kN, Vx_kN_m, Vy_kN_m
graft_18 = GraftTree(Tree=s_forces_2.Nxx_kN_m, IncludeEmptyLists=True, IncludeNullItems=True)  # -> simplify(Tree)
graft_19 = GraftTree(Tree=s_forces_2.Nyy_kN_m, IncludeEmptyLists=True, IncludeNullItems=True)  # -> simplify(Tree)
graft_20 = GraftTree(Tree=s_forces_2.Nxy_kN_m, IncludeEmptyLists=True, IncludeNullItems=True)  # -> simplify(Tree)
graft_21 = GraftTree(Tree=s_forces_2.Mxx_kN, IncludeEmptyLists=True, IncludeNullItems=True)  # -> simplify(Tree)
graft_22 = GraftTree(Tree=s_forces_2.Myy_kN, IncludeEmptyLists=True, IncludeNullItems=True)  # -> simplify(Tree)
graft_23 = GraftTree(Tree=s_forces_2.Mxy_kN, IncludeEmptyLists=True, IncludeNullItems=True)  # -> simplify(Tree)
graft_24 = GraftTree(Tree=s_forces_2.Vx_kN_m, IncludeEmptyLists=True, IncludeNullItems=True)  # -> simplify(Tree)
graft_25 = GraftTree(Tree=s_forces_2.Vy_kN_m, IncludeEmptyLists=True, IncludeNullItems=True)  # -> simplify(Tree)
merge_14 = Merge(
    Data1=graft_18,
    Data2=graft_19,
    Data3=graft_20,
    Data4=graft_21,
    Data5=graft_22,
    Data6=graft_23,
    Data7=graft_24,
    Data8=graft_25)
flip_2 = FlipMatrix(Data=merge_14)

num_79 = Number(merge_13)
num_80 = Number(flip_2)

txt_30 = Text(flatten(txt_3))
data_8 = Data(data_5)

num_81 = Number(num_80)

# ---- group: Assign Local Internal Forces to sMesh
python_10 = GhPythonScript(s_mesh=data_8, int_forces=num_81, force_tags=txt_30)  # -> out, s_mesh; inputs int_forces: tree, force_tags: list
# ---------- python_10: Python ----------
__author__ = "Rafael Pastrana"
__name__ = "Mesh Maker"
__date__ = "2018.07.19"
__version__ = "0.0.1"


# 1. Import dependencies
import rhinoscriptsyntax as rs
import copy

# 2. Start System
# set vector attributes
my_mesh = s_mesh


for idx, int_force in enumerate(int_forces.Branches):
    tag = force_tags[idx]
    
    for f_key in my_mesh.c_mesh.faces():
        force = int_force[f_key]
        if force == 0:
            force = 1e-7
            
        my_mesh.c_mesh.set_face_attribute(f_key, str(tag), force)

s_mesh = my_mesh
# ---------- end python_10 ----------

# ----
data_9 = Data(python_10.s_mesh)
data_10 = Data(data_9)
num_82 = Number(num_79)

# ---- group: Assign Principal Internal Forces to sMesh
python_11 = GhPythonScript(s_mesh=data_10, int_forces=num_82, force_tags=txt_19)  # -> out, s_mesh; inputs int_forces: tree, force_tags: list
# ---------- python_11: Python ----------
__author__ = "Rafael Pastrana"
__name__ = "Mesh Maker"
__date__ = "2018.07.19"
__version__ = "0.0.1"


# 1. Import dependencies
import rhinoscriptsyntax as rs
import copy

TAG = '_val'
my_mesh = s_mesh

# 2. Start System
# set vector attributes
for idx, int_force in enumerate(int_forces.Branches):
    f_tag = force_tags[idx] + TAG
    
    for f_key in my_mesh.c_mesh.faces():
        force = int_force[f_key]
        if force == 0:
            force = 1e-7
        my_mesh.c_mesh.set_face_attribute(f_key, str(f_tag), force)

s_mesh = my_mesh
# ---------- end python_11 ----------

# ----
data_11 = Data(python_11.s_mesh)
data_12 = Data(data_11)

mesh_17 = Mesh(mesh_13)
line_8 = Line(crv_17)

line_topo_2 = LineTopology(ListOfLines=line_8, Tolerance=0.001)  # -> ListOfPoints, LinePointStructure, PointPointStructure, PointLineStructure
meshcp = MeshClosestPoint(Point=line_topo_2.ListOfPoints, Mesh=mesh_17)  # -> Point, Index, Parameter
facen = FaceNormals(Mesh=mesh_17)  # -> Centers, Normals
item_9 = ListItem(List=facen.Normals, Index=meshcp.Index, Wrap=True)
unit = UnitVector(Vector=item_9)
multiplication_6 = Multiplication(A=unit, B="0.1")
pl = PlaneNormal(Origin=meshcp.Point, ZAxis=unit)
vdisex_2 = VectorDisplayEx(Point=meshcp.Point, Vector=multiplication_6, Colour=RGB(0, 0, 0), Width=2)

meval = MeshEval(Mesh=mesh_17, Parameter=meshcp.Parameter)  # -> Point, Normal, Colour

pln = Plane(pl)
int_19 = Integer(line_topo_2.PointPointStructure)
pt_20 = Point(line_topo_2.ListOfPoints)

crv_18 = Curve(crv_16)
pt_21 = Point(pt_20)
explode_4 = Explode(Curve=crv_18, Recursive=True)  # -> Segments, simplify(Vertices)
python_12 = GhPythonScript(pts=pt_21, y=explode_4.Vertices, tol=Slider(0.01, range=0..0.01))  # -> out, a; inputs pts: list of Point3d, y: tree of Point3d
# ---------- python_12: Python ----------
__author__ = "ARPJ"
__version__ = "2018.09.16"

import rhinoscriptsyntax as rs
import clr
clr.AddReference("Grasshopper")
import Grasshopper.Kernel.Data.GH_Path as ghpath
import Grasshopper.DataTree as datatree
import System
 
a = datatree[System.Object]()
import compas.geometry as cg
from compas.geometry import KDTree

search_points = list(map(lambda x: [x.X, x.Y, x.Z], pts))
search_tree = KDTree(search_points)

for idx, branch in enumerate(y.Branches):

    for point in branch:
        pt = [point.X, point.Y, point.Z]
        nbr, label, d = search_tree.nearest_neighbor(pt)
        print('distance is {}'.format(d))
        if d <= tol:
            a.Add(point, ghpath(idx))
# ---------- end python_12 ----------
pline_2 = PolyLine(Vertices=python_12.a, Closed=False)
intcrv = Interpolate(Vertices=python_12.a, Degree="3", Periodic=False, KnotStyle=1)  # -> Curve, Length, Domain
crv_19 = Curve(pline_2)

pln_2 = Plane(pln)
pt_22 = Point(pt_20)
int_20 = Integer(int_19)

gcfl = GetCellsFromLines(Connectivity=int_20, Points=pt_22, Planes=pln_2)
int_21 = Integer(gcfl)
pt_23 = Point(pt_22)
pt_24 = Point(pt_23)
cir = Circle(Plane=pt_24, Radius="0.04")
crv_20 = Curve(cir)
item_10 = ListItem(List=pt_23, Index=int_21, Wrap=True)
pt_25 = Point(pt_23)
int_22 = Integer(int_21)
pline_3 = PolyLine(Vertices=item_10, Closed=False)
python_13 = GhPythonScript(rs_points=pt_25, topology=int_22)  # -> out, mesh_face_centroids, mesh_edges, mesh_vertices, mesh_face_vertices; inputs rs_points: list of Point3d, topology: tree of Int32
# ---------- python_13: Python ----------
__author__ = "ARPJ"
__version__ = "2018.07.25"

import rhinoscriptsyntax as rs
import compas.datastructures
import compas_rhino
import System
import clr
clr.AddReference("Grasshopper")
import Grasshopper.Kernel.Data.GH_Path as ghpath
import Grasshopper.DataTree as datatree
import Rhino.Geometry as rg
from compas.datastructures import Mesh
from compas.datastructures import Network

FACTOR = 5

def get_coordinates(points):
    return [(point.X, point.Y, point.Z) for point in points]

def get_line_coordinates(lines):
    line_coords = []
    for line in lines:
          line_coord = rs.CurveStartPoint(line), rs.CurveEndPoint(line)
          line_coords.append(get_coordinates(line_coord))
    return line_coords

def get_edges_lines(dstr, geo=True):
    edges = []
    for u, v in dstr.edges():
        start, end = dstr.edge_coordinates(u, v)
        if geo is True:
            edges.append(rs.AddLine(start, end))
        else:
            edges.append((start, end))
    return edges
    
def get_vertices_points(dstr, geo=True):
    points = []
    for v in dstr.vertices():
        if geo is True:
            points.append(rs.AddPoint(dstr.vertex_coordinates(v)))
        else:
            points.append(dstr.vertex_coordinates(v))
    return points

def get_faces_centroids(dstr):
    centroids = []
    for f_key in dstr.faces():
        pt = rs.AddPoint(*dstr.face_centroid(f_key))
        centroids.append(pt)
    return centroids

def get_vertices_faces(gh_mesh):
    vertices = [[v.X, v.Y, v.Z] for v in rs.MeshVertices(gh_mesh)]
    faces = [list(face) for face in rs.MeshFaceVertices(gh_mesh)]
    return vertices, faces
    
def get_face_rs_vertices(c_mesh):
    f_ver = datatree[System.Object]()
    
    for idx, f in enumerate(c_mesh.faces()):
        f_ver.AddRange([rg.Point3d(*c) for c in c_mesh.face_coordinates(f)], ghpath(idx))
    
    return f_ver
    
def get_faces_topology(topo):
    faces = []
    for cell in topo.Branches:
        new_cell =[value for value in cell]
        faces.append(new_cell)
    return faces

def sanitize_faces(mesh):
    ids = []
    h_e = [mesh.face_halfedges(f) for f in mesh.faces()]
    
    thres = sum(list(map(lambda x: len(x), h_e))) / len(h_e)
    thres = thres * FACTOR
    print('threshold is {}'.format(thres))
    for f in mesh.faces():
        if len(mesh.face_halfedges(f)) > thres:
            ids.append(f)
            
    if len(ids) > 0:
        for id in ids:
            mesh.delete_face(id)
        print('----')
        print('{} faces were sanitized'.format(len(ids)))
    return mesh
        
def sanitize_edges(mesh):
    ids = []
    for u, v in mesh.edges():
        num_f = list(mesh.edge_faces(u, v))
        
        if None in num_f:
            clean_num_f = [x for x in num_f if x is not None]
            if len(clean_num_f) > 1:
                com = [(f, len(mesh.face_vertices(f))) for f in clean_num_f]
                com = sorted(com, key=lambda x: x[1])
                ids.append(com[-1][0])
    
    if len(ids) > 0:
        for id in ids:
            mesh.delete_face(id)
        print('----')
        print('{} faces were sanitized'.format(len(ids)))
    return mesh

m_v = get_coordinates(rs_points)
m_f = get_faces_topology(topology)

# print(len(m_v))
# print(len(m_f))
# print(m_f[1])

c_mesh = Mesh.from_vertices_and_faces(m_v, m_f)
#c_mesh = sanitize_edges(c_mesh)
c_mesh = sanitize_faces(c_mesh)
#print(c_mesh)

# cull out redundant faces
# 1. faces that contain several faces

# display
mesh_face_centroids = get_faces_centroids(c_mesh)
mesh_edges = get_edges_lines(c_mesh)
mesh_vertices = get_vertices_points(c_mesh)
mesh_face_vertices = get_face_rs_vertices(c_mesh)
# ---------- end python_13 ----------
panel_33 = Panel(python_13.out)
line_9 = Line(python_13.mesh_edges)
pt_26 = Point(python_13.mesh_vertices)
pt_27 = Point(python_13.mesh_face_vertices)
pt_28 = Point(python_13.mesh_face_centroids)

panel_34 = Panel("""bottom layer
top layer
center layer
total """)
panel_35 = Panel("""asx_b
asx_t
asy_b
asy_t
asx_c
asy_c""")

entwine_9 = Entwine(
    Branch00=ColourSwatch(SwatchColor=RGB(0, 124, 247)),
    Branch01=ColourSwatch(SwatchColor=RGB(1, 35, 97)),
    Branch02=ColourSwatch(SwatchColor=RGB(1, 97, 92)),
    FlattenInputs=True)

X_2 = UnitX(Factor="6")

X_3 = UnitX(Factor="6")

entwine_10 = Entwine(
    Branch00=ColourSwatch(SwatchColor=RGB(227, 9, 118)),
    Branch01=ColourSwatch(SwatchColor=RGB(214, 204, 4)),
    FlattenInputs=True)

entwine_11 = Entwine(
    Branch00=ColourSwatch(SwatchColor=RGB(255, 255, 255)),
    Branch01=ColourSwatch(SwatchColor=RGB(0, 255, 38)),
    Branch02=ColourSwatch(SwatchColor=RGB(0, 128, 255)),
    FlattenInputs=True)
X_4 = UnitX(Factor="0")

# ---- group: Make RC Design
python_14 = GhPythonScript(run=bool_15, s_mesh=data_12, heights=num_25, covers=num_26, fck=num_27, fy=num_28, fctd_factor=num_29, force_tags=txt_20)  # -> out, s_mesh, asxb, asxt, asyb, asyt, asxc, asyc, ast; inputs run: Boolean, force_tags: list
# ---------- python_14: Python ----------
"""NOTE 18.08.01: Bottom and Top were inverted for compatibility"""

__author__ = "Rafael Pastrana"
__name__ = "Sandwich"
__date__ = "2018.08.01"
__version__ = "0.0.2"

# 1. Import dependencies
import sys
import imp
import rhinoscriptsyntax as rs

# 1-b. Replace with your own path here
sys.path.append("Z:\projects\streamlines\src\streamlines")

import materials
import basic_sandwich

imp.reload(materials)
imp.reload(basic_sandwich)

from basic_sandwich import ReinforcedShell
from materials import Concrete
from materials import Rebar


# 2. Create Input Material Data
myConcrete = Concrete(fck)
myRebar = Rebar(fy)
#myConcrete.printSummary()

# 3. Perform Reinforcement Design
my_mesh = s_mesh

asxb = []
asyb = []
asxt = []
asyt = []
asxc = []
asyc = []

ast = []
shells = []

if run is True:
    for idx, f_key in enumerate(s_mesh.c_mesh.faces()):
        forces = s_mesh.c_mesh.get_face_attributes(f_key, force_tags)
        myForces = {str(a): b for a, b in zip(force_tags, forces)}
        
        myShell = ReinforcedShell(idx, myConcrete, myRebar, heights, covers)
        myShell.tcred = myShell.concrete.fctd * fctd_factor
        
        # 4. Perform Reinforcement Design Routine
        myShell.applyForces(**myForces)
        
        # new version 25.08.18
        myShell.get_membrane_forces()
        myShell.get_reinforcement_forces()
        myShell.design_reinforcement()
        
        # 5. Append Results to Output Lists. Bottom and top were inverted
        shells.append(myShell)
        
        asxb.append(myShell.asxt)
        asyb.append(myShell.asyt)
        
        asxt.append(myShell.asxb)
        asyt.append(myShell.asyb)
        
        asxc.append(myShell.asxc)
        asyc.append(myShell.asyc)
        
        ast.append(myShell.ast)
        
        # 6. Set Face Attributes. Bottom and top were inverted
        my_mesh.c_mesh.set_face_attribute(f_key, 'asx_b', myShell.asxt)
        my_mesh.c_mesh.set_face_attribute(f_key, 'asx_t', myShell.asxb)
        my_mesh.c_mesh.set_face_attribute(f_key, 'asy_b', myShell.asyt)
        my_mesh.c_mesh.set_face_attribute(f_key, 'asy_t', myShell.asyb)
        
        my_mesh.c_mesh.set_face_attribute(f_key, 'asx_c', myShell.asxc)
        my_mesh.c_mesh.set_face_attribute(f_key, 'asy_c', myShell.asyc)
        
        my_mesh.c_mesh.set_face_attribute(f_key, 'asx_', (myShell.asxc + myShell.asxt + myShell.asxb))
        my_mesh.c_mesh.set_face_attribute(f_key, 'asy_', (myShell.asyc + myShell.asyt + myShell.asyb))
    
        
    # 6. Retrieve Statistics
    print("# of Elements with Crushed Core: {}".format(len([shell for shell in shells if shell.coreCrush == True])))
    print("# of Elements with Crushed Top Cover: {}".format(len([shell for shell in shells if shell.tsupCrush == True])))
    print("# of Elements with Crushed Bottom Cover: {}".format(len([shell for shell in shells if shell.tinfCrush == True])))
    print("----------------------------------")
    print("Shear Force Vo in Crushed Core Elements: {}".format([shell.vo for shell in shells if shell.coreCrush == True]))
    print("----------------------------------")
# ---------- end python_14 ----------
num_83 = Number(python_14.asyt)
num_84 = Number(python_14.ast)
num_85 = Number(python_14.asyb)
num_86 = Number(python_14.asxb)
num_87 = Number(python_14.asxt)

# ----
num_88 = Number(python_14.asxc)
num_89 = Number(python_14.asyc)
num_90 = Number(num_88)
num_91 = Number(num_89)

# ---- group: Make RC Design (continued)
num_92 = Number(num_86)
num_93 = Number(num_87)
num_94 = Number(num_85)
num_95 = Number(num_83)
entwine_12 = Entwine(Branch00=num_92, Branch01=num_93, Branch02=num_94, Branch03=num_95, Branch04=num_90, Branch05=num_91, FlattenInputs=True)

# ----
entwine_13 = Entwine(Branch00=num_92, Branch01=num_93, Branch02=num_94, Branch03=num_95, FlattenInputs=True)

data_13 = Data(python_14.out)
num_96 = Number(entwine_12)

data_14 = Data(python_14.s_mesh)
num_97 = Number(entwine_13)

# ---- group: s_mesh
data_15 = Data(data_14)

# ----
python_15 = GhPythonScript(s_mesh=data_15, diam=num_52, max_sp=num_53)  # -> out, s_mesh, sp_asx, sp_asy; inputs diam: list, max_sp: list
# ---------- python_15: Python ----------
# 1. Import dependencies
import rhinoscriptsyntax as rs
import Rhino.Geometry as rg
import math


# 1-b. Define Globals
TAG = 'spacing_'
TOL = 1e-6
AS_TAGS = ['asx_', 'asy_']
my_mesh = s_mesh

# 1-c. Define Functions

def get_bar_area(diameter):
    return math.pi * math.pow((diameter / 10), 2) / 4

def steel_area_to_spacing(steel_areas, diameter, max):
    spacings = []
    bar_area = get_bar_area(diameter)
    
    for s_area in steel_areas:
        if s_area < TOL:
            s_area = TOL
        spacing = s_area / bar_area
        spacing = 1 / spacing
        
        if spacing > max:
            spacing = max
        spacings.append(spacing)
    return spacings

# 2. Set Data
for f_key in my_mesh.c_mesh.faces():
    for as_tag in AS_TAGS:
        steel_area = my_mesh.c_mesh.get_face_attribute(f_key, as_tag)
        if as_tag[2] == 'x':
            sp = steel_area_to_spacing([steel_area], diam[0], max_sp[0])[0]
            my_mesh.c_mesh.set_face_attribute(f_key, TAG+as_tag, sp)
            my_mesh.c_mesh.set_face_attribute(f_key, 'bar_diameter_x', diam[0])
            
        elif as_tag[2] == 'y':
            sp = steel_area_to_spacing([steel_area], diam[1], max_sp[1])[0]
            my_mesh.c_mesh.set_face_attribute(f_key, TAG+as_tag, sp)
            my_mesh.c_mesh.set_face_attribute(f_key, 'bar_diameter_y', diam[1])
            
# 3. Get Data

s_mesh = my_mesh
keys = [f_key for f_key in my_mesh.c_mesh.faces()]

sp_asx_ = my_mesh.c_mesh.get_faces_attribute(keys, TAG+AS_TAGS[0])
sp_asy_ = my_mesh.c_mesh.get_faces_attribute(keys, TAG+AS_TAGS[1])

t_sp_asx_ = sorted(sp_asx_)
t_sp_asy_ = sorted(sp_asy_)

print('Spacings for ASX_ min is {0}. max is {1}'.format(t_sp_asx_[0], t_sp_asx_[-1]))
print('Spacings for ASY_ min is {0}. max is {1}'.format(t_sp_asy_[0], t_sp_asy_[-1]))
# ---------- end python_15 ----------
data_16 = Data(python_15.out)
data_17 = Data(python_15.s_mesh)

# ---- group: s_mesh
data_18 = Data(data_17)

# ----
python_16 = GhPythonScript(s_mesh=data_18, perc=num_54)  # -> out, s_mesh, face_centers, seeds_x, seeds_y; inputs perc: list
# ---------- python_16: Python ----------
# 1. Import dependencies
import rhinoscriptsyntax as rs
import Rhino.Geometry as rg
import math


# 1-b. Define Globals
my_mesh = s_mesh
TAG = 'spacing_'
TOL = 1e-6
AS_TAGS = ['asx_', 'asy_']
seeds_x = []
seeds_y = []
face_centers = []

# 1-c. Define Functions

# 2. Set and Get Data
as_dir_1 = TAG + AS_TAGS[0]
as_dir_2 = TAG + AS_TAGS[1]
keys = [f_key for f_key in my_mesh.c_mesh.faces()]

max_dir_1 = sorted(my_mesh.c_mesh.get_faces_attribute(keys, as_dir_1))[-1]
max_dir_2 = sorted(my_mesh.c_mesh.get_faces_attribute(keys, as_dir_2))[-1]
print('Max AS in dir X is {} cm2/m. In dir Y is {} cm2/m'.format(max_dir_1, max_dir_2))

for f_key in my_mesh.c_mesh.faces():
    my_as_dir_1 = my_mesh.c_mesh.get_face_attribute(f_key, as_dir_1)
    my_as_dir_2 = my_mesh.c_mesh.get_face_attribute(f_key, as_dir_2)
    pt = rg.Point3d(*my_mesh.c_mesh.face_centroid(f_key))
    
    face_centers.append(pt)
    if my_as_dir_1 <= max_dir_1 * perc[0]:
        seeds_x.append((pt, my_as_dir_1))
    if my_as_dir_2 <= max_dir_2 * perc[1]:
        seeds_y.append((pt, my_as_dir_2))

s_mesh = my_mesh
seeds_x = [seed[0] for seed in sorted(seeds_x, key=lambda x: x[1])]
seeds_y = [seed[0] for seed in sorted(seeds_y, key=lambda x: x[1])]

print('Number of Seeds in X direction is {}'.format(len(seeds_x)))
print('Number of Seeds in Y direction is {}'.format(len(seeds_y)))
# ---------- end python_16 ----------
num_98 = Number(python_15.sp_asx)
num_99 = Number(python_15.sp_asy)
pt_29 = Point(python_16.seeds_y)

# ---- group: seeds Y
pt_30 = Point(pt_29)

# ----
pt_31 = Point(python_16.seeds_x)

# ---- group: seeds X
pt_32 = Point(pt_31)

# ----
entwine_14 = Entwine(Branch00=pt_32, Branch01=pt_30, FlattenInputs=True)
filter = StreamFilter(Gate=bool_14, Stream1=entwine_14)
dots = DotDisplay(Point=filter, Colour=entwine_10, Size="0.01")

data_19 = Data(python_16.out)
data_20 = Data(python_16.s_mesh)  # disabled
pt_33 = Point(python_16.face_centers)  # disabled

# ---- group: s_mesh
data_21 = Data(data_17)

data_22 = Data(data_17)

data_23 = Data(data_17)

data_24 = Data(data_17)

# ----
python_17 = GhPythonScript(show=bool_19, s_mesh=data_22, vector_tag=txt_23, v_scale=num_32)  # -> out, s_mesh, line_field, node_line_field, centers_line_field, colors_line_field, colors_node_line_field, colors_centers_line_field, vectors_a, vectors_b; inputs show: Boolean
# ---------- python_17: Python ----------
"""Retrieves data from a Structural Mesh object"""

__author__ = "Rafael Pastrana"
__name__ = "Mesh Displayer"
__date__ = "2018.07.24"
__version__ = "0.0.1"


# 1. Import dependencies
import imp
import rhinoscriptsyntax as rs
import sys
sys.path.append("Z:\projects\streamlines\src\streamlines")
import display
imp.reload(display)
from display import Display
import compas.geometry as cg

dsp = Display()

# 2. Start System
my_mesh = s_mesh
v_name = vector_tag
TAG = '_val'

if show is True:
    # vector properties
    line_field = dsp.draw_face_vectors(my_mesh, v_name, v_scale)
    node_line_field = dsp.draw_node_vectors(my_mesh, v_name, v_scale)
    center_vectors = my_mesh.find_vector_face_centers(v_name)
    centers = list(map(lambda x: my_mesh.c_mesh.face_centroid(x), my_mesh.c_mesh.faces()))
    centers_line_field = dsp.draw_vectors(centers, center_vectors, v_scale)
        
    f_color = []
    for f_key in my_mesh.c_mesh.faces():
        val = my_mesh.c_mesh.get_face_attribute(f_key, v_name+TAG)
        if val:
            if val < 0:
                f_color.append(rs.CreateColor(255,0,0))
            else:
                f_color.append(rs.CreateColor(0,0,255))
        else:
            f_color.append(rs.CreateColor(0,0,255))
            
    n_color = []
    for v_key in my_mesh.c_mesh.vertices():
        val = my_mesh.c_mesh.get_vertex_attribute(v_key, v_name+TAG)
        if val < 0:
            n_color.append(rs.CreateColor(0,0,0))
        else:
            n_color.append(rs.CreateColor(0,0,0))
    
    colors_line_field = f_color
    colors_node_line_field = n_color
    colors_centers_line_field = f_color
    
    vectors_a = list(map(lambda x: my_mesh.c_mesh.get_vertex_attribute(x,v_name+'_a'), my_mesh.c_mesh.vertices()))
    vectors_a = list(map(lambda x: rs.CreateVector(*x), vectors_a))
    
    vectors_b = list(map(lambda x: my_mesh.c_mesh.get_vertex_attribute(x,v_name+'_b'), my_mesh.c_mesh.vertices()))
    vectors_b = list(map(lambda x: rs.CreateVector(*x), vectors_b))
# ---------- end python_17 ----------
python_18 = GhPythonScript(show=bool_20, s_mesh=data_23, vector_tag=txt_25, v_scale=num_31)  # -> out, s_mesh, line_field, node_line_field, centers_line_field, colors_line_field, colors_node_line_field, colors_centers_line_field, vectors_a, vectors_b; inputs show: Boolean; same code as python_17
python_19 = GhPythonScript(show=bool_16, s_mesh=data_21, data_tag=txt_22, mode=txt_21)  # -> out, s_mesh, display_mesh, color_data, data_values; inputs show: Boolean
# ---------- python_19: Python ----------
"""Retrieves data from a Structural Mesh object"""

__author__ = "Rafael Pastrana"
__name__ = "Mesh Displayer"
__date__ = "2018.07.24"
__version__ = "0.0.1"


# 1. Import dependencies
import imp
import copy
import rhinoscriptsyntax as rs
import sys
sys.path.append("Z:\Dropbox\Documentos\ETH Zuerich\ETH MAS Thesis\code\current")

import Display
imp.reload(Display)
from Display import Display

dsp = Display()
my_mesh = s_mesh

# 2. Start System
if show is True:
    display_mesh = my_mesh.gh_mesh
    color_data = None
    data_values = my_mesh.get_data_on_nodes(data_tag, mode)
    # display_mesh, data_values, color_data = dsp.plot_mesh(my_mesh, data_tag, mode)
# ---------- end python_19 ----------
data_25 = Data(python_19.s_mesh)
python_20 = GhPythonScript(s_mesh=data_24, steel_density="7.85")  # -> out, steel_mass, mass_bot, mass_top, mass_center
# ---------- python_20: Python ----------
"""Retrieves data from a Structural Mesh object"""

__author__ = "Rafael Pastrana"
__name__ = "Steel Mass Calculator"
__date__ = "2018.08.02"
__version__ = "0.0.1"


# 1. Import dependencies
import rhinoscriptsyntax as rs

# 2. Define Globals
DENSITY = steel_density  # kg/cm3
TOL = 1e-6
AS_TAGS = ['asx_b', 'asx_t', 'asy_b', 'asy_t', 'asx_c', 'asy_c']

# 3. Start System
my_mesh = s_mesh
face_areas = list(map(lambda x: my_mesh.c_mesh.face_area(x), my_mesh.c_mesh.faces()))

# 4. Get Mass at Bottom Layer
m_asx_b = list(map(lambda x: DENSITY * my_mesh.c_mesh.get_face_attribute(x,AS_TAGS[0]), my_mesh.c_mesh.faces()))
m_asy_b = list(map(lambda x: DENSITY * my_mesh.c_mesh.get_face_attribute(x,AS_TAGS[2]), my_mesh.c_mesh.faces()))

m_asx_t = list(map(lambda x: DENSITY * my_mesh.c_mesh.get_face_attribute(x,AS_TAGS[1]), my_mesh.c_mesh.faces()))
m_asy_t = list(map(lambda x: DENSITY * my_mesh.c_mesh.get_face_attribute(x,AS_TAGS[3]), my_mesh.c_mesh.faces()))

m_asx_c = list(map(lambda x: DENSITY * my_mesh.c_mesh.get_face_attribute(x,AS_TAGS[4]), my_mesh.c_mesh.faces()))
m_asy_c = list(map(lambda x: DENSITY * my_mesh.c_mesh.get_face_attribute(x,AS_TAGS[5]), my_mesh.c_mesh.faces()))

mass_bot = reduce(lambda x, y: x+y, [sum(x)*face_areas[idx] for idx, x in enumerate(zip(m_asx_b, m_asy_b))])
mass_top = reduce(lambda x, y: x+y, [sum(x)*face_areas[idx] for idx, x in enumerate(zip(m_asx_t, m_asy_t))])
mass_center = reduce(lambda x, y: x+y, [sum(x)*face_areas[idx] for idx, x in enumerate(zip(m_asx_c, m_asy_c))])

steel_mass = mass_bot + mass_top + mass_center
# ---------- end python_20 ----------
python_21 = GhPythonScript(x=data_25)  # -> out, a
# ---------- python_21: Python ----------
__author__ = "ARPJ"
__version__ = "2018.08.01"

import rhinoscriptsyntax as rs

print('number of edges is: {}'.format(len([e for e in x.c_mesh.edges()])))
# ---------- end python_21 ----------
num_100 = Number(python_20.steel_mass)
num_101 = Number(python_20.mass_bot)
num_102 = Number(python_20.mass_top)
num_103 = Number(python_20.mass_center)
num_104 = Number(num_103)

num_105 = Number(num_100)
num_106 = Number(num_101)
num_107 = Number(num_102)
data_26 = Data(data_16)
data_27 = Data(data_19)
num_108 = Number(num_96)
data_28 = Data(data_13)
entwine_15 = Entwine(Branch00=num_106, Branch01=num_107, Branch02=num_104, Branch03=num_105, FlattenInputs=True)
num_109 = Number(num_96)
bnd = Bounds(Numbers=num_108)
sort = SortList(Keys=num_109)  # -> Keys, ValuesA
concat = Concatenate(FragmentA=graft(panel_35), FragmentB="domain is:", FragmentC=bnd, JoinSeparator=" ")
concat_2 = Concatenate(FragmentA=graft(panel_34), FragmentB="mass is:", FragmentC=entwine_15, FragmentD="kg", JoinSeparator=" ")
panel_36 = Panel(data_26)
panel_37 = Panel(data_27)
panel_38 = Panel(data_28)
reinforcement_areas_domain_cm2_m = Panel(concat)
graph = QuickGraph(sort.Keys, SortOrder=0)
reinforcement_areas_domain_cm2_m_2 = Panel(concat_2)

panel_39 = Panel(python_21.out)
num_110 = Number(python_19.data_values)
mesh_18 = Mesh(python_19.display_mesh)
mesh_19 = Mesh(mesh_18)
wbnaked = WeaverbirdsNakedBoundary(MeshClosedPolylines=mesh_19)

entwine_16 = Entwine(Branch00=wbnaked, Branch01=crv, Branch02=crv_2, FlattenInputs=True)
previewlw = CustomPreviewLineweights(Geometry=entwine_16, Shader=entwine_9, Thickness="4", Absolute=False)

col = Colour(python_19.color_data)
line_10 = Line(python_17.centers_line_field)
line_11 = Line(python_17.line_field)
col_2 = Colour(python_17.colors_line_field)
col_3 = Colour(python_17.colors_centers_line_field)
vec_44 = Vector(python_17.vectors_a)
vec_45 = Vector(python_17.vectors_b)
line_12 = Line(python_18.line_field)
line_13 = Line(python_18.centers_line_field)
col_4 = Colour(python_18.colors_line_field)
col_5 = Colour(python_18.colors_centers_line_field)
vec_46 = Vector(python_18.vectors_a)
vec_47 = Vector(python_18.vectors_b)
line_14 = Line(python_17.node_line_field)

line_15 = Line(line_11)
line_16 = Line(line_14)
line_17 = Line(line_10)

line_18 = Line(flatten(line_15))
line_19 = Line(line_18)
end_2 = EndPoints(Curve=graft(line_19))  # -> Start, End
vec2pt = Vector2Pt(PointA=end_2.Start, PointB=end_2.End, Unitize=False)  # -> flatten(Vector), Length
evaluate_curve = EvaluateCurve(Curve=graft(line_19), Parameter=0.5)  # -> Point, Tangent, Angle
vec2pt_2 = Vector2Pt(PointA=end_2.Start, PointB=end_2.End, Unitize="True")  # -> Vector, Length
vlen = VectorLength(Vector=vec2pt.Vector)
multiplication_7 = Multiplication(A=vec2pt_2.Vector, B=number_slider)
reverse = Reverse(Vector=multiplication_7)
bnd_2 = Bounds(Numbers=vlen)
remap = RemapNumbers(Value=vlen, Source=bnd_2, Target=Domain(0, 1))  # -> Mapped, Clipped
move = Move(Geometry=evaluate_curve.Point, Motion=reverse)  # -> Geometry, Transform
move_2 = Move(Geometry=evaluate_curve.Point, Motion=multiplication_7)  # -> Geometry, Transform
move_3 = Move(Geometry=line_18, Motion=Z_2)  # -> Geometry, Transform
graph_2 = GraphMapper(remap.Mapped, x0=0, x1=1, y0=0, y1=1, container_name="Bezier", cpx=[0, 0, 0.3804347813, 1], cpy=[0, 0, 1, 1])
line_20 = Line(StartPoint=move_2.Geometry, EndPoint=move.Geometry)  # -> flatten(Line)
bnd_3 = Bounds(Numbers=graph_2)
gradient_5 = Gradient(
    LowerLimit="1",
    UpperLimit="-1",
    Parameter=graph_2,
    stops=[0: RGB(255, 0, 0), 0.176: RGB(255, 238, 0), 0.35: RGB(0, 255, 234), 0.504: RGB(35, 4, 128), 0.664: RGB(0, 252, 215), 0.843: RGB(255, 255, 0), 1: RGB(255, 0, 47)])
line_21 = Line(line_20)
avr = Average(Input=[end_2.Start, end_2.End])  # -> flatten(ArithmeticMean)
remap_2 = RemapNumbers(Value=graph_2, Source=bnd_3, Target="4 to 0.5")  # -> Mapped, Clipped
scale = Scale(Geometry=line_19, Center=avr, Factor=remap_2.Mapped)  # -> Geometry, Transform
line_22 = Line(scale.Geometry)
col_6 = Colour(gradient_5)
preview = CustomPreview(Geometry=line_22, Material=col_6)
preview_2 = CustomPreview(Geometry=line_19, Material=col_6)
preview_3 = CustomPreview(Geometry=line_21, Material=ColourSwatch(SwatchColor=RGB(0, 76, 255)))
col_7 = Colour(col_6)
line_23 = Line(line_22)
graft_26 = GraftTree(Tree=col_7, IncludeEmptyLists=True, IncludeNullItems=True)
graft_27 = GraftTree(Tree=line_23, IncludeEmptyLists=True, IncludeNullItems=True)
createatts_2 = CreateAttributes(LayerName="colored_vectors", Color=graft_26, enableFullPath=False)
bake = BakeGeometry(Bake=Button(), Geometry=graft_27, Attributes=createatts_2, DeleteOldBakes=False, PreserveTrees=False)
line_24 = Line(python_18.node_line_field)

line_25 = Line(line_12)
line_26 = Line(line_24)
line_27 = Line(line_13)

line_28 = Line(flatten(line_25))
line_29 = Line(line_28)
end_3 = EndPoints(Curve=graft(line_29))  # -> Start, End
vec2pt_3 = Vector2Pt(PointA=end_3.Start, PointB=end_3.End, Unitize=False)  # -> flatten(Vector), Length
vlen_2 = VectorLength(Vector=vec2pt_3.Vector)
evaluate_curve_2 = EvaluateCurve(Curve=graft(line_29), Parameter=0.5)  # -> Point, Tangent, Angle
vec2pt_4 = Vector2Pt(PointA=end_3.Start, PointB=end_3.End, Unitize="True")  # -> Vector, Length
bnd_4 = Bounds(Numbers=vlen_2)
remap_3 = RemapNumbers(Value=vlen_2, Source=bnd_4, Target=Domain(0, 1))  # -> Mapped, Clipped
multiplication_8 = Multiplication(A=vec2pt_4.Vector, B=number_slider)
reverse_2 = Reverse(Vector=multiplication_8)
move_4 = Move(Geometry=line_28, Motion=Z_3)  # -> Geometry, Transform
graph_3 = GraphMapper(
    remap_3.Mapped,
    x0=0,
    x1=1,
    y0=0,
    y1=1,
    container_name="Bezier",
    cpx=[0, 0, 1, 1],
    cpy=[0, 0.3821747303, 0.5108695626, 1])
move_5 = Move(Geometry=evaluate_curve_2.Point, Motion=reverse_2)  # -> Geometry, Transform
move_6 = Move(Geometry=evaluate_curve_2.Point, Motion=multiplication_8)  # -> Geometry, Transform
bnd_5 = Bounds(Numbers=graph_3)
line_30 = Line(StartPoint=move_6.Geometry, EndPoint=move_5.Geometry)  # -> flatten(Line)
gradient_6 = Gradient(
    LowerLimit="1",
    UpperLimit="-1",
    Parameter=graph_3,
    stops=[0: RGB(255, 0, 0), 0.176: RGB(255, 238, 0), 0.35: RGB(0, 255, 234), 0.504: RGB(35, 4, 128), 0.664: RGB(0, 252, 215), 0.843: RGB(255, 255, 0), 1: RGB(255, 0, 47)])
avr_2 = Average(Input=[end_3.Start, end_3.End])  # -> flatten(ArithmeticMean)
remap_4 = RemapNumbers(Value=graph_3, Source=bnd_5, Target="4 to 0.5")  # -> Mapped, Clipped
line_31 = Line(line_30)
scale_2 = Scale(Geometry=line_29, Center=avr_2, Factor=remap_4.Mapped)  # -> Geometry, Transform
line_32 = Line(scale_2.Geometry)
col_8 = Colour(gradient_6)
preview_4 = CustomPreview(Geometry=line_32, Material=col_8)
preview_5 = CustomPreview(Geometry=line_29, Material=col_8)
preview_6 = CustomPreview(Geometry=line_31, Material=ColourSwatch(SwatchColor=RGB(255, 0, 0)))
col_9 = Colour(col_8)
line_33 = Line(line_32)
graft_28 = GraftTree(Tree=col_9, IncludeEmptyLists=True, IncludeNullItems=True)
graft_29 = GraftTree(Tree=line_33, IncludeEmptyLists=True, IncludeNullItems=True)
createatts_3 = CreateAttributes(LayerName="colored_vectors", Color=graft_28, enableFullPath=False)
bake_2 = BakeGeometry(Bake=Button(), Geometry=graft_29, Attributes=createatts_3, DeleteOldBakes=False, PreserveTrees=False)
data_29 = Data(python_17.s_mesh)
col_10 = Colour(python_17.colors_node_line_field)

col_11 = Colour(col_2)
col_12 = Colour(col_10)
col_13 = Colour(col_3)

entwine_17 = Entwine(Branch00=line_15, Branch01=line_16, Branch02=line_17, FlattenInputs=True)
entwine_18 = Entwine(Branch00=col_11, Branch01=col_12, Branch02=col_13, FlattenInputs=True)
move_7 = Move(Geometry=entwine_17, Motion=X_2)  # -> Geometry, Transform
preview_7 = CustomPreview(Geometry=line_18, Material=ColourSwatch(SwatchColor=RGB(255, 255, 255)))

data_30 = Data(python_18.s_mesh)

# ---- group: s_mesh
data_31 = Data(data_30)

# ----
python_22 = GhPythonScript(show=bool_17, s_mesh=data_31, vector_tag=txt_24, tol=num_30)  # -> out, s_mesh, face_neg, face_null, face_pos; inputs show: Boolean
# ---------- python_22: Python ----------
"""Retrieves data from a Structural Mesh object"""

__author__ = "Rafael Pastrana"
__name__ = "Mesh Displayer"
__date__ = "2018.07.24"
__version__ = "0.0.1"


# 1. Import dependencies
import rhinoscriptsyntax as rs

# 2. Start System
my_mesh = s_mesh
v_name = vector_tag

if show is True:
    my_mesh.get_face_labels(v_name, tol)
    face_neg, face_null, face_pos = my_mesh.stream_face_labels()
# ---------- end python_22 ----------
data_32 = Data(python_22.s_mesh)

# ---- group: s_mesh
data_33 = Data(data_32)

# ----
python_23 = GhPythonScript(show=bool_18, s_mesh=data_33)  # -> out, s_mesh, face_planes, edge_planes; inputs show: Boolean
# ---------- python_23: Python ----------
"""Retrieves data from a Structural Mesh object"""

__author__ = "Rafael Pastrana"
__name__ = "Mesh Displayer"
__date__ = "2018.07.24"
__version__ = "0.0.1"


# 1. Import dependencies
import rhinoscriptsyntax as rs

# 2. Start System
my_mesh = s_mesh

if show is True:
    # plane properties
    face_planes = list(map(lambda x: my_mesh.cMesh.get_face_attribute(x,'plane'), my_mesh.cMesh.faces()))
    face_planes = [rs.PlaneFromNormal(x[0], x[1]) for x in face_planes]
    
    edge_planes = list(map(lambda x: my_mesh.cMesh.get_edge_attribute(x,'plane'), my_mesh.cMesh.edges()))
    edge_planes = [rs.PlaneFromNormal(x[0], x[1]) for x in edge_planes if x is not None]

s_mesh = s_mesh
# ---------- end python_23 ----------
pt_34 = Point(python_22.face_neg)
pt_35 = Point(python_22.face_null)
pt_36 = Point(python_22.face_pos)

pt_37 = Point(pt_34)
pt_38 = Point(pt_35)
pt_39 = Point(pt_36)  # disabled

entwine_19 = Entwine(Branch00=pt_37, Branch01=pt_38, Branch02=pt_39, FlattenInputs=True)
move_8 = Move(Geometry=entwine_19, Motion=X_4)  # -> Geometry, Transform

circle_cnr = CircleCNR(Center=move_8.Geometry, Normal=Vector(0, 0, 1), Radius="0.05")
custom_preview_2 = CustomPreview(Geometry=circle_cnr, Material=entwine_11)
data_34 = Data(python_23.s_mesh)
pln_3 = Plane(python_23.edge_planes)
pln_4 = Plane(python_23.face_planes)
col_14 = Colour(python_18.colors_node_line_field)

col_15 = Colour(col_4)
col_16 = Colour(col_14)
col_17 = Colour(col_5)

entwine_20 = Entwine(Branch00=line_25, Branch01=line_26, Branch02=line_27, FlattenInputs=True)
entwine_21 = Entwine(Branch00=col_15, Branch01=col_16, Branch02=col_17, FlattenInputs=True)
move_9 = Move(Geometry=entwine_20, Motion=X_3)  # -> Geometry, Transform
preview_8 = CustomPreview(Geometry=line_28, Material=ColourSwatch(SwatchColor=RGB(255, 255, 255)))

data_35 = Data(data_17)
data_36 = Data(data_17)
python_24 = GhPythonScript(
    run=bool_25,
    s_mesh=flatten(data_35),
    weights=num_57,
    dL=num_55,
    min_length=num_58,
    vector_tag=txt_27,
    as_tag=txt_26,
    min_sp=num_59,
    uni_sp=bool_26,
    num_samples=int_17,
    strat_factor=num_60,
    others_prox=num_61,
    start_prox=num_56,
    self_prox=num_62,
    iterations=num_63)  # -> out, str_system; inputs weights: list, uni_sp: Boolean, num_samples: Int32, iterations: Int32
# ---------- python_24: Python ----------
fac__author__ = "Rafael Pastrana"
__name__ = "Streamliner"
__date__ = "2018.08.05"
__version__ = "0.0.4"


# 0. Import dependencies
import sys
import imp
import rhinoscriptsyntax as rs
import clr
clr.AddReference("Grasshopper")
import Grasshopper.Kernel.Data.GH_Path as ghpath
import Grasshopper.DataTree as datatree
import System
import ghpythonlib.parallel as gh_parallel
 
# 0-b. Replace with your own path here
sys.path.append("Z:\projects\streamlines\src\streamlines")
import streamsystem
imp.reload(streamsystem)
from streamsystem import Streamsystem


# 1. Define Globals 
TAG = 'spacing_'
TOL = 1e-6
AS_TAGS = [TAG+'asx_', TAG+'asy_']
MIN_SP = min_sp  # minimum backup separation for objects
UNI_SP = uni_sp  # Ignore Separation Map from RC Design?

W_1 = [weights[0], weights[1], weights[2]]
W_2= [weights[3], weights[4], weights[5]]
vec_tag_dict = {'n_1':'n_2', 'n_2':'n_1', 'm_1':'m_2', 'm_2':'m_1', 'ps_1_top':'ps_2_top', 'ps_1_bot':'ps_2_bot', 'ps_1_mid':'ps_2_mid', 'ps_2_top':'ps_1_top', 'ps_2_bot':'ps_1_bot', 'ps_2_mid':'ps_1_mid', 'custom_1':'custom_2', 'custom_2':'custom_1'}

# 2. Establish Tag Convention
if as_tag == 'asx_':
    as_dir = AS_TAGS[0]
    w = W_1
    vector_tag = vector_tag

elif as_tag == 'asy_':
    as_dir = AS_TAGS[1]
    w = W_2
    vector_tag = vec_tag_dict[vector_tag]

# 3. Create Data Trees for collecting output
streamlines = datatree[System.Object]()
streamlines_objects = datatree[System.Object]()
short_streamlines = datatree[System.Object]()
offsets = datatree[System.Object]()

# 4. Run Streamlines on Direction 1
if run :
    str_system = Streamsystem(s_mesh, as_dir, dL, MIN_SP, UNI_SP)
    str_system.set_tracing_data(vector_tag, w, min_length)
    str_system.make_streamlines_jobard(strat_factor, others_prox, start_prox, self_prox, num_samples, iterations)
# ---------- end python_24 ----------
python_25 = GhPythonScript(
    run=bool_27,
    s_mesh=flatten(data_36),
    weights=num_65,
    dL=num_68,
    min_length=num_64,
    vector_tag=txt_28,
    as_tag=txt_29,
    min_sp=num_69,
    uni_sp=bool_28,
    num_samples=int_18,
    strat_factor=num_70,
    others_prox=num_66,
    start_prox=num_67,
    self_prox=num_71,
    iterations=num_72)  # -> out, str_system; inputs weights: list, uni_sp: Boolean, num_samples: Int32, iterations: Int32
# ---------- python_25: Python ----------
__author__ = "Rafael Pastrana"
__name__ = "Streamliner"
__date__ = "2018.08.05"
__version__ = "0.0.4"


# 0. Import dependencies
import sys
import imp
import rhinoscriptsyntax as rs
import clr
clr.AddReference("Grasshopper")
import Grasshopper.Kernel.Data.GH_Path as ghpath
import Grasshopper.DataTree as datatree
import System
import ghpythonlib.parallel as gh_parallel
 
# 0-b. Replace with your own path here
sys.path.append("Z:\projects\streamlines\src\streamlines")
import streamsystem
imp.reload(streamsystem)
from streamsystem import Streamsystem


# 1. Define Globals 
TAG = 'spacing_'
TOL = 1e-6
AS_TAGS = [TAG+'asx_', TAG+'asy_']
MIN_SP = min_sp  # minimum backup separation for objects
UNI_SP = uni_sp  # Ignore Separation Map from RC Design?

W_1 = [weights[0], weights[1], weights[2]]
W_2= [weights[3], weights[4], weights[5]]
vec_tag_dict = {'n_1':'n_2', 'n_2':'n_1', 'm_1':'m_2', 'm_2':'m_1', 'ps_1_top':'ps_2_top', 'ps_1_bot':'ps_2_bot', 'ps_1_mid':'ps_2_mid', 'ps_2_top':'ps_1_top', 'ps_2_bot':'ps_1_bot', 'ps_2_mid':'ps_1_mid', 'custom_1':'custom_2', 'custom_2':'custom_1'}

# 2. Establish Tag Convention
if as_tag == 'asx_':
    as_dir = AS_TAGS[0]
    w = W_1
    vector_tag = vector_tag

elif as_tag == 'asy_':
    as_dir = AS_TAGS[1]
    w = W_2
    vector_tag = vec_tag_dict[vector_tag]

# 3. Create Data Trees for collecting output
streamlines = datatree[System.Object]()
streamlines_objects = datatree[System.Object]()
short_streamlines = datatree[System.Object]()
offsets = datatree[System.Object]()

# 4. Run Streamlines on Direction 1
if run :
    str_system = Streamsystem(s_mesh, as_dir, dL, MIN_SP, UNI_SP)
    str_system.set_tracing_data(vector_tag, w, min_length)
    str_system.make_streamlines_jobard(strat_factor, others_prox, start_prox, self_prox, num_samples, iterations)

# 5. Collect Streamlines
#    for idx, streamline in enumerate(str_system.streamlines):
#        rh_pts = []
#        for point in streamline.polyline.points:
#            rh_pts.append(rs.AddPoint(*point))
#        streamlines.AddRange(rh_pts, ghpath(idx))
#        streamlines_objects.Add(streamline, ghpath(idx))
#        
#    for idx, streamline in enumerate(str_system.short_streamlines):
#        rh_pts = []
#        for point in streamline.polyline.points:
#            rh_pts.append(rs.AddPoint(*point))
#        short_streamlines.AddRange(rh_pts, ghpath(idx))
#   
#    for idx, streamline in enumerate(str_system.offsets):
#        rh_pts = []
#        for point in streamline.polyline.points:
#            rh_pts.append(rs.AddPoint(*point))
#        offsets.AddRange(rh_pts, ghpath(idx))
#        
#    seed_pts = str_system.seed_pts
#    first_pt = str_system.first_pt


# if run_2:
#     print('dir 2')
#     myStreamSystem = StreamSystem(s_mesh, seeds_2, as_dir_2, dL, MIN_SP, UNI_SP)
#     myStreamSystem.set_data_mebarki(vector_tag_2, W_2, min_length)
# 
#     all_seeds = seeds_2
#     if PARALLEL is True:
#         rh_pts = gh_parallel.run(myStreamSystem.make_streamline_mebarki_parallel, [all_seeds], True)
#     else:
#         rh_pts = myStreamSystem.make_streamline_mebarki_parallel([all_seeds])
# 
#     for idx, pts in enumerate(rh_pts):
#         if pts:
#            streamlines_2.AddRange(pts, ghpath(idx))
# ---------- end python_25 ----------
data_37 = Data(python_24.str_system)
data_38 = Data(python_25.str_system)
panel_40 = Panel(python_24.out)
data_39 = Data(data_37)
data_40 = Data(data_38)
panel_41 = Panel(python_25.out)
python_26 = GhPythonScript(streamsystem=data_39)  # -> out, offsets, first_pt, seed_pts, streamlines, streamlines_objects, short_streamlines
# ---------- python_26: Python ----------
__author__ = "Rafael Pastrana"
__name__ = "Streamliner"
__date__ = "2018.08.05"
__version__ = "0.0.4"


# 0. Import dependencies
import sys
import imp
import rhinoscriptsyntax as rs
import clr
clr.AddReference("Grasshopper")
import Grasshopper.Kernel.Data.GH_Path as ghpath
import Grasshopper.DataTree as datatree
import System
import ghpythonlib.parallel as gh_parallel
 
# 0-b. Replace with your own path here
# sys.path.append("Z:\Dropbox\Documentos\ETH Zuerich\ETH MAS Thesis\code\current")
#import streamsystem
#imp.reload(streamsystem)
#from streamsystem import Streamsystem


# 1. Define Globals 
streamlines = datatree[System.Object]()
streamlines_objects = datatree[System.Object]()
short_streamlines = datatree[System.Object]()
offsets = datatree[System.Object]()


# 5. Collect Streamlines
if streamsystem is not None:
    str_system = streamsystem
    
    for idx, streamline in enumerate(str_system.streamlines):
        rh_pts = []
        for point in streamline.polyline.points:
            rh_pts.append(rs.AddPoint(*point))
        streamlines.AddRange(rh_pts, ghpath(idx))
        streamlines_objects.Add(streamline, ghpath(idx))
        
    for idx, streamline in enumerate(str_system.short_streamlines):
        rh_pts = []
        for point in streamline.polyline.points:
            rh_pts.append(rs.AddPoint(*point))
        short_streamlines.AddRange(rh_pts, ghpath(idx))
    
    for idx, streamline in enumerate(str_system.offsets):
        rh_pts = []
        for point in streamline.polyline.points:
            rh_pts.append(rs.AddPoint(*point))
        offsets.AddRange(rh_pts, ghpath(idx))
        
    seed_pts = str_system.seed_pts
    first_pt = str_system.first_pt
# ---------- end python_26 ----------
python_27 = GhPythonScript(streamsystem=data_40)  # -> out, offsets, first_pt, seed_pts, streamlines, streamlines_objects, short_streamlines
# ---------- python_27: Python ----------
__author__ = "Rafael Pastrana"
__name__ = "Streamliner"
__date__ = "2018.08.05"
__version__ = "0.0.4"


# 0. Import dependencies
import sys
import imp
import rhinoscriptsyntax as rs
import clr
clr.AddReference("Grasshopper")
import Grasshopper.Kernel.Data.GH_Path as ghpath
import Grasshopper.DataTree as datatree
import System
import ghpythonlib.parallel as gh_parallel
 
# 0-b. Replace with your own path here
sys.path.append("Z:\Dropbox\Documentos\ETH Zuerich\ETH MAS Thesis\code\current")
#import streamsystem
#imp.reload(streamsystem)
#from streamsystem import Streamsystem


# 1. Define Globals 
streamlines = datatree[System.Object]()
streamlines_objects = datatree[System.Object]()
short_streamlines = datatree[System.Object]()
offsets = datatree[System.Object]()


# 5. Collect Streamlines
if streamsystem is not None:
    str_system = streamsystem
    
    for idx, streamline in enumerate(str_system.streamlines):
        rh_pts = []
        for point in streamline.polyline.points:
            rh_pts.append(rs.AddPoint(*point))
        streamlines.AddRange(rh_pts, ghpath(idx))
        streamlines_objects.Add(streamline, ghpath(idx))
        
    for idx, streamline in enumerate(str_system.short_streamlines):
        rh_pts = []
        for point in streamline.polyline.points:
            rh_pts.append(rs.AddPoint(*point))
        short_streamlines.AddRange(rh_pts, ghpath(idx))
    
    for idx, streamline in enumerate(str_system.offsets):
        rh_pts = []
        for point in streamline.polyline.points:
            rh_pts.append(rs.AddPoint(*point))
        offsets.AddRange(rh_pts, ghpath(idx))
        
    seed_pts = str_system.seed_pts
    first_pt = str_system.first_pt
# ---------- end python_27 ----------
pt_40 = Point(python_26.first_pt)
pt_41 = Point(python_26.seed_pts)
pt_42 = Point(python_26.short_streamlines)
pt_43 = Point(python_26.offsets)
pt_44 = Point(python_26.streamlines)
data_41 = Data(python_26.streamlines_objects)
pt_45 = Point(python_27.streamlines)
pt_46 = Point(python_27.first_pt)
pt_47 = Point(python_27.short_streamlines)
pt_48 = Point(python_27.seed_pts)
data_42 = Data(python_27.streamlines_objects)
pt_49 = Point(python_27.offsets)

pt_50 = Point(pt_43)
pt_51 = Point(pt_42)
pt_52 = Point(pt_44)
pline_4 = PolyLine(Vertices=pt_52, Closed=False)
pline_5 = PolyLine(Vertices=pt_50, Closed=False)
pline_6 = PolyLine(Vertices=pt_51, Closed=False)
crv_21 = Curve(pline_4)
crv_22 = Curve(pline_5)
crv_23 = Curve(pline_6)

pt_53 = Point(pt_47)
pt_54 = Point(pt_49)
pt_55 = Point(pt_45)
pline_7 = PolyLine(Vertices=pt_55, Closed=False)
pline_8 = PolyLine(Vertices=pt_54, Closed=False)
pline_9 = PolyLine(Vertices=pt_53, Closed=False)
crv_24 = Curve(pline_8)
crv_25 = Curve(pline_7)
crv_26 = Curve(pline_9)

crv_27 = Curve(crv_21)
crv_28 = Curve(crv_21)
crv_29 = Curve(crv_25)
crv_30 = Curve(crv_25)
tstat_2 = TreeStatistics(Tree=crv_27)  # -> Paths, Length, Count
flatten_7 = FlattenTree(Tree=crv_28, Path="{0}")
tstat_3 = TreeStatistics(Tree=crv_30)  # -> Paths, Length, Count
flatten_8 = FlattenTree(Tree=crv_29, Path="{0}")
crv_31 = Curve(crv_25)
series_3 = Series(Start=0, Step=1, Count=tstat_2.Count)
eval_3 = EvaluateCurve(Curve=reparameterize(flatten_7), Parameter="0.5")  # -> Point, Tangent, Angle
series_4 = Series(Start=0, Step=1, Count=tstat_3.Count)
eval_4 = EvaluateCurve(Curve=reparameterize(flatten_8), Parameter="0.5")  # -> Point, Tangent, Angle
gradient_7 = Gradient(
    LowerLimit=0,
    UpperLimit=expr("x-1", tstat_2.Count),
    Parameter=series_3,
    stops=[0: RGB(255, 255, 255), 0.498: RGB(89, 147, 247), 1: RGB(20, 2, 107)])
gradient_8 = Gradient(
    LowerLimit=0,
    UpperLimit=expr("x-1", tstat_3.Count),
    Parameter=series_4,
    stops=[0: RGB(255, 255, 255), 0.498: RGB(89, 147, 247), 1: RGB(20, 2, 107)])
intersection = SetIntersection(SetA=eval_3.Point, SetB=eval.Point)
intersection_2 = SetIntersection(SetA=eval_4.Point, SetB=eval_2.Point)
item_11 = ListItem(List=flatten(crv_31), Index=Slider(19, range=0..100), Wrap=True)
mindex_2 = MemberIndex(Set=eval.Point, Member=intersection)  # -> flatten(Index), Count
mindex_3 = MemberIndex(Set=eval_2.Point, Member=intersection_2)  # -> flatten(Index), Count
cull_i_2 = CullIndex(List=flatten, Indices=mindex_2.Index, Wrap=True)
cull_i_3 = CullIndex(List=flatten_2, Indices=mindex_3.Index, Wrap=True)
graft_30 = GraftTree(Tree=gradient_7, IncludeEmptyLists=True, IncludeNullItems=True)
graft_31 = GraftTree(Tree=gradient_8, IncludeEmptyLists=True, IncludeNullItems=True)
smoothpline = SmoothPolyline(Polyline=crv_27, Strength=1, Times="50")
previewlw_2 = CustomPreviewLineweights(Geometry=cull_i_2, Shader=ColourSwatch(SwatchColor=RGB(107, 107, 107)), Thickness="3", Absolute=False)
previewlw_3 = CustomPreviewLineweights(Geometry=crv_27, Shader=graft_30, Thickness="3", Absolute=False)
previewlw_4 = CustomPreviewLineweights(Geometry=crv_30, Shader=graft_31, Thickness="3", Absolute=False)
previewlw_5 = CustomPreviewLineweights(Geometry=cull_i_3, Shader=ColourSwatch(SwatchColor=RGB(107, 107, 107)), Thickness="3", Absolute=False)

# ---- group: The Bridge
pt_56 = Point()  # disabled
pt_57 = Point()  # disabled
mesh_20 = Mesh()  # disabled
data_43 = Data(data_17)  # disabled

# ----
crv_32 = Curve(crv_21)
crv_33 = Curve(pline_7)
crv_34 = Curve(cull_i_3)
crv_35 = Curve(cull_i_2)
pt_58 = ConstructPoint(XCoordinate="0.02", YCoordinate=0, ZCoordinate=0)
pt_59 = ConstructPoint(XCoordinate="0", YCoordinate=0, ZCoordinate=0)
entwine_22 = Entwine(Branch00=crv_32, Branch01=crv_33, FlattenInputs=True)
yz_2 = YZPlane(Origin=pt_58)
entwine_23 = Entwine(Branch00=crv_35, Branch01=crv_34, FlattenInputs=True)
yz_3 = YZPlane(Origin=pt_59)
mirror_2 = Mirror(Geometry=entwine_22, Plane=yz_2)  # -> Geometry, Transform
mirror_3 = Mirror(Geometry=entwine_23, Plane=yz_3)  # -> Geometry, Transform
merge_15 = Merge(Data1=entwine_22, Data2=mirror_2.Geometry)
merge_16 = Merge(Data1=entwine_23, Data2=mirror_3.Geometry)
rad = Radians(Degrees="90")
rad_2 = Radians(Degrees="180")
rotate = Rotate(Geometry=merge_15, Angle=rad_2, Plane=PlaneXY(0, 0, 0))  # -> Geometry, Transform
rotate_2 = Rotate(Geometry=merge_16, Angle=rad, Plane=PlaneXY(0, 0, 0))  # -> Geometry, Transform
previewlw_6 = CustomPreviewLineweights(Geometry=rotate.Geometry, Shader=ColourSwatch(SwatchColor=RGB(255, 255, 255)), Thickness="3", Absolute=False)
previewlw_7 = CustomPreviewLineweights(Geometry=merge_16, Shader=ColourSwatch(SwatchColor=RGB(255, 255, 255)), Thickness="3", Absolute=False)

mesh_21 = Mesh(mesh_18)

demesh = DeconstructMesh(Mesh=mesh_21)  # -> Vertices, Faces, Colours, Normals

num_111 = Number(num_110)
bnd_6 = Bounds(Numbers=num_111)
python_28 = GhPythonScript(x=num_111)  # -> out, a; inputs x: list
# ---------- python_28: Python ----------
__author__ = "ARPJ"
__version__ = "2018.08.01"

import rhinoscriptsyntax as rs

def normalise_data(data, cmin=None, cmax=None):
    fmax = cmax if cmax is not None else max([abs(x) for x in data])
    fmin = cmin if cmin is not None else min([abs(x) for x in data])
    fabs = max([abs(fmin), abs(fmax)])

    fscaled = []
    for value in data:
        new_val = value / fabs
        if new_val > 1:
            new_val = 1
        elif new_val < -1:
            new_val = -1
        fscaled.append(new_val)
    return fscaled

a = normalise_data(x)
# ---------- end python_28 ----------
dedomain = DeconstructDomain(Domain=bnd_6)  # -> Start, End
range_5 = Range(Domain=bnd_6, Steps="15")
neg = Negative(Value=dedomain.End)
gradient_9 = Gradient(
    LowerLimit=neg,
    UpperLimit=dedomain.End,
    Parameter=range_5,
    stops=[0: RGB(255, 0, 0), 0.176: RGB(255, 238, 0), 0.35: RGB(0, 255, 234), 0.504: RGB(35, 4, 128), 0.664: RGB(0, 252, 215), 0.843: RGB(255, 255, 0), 1: RGB(255, 0, 47)])
gradient_10 = Gradient(
    LowerLimit="-1",
    UpperLimit="1",
    Parameter=python_28.a,
    stops=[0: RGB(255, 0, 0), 0.176: RGB(255, 238, 0), 0.35: RGB(0, 255, 234), 0.504: RGB(35, 4, 128), 0.664: RGB(0, 252, 215), 0.843: RGB(255, 255, 0), 1: RGB(255, 0, 47)])
num_112 = Number(range_5)
col_18 = Colour(gradient_9)

num_113 = Number(num_112)
col_19 = Colour(col_18)
legend_5 = Legend(Colour=col_19, Tags=num_113, LegendType=1)

gradient_11 = Gradient(
    LowerLimit="-1",
    UpperLimit="1",
    Parameter=python_28.a,
    stops=[0: RGB(255, 0, 0), 0.254: RGB(255, 238, 0), 0.423: RGB(0, 255, 234), 0.504: RGB(35, 4, 128), 0.56: RGB(0, 252, 215), 0.719: RGB(255, 255, 0), 1: RGB(255, 0, 47)])
num_114 = Number(python_28.a)

col_20 = Colour(gradient_11)

col_21 = Colour(col_20)

conmesh = ConstructMesh(Vertices=demesh.Vertices, Faces=demesh.Faces, Colours=col_21)
move_10 = Move(Geometry=conmesh, Motion=X)  # -> Geometry, Transform
wbedges_3 = WeaverbirdsMeshEdges(MeshOrPolylines=move_10.Geometry)
mblur = BlurMesh(Mesh=conmesh, Iterations=1)
previewlw_8 = CustomPreviewLineweights(Geometry=wbedges_3, Shader=ColourSwatch(SwatchColor=RGB(3, 3, 3)), Absolute=False)
mesh_22 = Mesh(mblur)

pt_60 = Point(pt_27)
X_5 = UnitX(Factor="0")
move_11 = Move(Geometry=pt_60, Motion=X_5)  # -> Geometry, Transform
pline_10 = PolyLine(Vertices=move_11.Geometry, Closed="True")
from_polylines = FromPolylines(Polylines=flatten(pline_10), Weld=-1, Min_Triangulation=False)
ngon_2 = NGon(Mesh=flatten(from_polylines), LineWeight=1)
ngonfaces = NGonFaces(Mesh=ngon_2)  # -> F, I
crv_36 = Curve(pline_10)
crv_37 = Curve(pline_10)
explode_5 = Explode(Curve=crv_36, Recursive=True)  # -> Segments, Vertices
explode_6 = Explode(Curve=crv_37, Recursive=True)  # -> Segments, Vertices
plfit = PlaneFit(Points=explode_6.Vertices)  # -> Plane, Deviation
project = Project(Geometry=crv_37, Plane=plfit.Plane)  # -> Geometry, Transform
crv_38 = Curve(pline_10)
crv_39 = Curve(crv_38)
pt_61 = Point(pt_28)
panel_42 = Panel("0")
X_6 = UnitX(Factor=panel_42)
swatch_3 = ColourSwatch(SwatchColor=RGB(0, 0, 0))
move_12 = Move(Geometry=pt_61, Motion=X_6)  # -> Geometry, Transform
dots_2 = DotDisplay(Point=move_12.Geometry, Colour=swatch_3, Size="0.01")  # disabled

crv_40 = Curve(ngonfaces.F)
rdlines_2 = RemoveDuplicateLinesKaramba(Line=explode_5.Segments, LimitDistance=0.005)  # -> OutLine, Info, Indexes
rdpoints_2 = RemoveDuplicatePointsKaramba(Point=explode_5.Vertices, LimitDistance=0.005)  # -> OutPoint, Info, Indexes
del = DelaunayMesh(Points=rdpoints_2.OutPoint, Plane=PlaneXY(0, 0, 0))
wbnaked_2 = WeaverbirdsNakedBoundary(MeshClosedPolylines=del)
mesh_23 = Mesh(del)
crv_41 = Curve(crv_38)
explode_7 = Explode(Curve=crv_41, Recursive=True)  # -> Segments, Vertices
flatten_9 = FlattenTree(Tree=explode_7.Segments, Path="{0}")
wbedges_4 = WeaverbirdsMeshEdges(MeshOrPolylines=crv_39)
flatten_10 = FlattenTree(Tree=explode_7.Vertices, Path="{0}")
rdpoints_3 = RemoveDuplicatePointsKaramba(Point=flatten_10, LimitDistance=0.005)  # -> OutPoint, Info, Indexes
rdlines_3 = RemoveDuplicateLinesKaramba(Line=flatten_9, LimitDistance=0.005)  # -> OutLine, Info, Indexes
cir_2 = Circle(Plane=rdpoints_3.OutPoint, Radius="0.035")
crv_42 = Curve(cir_2)
line_34 = Line(rdlines_3.OutLine)
crv_43 = Curve(wbedges_4)
crv_44 = Curve(crv_43)
rdlines_4 = RemoveDuplicateLinesKaramba(Line=flatten(crv_44), LimitDistance=0.005)  # -> OutLine, Info, Indexes
line_35 = Line(rdlines_4.OutLine)
crv_45 = Curve([line_35, crv_20])
previewlw_9 = CustomPreviewLineweights(Geometry=crv_45, Shader=ColourSwatch(SwatchColor=RGB(0, 0, 0)), Thickness="2", Absolute=False)

wbweave = WeaverbirdsMeshFromLinesWeaveBack(Lines=rdlines_2.OutLine, MaximumValence=4)
trim_2 = TrimTree(Tree=wbweave, Depth=1)
area = Area(Geometry=trim_2)  # -> Area, Centroid
project_2 = Project(Geometry=area.Centroid, Plane=plfit.Plane)  # -> Geometry, Transform
incurve = PointInCurve(Point=project_2.Geometry, Curve=project.Geometry)  # -> Relationship, Point
larger_2 = LargerThan(FirstNumber=incurve.Relationship, SecondNumber="1")  # -> LargerThan, OrEqualTo
cull_3 = CullPattern(List=trim_2, CullPattern=larger_2.OrEqualTo)
wbjoin = WeaverbirdsJoinMeshesAndWeld(Mesh=cull_3, Weld=False)
mesh_24 = Mesh(wbjoin)
mesh_25 = Mesh(mesh_23)
geo = Geometry(flatten(mesh_24))
lng_5 = ListLength(List=flatten(geo))
subtraction = Subtraction(A=lng_5, B=1)
range_6 = Range(Domain=Domain(0, 1), Steps=subtraction)
gradient_12 = Gradient(
    LowerLimit=0,
    UpperLimit=1,
    Parameter=range_6,
    stops=[0: RGB(243, 57, 0), 0.1: RGB(236, 27, 60), 0.2: RGB(210, 0, 118), 0.3: RGB(103, 0, 120), 0.4: RGB(39, 72, 161), 0.5: RGB(1, 192, 229), 0.6: RGB(18, 178, 90), 0.7: RGB(79, 186, 8), 0.8: RGB(220, 237, 32), 0.9: RGB(247, 159, 20), 1: RGB(243, 57, 0)])
previewlw_10 = CustomPreviewLineweights(Geometry=wbedges_4, Shader=swatch_3, Thickness="2", Absolute=False)

area_2 = Area(Geometry=flatten(mesh_25))  # -> Area, Centroid
pdecon = Deconstruct(Point=area_2.Centroid)  # -> XComponent, YComponent, ZComponent
bnd_7 = Bounds(Numbers=area_2.Area)
bnd_8 = Bounds(Numbers=pdecon.YComponent)
dedomain_2 = DeconstructDomain(Domain=bnd_7)  # -> Start, End
wbjoin_2 = WeaverbirdsJoinMeshesAndWeld(Mesh=flatten(mesh_25), Weld=False)
dedomain_3 = DeconstructDomain(Domain=bnd_8)  # -> Start, End
gradient_13 = Gradient(
    LowerLimit=dedomain_2.Start,
    UpperLimit=dedomain_2.End,
    Parameter=area_2.Area,
    stops=[0: RGB(234, 38, 0), 0.25: RGB(234, 126, 0), 0.5: RGB(254, 244, 84), 0.75: RGB(173, 203, 249), 1: RGB(75, 107, 169)])
gradient_14 = Gradient(
    LowerLimit=dedomain_3.End,
    UpperLimit=dedomain_3.Start,
    Parameter=pdecon.YComponent,
    stops=[0: RGB(243, 57, 0), 0.1: RGB(236, 27, 60), 0.2: RGB(210, 0, 118), 0.3: RGB(103, 0, 120), 0.4: RGB(39, 72, 161), 0.5: RGB(1, 192, 229), 0.6: RGB(18, 178, 90), 0.7: RGB(79, 186, 8), 0.8: RGB(220, 237, 32), 0.9: RGB(247, 159, 20), 1: RGB(243, 57, 0)])
wblaplace = WeaverbirdsLaplacianSmoothing(MeshCurves=wbjoin_2, Level=Slider(0, range=0..10), SmoothNakedEdges=0, Thin=1)
wbfacepolys = WeaverbirdsFacePolylines(Mesh=wblaplace)

material = CreateMaterial(
    Diffuse=gradient_13,
    Specular=RGB(255, 255, 255),
    Emission=RGB(0, 0, 0),
    Transparency=Slider(0, range=0..1),
    Shine=Slider(27, range=0..100))
preview_9 = CustomPreview(Geometry=flatten(mesh_25), Material=material)

# ==== cluster Cluster
mesh = ClusterInput()
vec = ClusterInput()
mesh_2 = Mesh(mesh)
vec_2 = Vector(vec)
facen = FaceNormals(Mesh=mesh_2)  # -> Centers, Normals
pl = PlaneNormal(Origin=facen.Centers, ZAxis=facen.Normals)
move = Move(Geometry=facen.Centers, Motion=vec_2)  # -> Geometry, Transform
project = Project(Geometry=move.Geometry, Plane=pl)  # -> Geometry, Transform
vec2pt = Vector2Pt(PointA=facen.Centers, PointB=project.Geometry, Unitize="True")  # -> Vector, Length
xprod = CrossProduct(VectorA=facen.Normals, VectorB=vec2pt.Vector, Unitize="True")  # -> Vector, Length
vec_3 = Vector(xprod.Vector)
vec_4 = Vector(vec2pt.Vector)
vec_5 = ClusterOutput(vec_3)
vec_6 = ClusterOutput(vec_4)
