# Grasshopper definition vault_generator_mesh.ghx (Grasshopper 1.0.7)
# plug-ins: Weaverbird, Kangaroo2 Components

panel = Panel("Z:\code\libraries\variational_clustering\data\json_files\four_point_slab.json")
shell_thickness_m = Slider(0.15, range=0..1)
concrete_covers_cm = Panel("""2.5
2.5
-2.5
-2.5""")
txt = Text(panel)
num = Number(shell_thickness_m)
num_2 = Number(concrete_covers_cm)

create_cmesh_for_json_export = BooleanToggle(False)
bool = Boolean(create_cmesh_for_json_export)

export_json_file = BooleanToggle(False)
bool_2 = Boolean(export_json_file)

shell_dimension_x_m = Slider(4.5, range=0..10)
shell_dimension_y_m = Slider(6, range=0..10)
num_of_faces_in_x_direction = Slider(45, range=0..100)
num_of_faces_in_y_direction = Slider(60, range=0..120)
num_3 = Number(num_of_faces_in_y_direction)
num_4 = Number(shell_dimension_x_m)
num_5 = Number(shell_dimension_y_m)
num_6 = Number(num_of_faces_in_x_direction)

# ---- group: Loading - Controls
area_load_kn_m2 = Slider(10, range=0..100)
num_7 = Number(area_load_kn_m2)

# ----
num_8 = Number(num_5)
num_9 = Number(num_4)
num_10 = Number(num_3)
num_11 = Number(num_6)
rectangle = Rectangle(Plane=PlaneXY(0, 0, 0), XSize=Domain(-1, 1), YSize=Domain(-2, 2), Radius=0)  # -> Rectangle, Length
division = Division(A=num_9, B="2")
division_2 = Division(A=num_8, B="2")
explode = Explode(Curve=rectangle.Rectangle, Recursive=True)  # -> Segments, Vertices
neg = Negative(Value=division)
neg_2 = Negative(Value=division_2)
item = ListItem(List=explode.Segments, Index=0, Wrap=True)  # -> Item, Item1
dom = ConstructDomain(DomainStart=neg_2, DomainEnd=division_2)
dom_2 = ConstructDomain(DomainStart=neg, DomainEnd=division)
divide = DivideCurve(Curve=item.Item1, Count="2", Kinks=False)  # -> Points, Tangents, Parameters
rectangle_2 = Rectangle(Plane=PlaneXY(0, 0, 0), XSize=dom_2, YSize=dom, Radius=0)  # -> Rectangle, Length
item_2 = ListItem(List=explode.Vertices, Index=0, Wrap=True)  # -> Item, Item1, Item2, Item3
item_3 = ListItem(List=divide.Points, Index=0, Wrap=True)  # -> Item, Item1
mplane = MeshPlane(Boundary=rectangle_2.Rectangle, WidthCount=num_11, HeightCount=num_10)  # -> Mesh, Area
merge = Merge(Data1=flatten(item_2.Item), Data2=flatten(item_3.Item1), Data3=flatten(item_2.Item3))
pline = PolyLine(Vertices=merge, Closed=False)
clean = CombineClean(Meshes=mplane.Mesh)
tri = Triangulate(Mesh=mplane.Mesh)  # -> Mesh, Count
crv = Curve(pline)
crv_2 = Curve(rectangle_2.Rectangle)
crv_3 = Curve(crv_2)
explode_2 = Explode(Curve=crv_3, Recursive=True)  # -> Segments, Vertices
graft = GraftTree(Tree=explode_2.Segments, IncludeEmptyLists=True, IncludeNullItems=True)
mesh = Mesh(mplane.Mesh)
mesh_2 = Mesh(mesh)
demesh = DeconstructMesh(Mesh=mesh_2)  # -> Vertices, Faces, Colours, Normals
python = GhPythonScript(x=demesh.Vertices, y="0.06", z="1.5")  # -> out, a; inputs x: list of Point3d
# ---------- python: Python ----------
a = []


max_y = max([pt.Y for pt in x])

for point in x:
    
    print(point.X, point.Y)
    if point.X > y or point.X < -y:
        continue
    
    if point.Y > (max_y - z) or point.Y < (-max_y + z):
       continue
    
    a.append(point)
# ---------- end python ----------
crv_cp = CurveClosestPoint(Point=demesh.Vertices, Curve=graft)  # -> Point, Parameter, Distance
smaller = SmallerThan(FirstNumber=crv_cp.Distance, SecondNumber="0.001")  # -> SmallerThan, OrEqualTo
cull = CullPattern(List=crv_cp.Point, CullPattern=smaller.SmallerThan)  # -> simplify(List)
split = SplitTree(Data=cull, Masks=flatten("{0,2}"))  # -> Positive, Negative
lng = ListLength(List=split.Negative)
lng_2 = ListLength(List=split.Positive)
crv_4 = Curve(crv)
mesh_3 = Mesh(mesh)
division_3 = Division(A=lng, B=2)
division_4 = Division(A=lng_2, B=2)
demesh_2 = DeconstructMesh(Mesh=mesh_3)  # -> Vertices, Faces, Colours, Normals
split_2 = SplitList(List=split.Negative, Index=division_3)  # -> simplify(ListA), simplify(ListB)
split_3 = SplitList(List=split.Positive, Index=division_4)  # -> simplify(ListA), simplify(ListB)
panel_2 = Panel("0.04")
num_12 = Number(Slider(0.5, range=0..1))
crv_cp_2 = CurveClosestPoint(Point=demesh_2.Vertices, Curve=crv_4)  # -> Point, Parameter, Distance
mesh_4 = Mesh(mesh)
smaller_2 = SmallerThan(FirstNumber=crv_cp_2.Distance, SecondNumber="0.06")  # -> SmallerThan, OrEqualTo
wbedges = WeaverbirdsMeshEdges(MeshOrPolylines=mesh_4)
split_4 = SplitTree(Data=split_2.ListA, Masks=flatten("{1}"))  # -> Positive, Negative
split_5 = SplitTree(Data=split_2.ListB, Masks=flatten("{1}"))  # -> Positive, Negative
split_6 = SplitTree(Data=split_3.ListA, Masks=flatten("{0}"))  # -> Positive, Negative
intersection = SetIntersection(SetA=split.Positive, SetB=flatten(split.Negative))
cset = CreateSet(List=flatten(cull))  # -> Set, Map
split_7 = SplitTree(Data=cull, Masks=flatten("{2, 3}"))  # -> Positive, Negative
python_2 = GhPythonScript(lines=wbedges)  # -> out, lines; inputs lines: list
# ---------- python_2: Python ----------
from compas_rhino.utilities import get_line_coordinates

lines = get_line_coordinates(lines)
# ---------- end python_2 ----------
cull_2 = CullPattern(List=demesh_2.Vertices, CullPattern=smaller_2.OrEqualTo)
data = Data(python_2.lines)
pt = Point([split_4.Positive, split_5.Negative, split_6.Positive])
pt_2 = Point(intersection)
pt_3 = Point(cset.Set)
pt_4 = Point(split_7.Positive)
pt_5 = Point(python.a)
pt_6 = Point([split_4.Negative, split_5.Positive])
pt_7 = Point(cull_2)
data_2 = Data(data)
pt_8 = Point(pt_3)
cset_2 = CreateSet(List=flatten(pt_8))  # -> Set, Map
pt_9 = Point(cset_2.Set)
pt_10 = Point(pt_9)
python_3 = GhPythonScript(lines=data_2, anchor_points=pt_10)  # -> out, form, force; inputs lines: list, anchor_points: list
# ---------- python_3: Python ----------
from compas_tna.diagrams import FormDiagram
from compas_tna.diagrams import ForceDiagram

from compas_rhino.utilities import get_point_coordinates
from compas.utilities import geometric_key


form = FormDiagram.from_lines(lines, precision="6f")

###

points = get_point_coordinates(anchor_points)
points_gkeys = set([geometric_key(point) for point in points])
gkey_vkey = form.gkey_key()

for gkey in points_gkeys:
    vkey = gkey_vkey[gkey]
    form.vertex_attribute(key=vkey, name="is_anchor", value=True)

form.update_boundaries()

###

force = ForceDiagram.from_formdiagram(form)
# ---------- end python_3 ----------
data_3 = Data(python_3.form)
data_4 = Data(python_3.force)
num_13 = Number(num_12)
data_5 = Data(data_4)
data_6 = Data(data_3)
python_4 = GhPythonScript(unload=Toggle(False))  # -> out
# ---------- python_4: Python ----------
from compas_ghpython.utilities import unload_modules

if unload:
    unload_modules("compas_tna")
    unload_modules("compas")
    print("unloaded")
# ---------- end python_4 ----------
python_5 = GhPythonScript()  # -> out, a
# ---------- python_5: Python ----------
import compas_tna.equilibrium

from scriptcontext import sticky as st
from compas.rpc import Proxy


proxy = Proxy("compas_tna.equilibrium")
# proxy.stop_server()

st["tna_proxy"] = proxy
# ---------- end python_5 ----------
python_6 = GhPythonScript(form=data_6, force=data_5, zmax=num_13)  # -> out, form, force, scale
# ---------- python_6: Python ----------
from scriptcontext import sticky
from compas_tna.diagrams import FormDiagram
from compas_tna.diagrams import ForceDiagram

eq = sticky["tna_proxy"]
    
formdata, forcedata = eq.horizontal_numpy_proxy(form.data, force.data)
formdata, scale = eq.vertical_from_zmax_proxy(formdata, zmax)

print("scale", scale)

form.data = formdata
force.data = forcedata
# ---------- end python_6 ----------
panel_3 = Panel(python_4)
panel_4 = Panel(python_5.out)
data_7 = Data(python_6.form)
data_8 = Data(data_7)
data_9 = Data(data_7)
panel_5 = Panel(python_6.out)
bool_3 = Boolean(Toggle(False))
python_7 = GhPythonScript(form=data_8)  # -> out, anchor_points, mesh
# ---------- python_7: Python ----------
from compas_ghpython.artists import MeshArtist

artist = MeshArtist(form)

keys = list(form.anchors())

anchor_points = artist.draw_vertices(keys=keys)
mesh = artist.draw_mesh()
# ---------- end python_7 ----------
python_8 = GhPythonScript(mesh=data_9, y=bool_3)  # -> out, a
# ---------- python_8: Python ----------
from compas_ghpython.artists import MeshArtist

artist = MeshArtist(mesh)
a = artist.draw_faces()

if y:
    mesh.to_json("/Users/arpj/Desktop/mesh.json")
# ---------- end python_8 ----------
pt_11 = Point(python_7.anchor_points)
mesh_5 = Mesh(python_7.mesh)
mesh_6 = Mesh(python_8.a)
